# Grasshopper definition performance_evaluation.gh (Grasshopper 1.0.7)
# plug-ins: Karamba3D, Pufferfish, Kangaroo2 Components, Weaverbird, NGon, Human

info = Info()  # -> info
#   port info: Environment info.
# ---------- info: Python ----------
"""
Displays information about the active COMPAS environment.
"""

import compas_bootstrapper
from ghpythonlib.componentbase import executingcomponent as component

import compas


class CompasInfo(component):
    def RunScript(self):
        self.Message = "COMPAS v{}".format(compas.__version__)
        info = "COMPAS Version: {}\nEnvironment: {}"
        return info.format(compas.__version__, compas_bootstrapper.ENVIRONMENT_NAME)
# ---------- end info ----------

# ---- group: main path
panel = Panel("D:/OneDrive - Delft University of Technology/Thesis/python_others/my_code/DATASETS/DATASET_30_DRIFT_opt/")

# ---- group: MATERIAL
list = ValueList({"steel": 0, "masonry": 1}, selected="masonry")
load_in_newtons = Panel("50000")

# ---- group: REPLICATE VAULT?
list_2 = ValueList({"replicate_smaller_vaults": 1, "DO NOT_replicate": 0}, selected="DO NOT_replicate")
distance_between_vaults = Panel("0.2")
number_of_replica_vaults = Panel("2")
list_3 = ValueList({"repeat_in_y_direction": 0, "repeat_in_x_direction": 1}, selected="repeat_in_y_direction")

# ---- group: mesh to test (eg. 5 means mesh_5) / DATASET
list_4 = ValueList({"test_no_crease": 0, "dataset": 1}, selected="dataset")

# ---- group: mesh to test (eg. 5 means mesh_5) / THICKNESS
list_5 = ValueList({"test_thickness": 0, "thickness_dataset": 1}, selected="test_thickness")

# ----
# RESULTS
panel_2 = Panel("1")

# ---- group: mesh to test (eg. 5 means mesh_5) / 10000 (dataset number)
number_slider = Slider(28, range=1..10000)

# ---- group: mesh to test (eg. 5 means mesh_5)
# TURN ON for generation of dataset
number_slider_2 = Slider(1, range=1..1000)
run = BooleanToggle(False)
python = PythonScript(Run=run, Target=number_slider, Interval=number_slider_2)  # -> Counter; inputs Run: Boolean
# ---------- python: Python ----------
import Grasshopper as gh

def updateComponent(interval):
    
    """ Update this component similar to using a grasshopper timer """
    
    def callBack(e):
        ghenv.Component.ExpireSolution(False)
        
    ghenv.Component.OnPingDocument().ScheduleSolution(interval,
    gh.Kernel.GH_Document.GH_ScheduleDelegate(callBack))

# Instantiate or reset persistent counter variable
if "count" not in globals() or not Run:
    count = 0

# Update the variable and component
if Run:
    if count < Target:
        count +=1
        updateComponent(Interval)
    elif count == Target:
        count = 0

# Output counter
Counter = count
# ---------- end python ----------
number_slider_3 = Slider(2058, range=0..9999)
panel_3 = Panel("5355")
panel_4 = Panel(python)

# ---- group: MATERIAL / masonry properties
poisson_ratio = Panel("0.15")
density_in_kg_m3 = Panel("1219.4")
young_s_modulus_in_n_m2 = Panel("3.2e9")

# ---- group: MATERIAL / steel properties
poisson_ratio_2 = Panel("0.29")
density_in_kg_m3_2 = Panel("7500")
young_s_modulus_in_n_m2_2 = Panel("210e9")

# ----
# LOAD/SAVE PATH
panel_5 = Panel("01_performance_evaluation/")
concat = Concatenate(FragmentA=panel, FragmentB="00_geometry_generation/")
concat_2 = Concatenate(FragmentA=panel, FragmentB=panel_5)

# ---- group: Young's Modulus
filter = StreamFilter(Gate=list, Stream0=young_s_modulus_in_n_m2_2, Stream1=young_s_modulus_in_n_m2)

# ---- group: poisson ratio
filter_2 = StreamFilter(Gate=list, Stream0=poisson_ratio_2, Stream1=poisson_ratio)

# ---- group: density
filter_3 = StreamFilter(Gate=list, Stream0=density_in_kg_m3_2, Stream1=density_in_kg_m3)

# ----
displacement_direction = ValueList({"y": 1, "x": 0, "z": 2}, selected="z")
number_of_planes_to_cut_from = Slider(30, range=0..40)

panel_6 = Panel(Slider(999, range=0..999))

# ---- group: DATASET MESHES IMPORTED FROM PYTHON
concatenate = Concatenate(FragmentA=concat, FragmentB="mesh/")
panel_7 = Panel(concatenate)
# DISPLAYING CREASES IN GRASSHOPPER
panel_8 = Panel(".json")
concat_3 = Concatenate(FragmentA="mesh_", FragmentB=panel_6, FragmentC=".json")
concat_4 = Concatenate(FragmentA="mesh_", FragmentB=panel_6, FragmentC="_edges", FragmentD=panel_8)
concatenate_2 = Concatenate(FragmentA=panel_7, FragmentB=concat_3)
concatenate_3 = Concatenate(FragmentA=panel_7, FragmentB=concat_4)
file_path_mesh = Panel(concatenate_2)
file_path_mesh_2 = Panel(concatenate_3)

# ---- group: displaying crease column/row numbers
concatenate_4 = Concatenate(FragmentA="mesh_", FragmentB=panel_6)
ghpython_script = GhPythonScript(sel=concatenate_4)  # -> out, columns, rows
# ---------- ghpython_script: Python ----------
import rhinoscriptsyntax as rs
import json
import os


# main file path
main_path = 'D:/OneDrive - Delft University of Technology/Thesis/python/00_geometry_generation/mesh/'


# specific_path_mesh
additional_string_mesh = 'master_mesh_dict.json'
result_path_master_mesh = os.path.join(main_path,additional_string_mesh)

# Load edge data from JSON file
with open(result_path_master_mesh, 'r') as file:
    master_mesh_dict = json.load(file)

#print(master_mesh_dict)

#sel = 'mesh_80'
mesh_selected = master_mesh_dict[sel]
columns =  master_mesh_dict[sel][0]
rows = master_mesh_dict[sel][1]
# ---------- end ghpython_script ----------
columns = Panel(ghpython_script.columns)
rows = Panel(ghpython_script.rows)

# ----
panel_9 = Panel("""Max_Displacement/mm
Max_Shear_Force/KN
Max_Bending_Moment/KNm
Max_Shear_Stress/MPa
Max_Bending_Stress/MPa
Max_Principal_Stress/MPa
Avg_Displacement/mm
Avg_Shear_Force/KN
Avg_Bending_Moment/KNm
Interstorey_Drift_Ratios
Interstorey_Drift_Failure
Utilization
Buckling_Load_Factor
Max_Compresive_Stress/MPa
Max_Tensile_Stress/MPa""")

# ---- group: Manual
thickness_of_vault_mm = Panel("95")

# ---- group: INPUT THICKNESS OF WALL
thickness_of_wall_mm = Panel("250")
shear_wall_length_m = Panel("1")

# ----
toggle_different_cuts = Slider(0, range=0..3)
value_list = ValueList({"Display sections separately": 0, "Display sections together": 1}, selected="Display sections together")

list_6 = ValueList({"no_walls": 0, "column_walls": 1, "shear_walls": 2}, selected="shear_walls")
list_7 = ValueList({"1_storey": 1, "3_storey": 3}, selected="1_storey")

# ---- group: manually select
list_8 = ValueList({"MX": 0, "MY": 1, "MZ": 2, "RMX": 3, "RMY": 4, "RMZ": 5}, selected="MY")

# ----
# x - Seismic load in x
# y - Seismic load in y
x_or_y = Panel("x")
ghpython_script_2 = GhPythonScript(input=x_or_y)  # -> out, output
# ---------- ghpython_script_2: Python ----------
import rhinoscriptsyntax as rs
if input == 'x':
    output = 1
elif input == 'y':
    output = 0
else: 
    output == 'error'
# ---------- end ghpython_script_2 ----------

concatenate_5 = Concatenate(FragmentA=concat_2, FragmentB="dataset_separate_modal_analysis/")
concat_5 = Concatenate(FragmentA="mesh_", FragmentB=panel_6, FragmentD="_ma_", FragmentE=x_or_y, FragmentC=".json")
concatenate_6 = Concatenate(FragmentA=concatenate_5, FragmentB=concat_5)
file_path_mesh_3 = Panel(concatenate_6)

concatenate_7 = Concatenate(FragmentA=concat_2, FragmentB="dataset_separate/")
concat_6 = Concatenate(FragmentA="mesh_", FragmentB=panel_6, FragmentD="_pa_", FragmentE=x_or_y, FragmentC=".json")
concatenate_8 = Concatenate(FragmentA=concatenate_7, FragmentB=concat_6)
file_path_mesh_4 = Panel(concatenate_8)

# ---- group: autoselect
ghpython_script_3 = GhPythonScript(input=x_or_y)  # -> out, output
# ---------- ghpython_script_3: Python ----------
import rhinoscriptsyntax as rs
if input == 'y':
    output = 1
elif input == 'x':
    output = 0
else: 
    output == 'error'
# ---------- end ghpython_script_3 ----------

# ----
beam_depth_mm = Panel("1000")
beam_width_mm = Panel("250")

# ---- group: number of natural modes to calculate
modes = Slider(20, range=0..20)

# ---- group: you can set the number of the eigenmode here for visualization
mode_number = Slider(0, range=0..100)

# ----
panel_10 = Panel(distance_between_vaults)
division = Division(A=beam_depth_mm, B="1000")

# ---- group: column / defining number of stories\
number_of_storeys = Slider(2, range=0..10)
storey_height = Slider(3, range=0..10)
series = Series(Start=0, Step=storey_height, Count=number_of_storeys)
panel_11 = Panel(series)
unit_z = UnitZ(Factor=series)

# ----
panel_12 = Panel("0")

# ---- group: MASS OF STRUCTURE / area_of_cross_section_of beams
division_2 = Division(A=beam_depth_mm, B="1000")
division_3 = Division(A=beam_width_mm, B="1000")
multiplication = Multiplication(A=division_2, B=division_3)

# ----
panel_13 = Panel("183.6987")
panel_14 = Panel("255.25")

# ---- group: force in y axis distributed in points loads
panel_15 = Panel("0")
panel_16 = Panel("1")

# ---- group: gravity load axis distributed in points loads
panel_17 = Panel("0")  # disabled
panel_18 = Panel("1")  # disabled

# ---- group: force in y axis distributed in points loads / seisimic x or y ?
unit_y = UnitY(Factor=1)
unit_x = UnitX(Factor=1)
# RESPONSE SPECTRUM ANALYSIS (RSA)
stream_filter = StreamFilter(Gate=ghpython_script_2.output, Stream0=unit_y, Stream1=unit_x)

# ----
X = UnitX(Factor=expr("-x", 1))
Y = UnitY(Factor=expr("-x", 1))
X_2 = UnitX(Factor=1)
Y_2 = UnitY(Factor=1)

# ---- group: karamba assembly / material
multiplication_2 = Multiplication(A=filter_3, B="0.0098066359")

material_properties_karamba3d = MaterialPropertiesKaramba3D(
    FamilyOfMaterial="Steel",
    Name="S235",
    YoungsModulus_kN_cm2="320",
    InPlaneShearModulus_kN_cm2="128",
    TransverseShearModulus_kN_cm2=8076,
    SpecificWeight_kN_m3=multiplication_2,
    CoefficientOfThermalExpansion_1_C=1.2e-05,
    TensileStrength_kN_cm2="0.024",
    CompressiveStrength_kN_cm2="-0.59",
    StrengthHypothesis="MISES",
    mode="Isotrop")

# ---- group: karamba assembly
panel_19 = Panel("1000")
panel_20 = Panel(thickness_of_wall_mm)

# ---- group: karamba assembly / columns
panel_21 = Panel(thickness_of_wall_mm)
panel_22 = Panel("1000")

# ----
loads = LoadsKaramba3D(Vector=Vector(0, 0, -1), LCase="seismic", mode="Gravity")

# ---- group: karamba assembly / beams / walls_karamba
panel_23 = Panel("beams")

# ---- group: karamba assembly / columns / walls_karamba
panel_24 = Panel("columns")

# ---- group: you can set the number of the eigenmode here
# KARAMBA - MODAL ANALYSIS
panel_25 = Panel(mode_number)

# ----
Z = UnitZ(Factor="0.2")

# ---- group: mesh2000_1storey_95_nocolumns
panel_26 = Panel("""* 2. EIGENVALUE ANALYSIS:

#          MODE        LAMBDA         OMEGA     FREQUENCY        PERIOD

# ------------- ------------- ------------- ------------- -------------

              1       507.439       22.5264       3.58519      0.278925

              2       1530.53        39.122       6.22646      0.160605

              3       1595.43       39.9428       6.35709      0.157305

              4        2817.3       53.0783       8.44767      0.118376

              5       3771.01       61.4086       9.77348      0.102318

              6       4396.61       66.3069       10.5531     0.0947591

              7       6378.24       79.8639       12.7107     0.0786737

              8       6382.08       79.8879       12.7146       0.07865

              9       10031.2       100.156       15.9403     0.0627339

             10       11074.1       105.233       16.7484     0.0597071

             11       11872.4        108.96       17.3416     0.0576649

             12       12942.7       113.766       18.1065     0.0552289

             13         16919       130.073       20.7018     0.0483051

             14       17755.7        133.25       21.2075     0.0471532

             15         20997       144.903       23.0621     0.0433612

             16         23011       151.694       24.1428     0.0414202

             17       27865.7        166.93       26.5677     0.0376396

             18       30831.9        175.59        27.946     0.0357832

             19       37015.2       192.393       30.6203      0.032658

             20       39656.5        199.14        31.694     0.0315517



* 3. TOTAL MASS OF THE STRUCTURE:

# The total masses (translational and rotational) of the structure

# including the masses at fixed DOFs (if any).

#            MX            MY            MZ           RMX           RMY           RMZ

# ------------- ------------- ------------- ------------- ------------- -------------

        14390.5       14390.5       14390.5        204817        122298        326775

* 4. TOTAL FREE MASS OF THE STRUCTURE:

# The total masses (translational and rotational) of the structure

# including only the masses at free DOFs.

#            MX            MY            MZ           RMX           RMY           RMZ

# ------------- ------------- ------------- ------------- ------------- -------------

        11960.3       11960.3       11960.3        142386       79704.2        221866

* 5. CENTER OF MASS:

# The center of mass of the structure, calculated from free masses.

#             X             Y             Z

# ------------- ------------- -------------

              5       6.49224      0.154573

* 6. MODAL PARTICIPATION FACTORS:

# The participation factor for a certain mode 'a' in a certain direction 'i'

# indicates how strongly displacement along (or rotation about)

# the global axes is represented in the eigenvector of that mode.

#          MODE            MX            MY            MZ           RMX           RMY           RMZ

# ------------- ------------- ------------- ------------- ------------- ------------- -------------

              1             0     -0.004454      -1.83788      -1.81296             0             0

              2     0.0804029             0             0             0       -3.5036   -0.00752862

              3             0    -0.0616861      0.433883      -5.35309             0             0

              4     0.0273363             0             0             0     -0.596656        0.1017

              5             0     0.0206913     -0.911117      0.183764             0             0

              6             0    -0.0525215      0.519627     -0.349091             0             0

              7             0     0.0327735      0.079421      -1.79607   3.46892e-11             0

              8     0.0190461             0             0  -4.75359e-11      -1.11622    -0.0366574

              9             0     -0.159656      0.212676      -5.03579             0             0

             10             0     0.0549225      0.351112        2.1514             0             0

             11      0.139622             0             0             0       1.98128      0.153982

             12      0.184542             0             0             0       2.33335     0.0392773

             13             0     0.0276656     0.0538151     -0.564342             0             0

             14     -0.134223             0             0             0       1.59495     -0.406499

             15             0    -0.0235181     -0.608493       0.59167             0             0

             16    0.00608788             0             0             0       1.25273      0.130969

             17    -0.0275923             0             0             0      0.772391       0.41876

             18             0     -0.044501     -0.183876     -0.729045             0             0

             19             0      0.339479      0.284842         3.834             0             0

             20     0.0214104             0             0             0      0.260706      0.343445

* 7. MODAL PARTICIPATION MASSES:

# The modal participation masses for each mode.

#          MODE            MX            MY            MZ           RMX           RMY           RMZ

# ------------- ------------- ------------- ------------- ------------- ------------- -------------

              1             0     0.0400086       6812.23       6628.76             0             0

              2       21.5893             0             0             0       40994.6       0.18929

              3             0       8.43514       417.315       63522.6             0             0

              4       2.09652             0             0             0       998.778       29.0177

              5             0       0.96881        1878.5        76.416             0             0

              6             0       6.56582       642.686       290.063             0             0

              7             0       2.40357       14.1151       7218.72             0             0

              8      0.954889             0             0             0       3279.73       3.53723

              9             0       22.2955       39.5623       22180.9             0             0

             10             0       3.28922       134.426       5047.04             0             0

             11       31.2529             0             0             0       6293.21       38.0122

             12       39.2392             0             0             0       6273.15       1.77751

             13             0      0.559391       2.11662       232.766             0             0

             14       10.3822             0             0             0       1465.99       95.2255

             15             0      0.754245       504.916       477.383             0             0

             16     0.0373323             0             0             0       1580.76       17.2778

             17       0.43335             0             0             0       339.578       99.8151

             18             0       1.57256       26.8484       422.064             0             0

             19             0       88.1507       62.0596       11243.6             0             0

             20      0.278381             0             0             0       41.2755       71.6316

* 8. MODAL PARTICIPATION MASSES (cumulative):

# The cumulative modal participation masses for each mode.

#          MODE            MX            MY            MZ           RMX           RMY           RMZ

# ------------- ------------- ------------- ------------- ------------- ------------- -------------

              1             0     0.0400086       6812.23       6628.76             0             0

              2       21.5893     0.0400086       6812.23       6628.76       40994.6       0.18929

              3       21.5893       8.47514       7229.55       70151.3       40994.6       0.18929

              4       23.6859       8.47514       7229.55       70151.3       41993.3        29.207

              5       23.6859       9.44395       9108.04       70227.7       41993.3        29.207

              6       23.6859       16.0098       9750.73       70517.8       41993.3        29.207

              7       23.6859       18.4133       9764.85       77736.5       41993.3        29.207

              8       24.6407       18.4133       9764.85       77736.5       45273.1       32.7442

              9       24.6407       40.7088       9804.41       99917.4       45273.1       32.7442

             10       24.6407       43.9981       9938.83        104964       45273.1       32.7442

             11       55.8937       43.9981       9938.83        104964       51566.3       70.7564

             12       95.1329       43.9981       9938.83        104964       57839.4       72.5339

             13       95.1329       44.5574       9940.95        105197       57839.4       72.5339

             14       105.515       44.5574       9940.95        105197       59305.4       167.759

             15       105.515       45.3117       10445.9        105675       59305.4       167.759

             16       105.552       45.3117       10445.9        105675       60886.2       185.037

             17       105.986       45.3117       10445.9        105675       61225.8       284.852

             18       105.986       46.8843       10472.7        106097       61225.8       284.852

             19       105.986       135.035       10534.8        117340       61225.8       284.852

             20       106.264       135.035       10534.8        117340         61267       356.484

* 9. MODAL PARTICIPATION MASS RATIOS (%):

# The modal participation mass ratios (%) for each mode.

#          MODE            MX            MY            MZ           RMX           RMY           RMZ

# ------------- ------------- ------------- ------------- ------------- ------------- -------------

              1             0   0.000334513       56.9572        4.6555             0             0

              2      0.180509             0             0             0       51.4334   8.53172e-05

              3             0     0.0705263       3.48918        44.613             0             0

              4     0.0175291             0             0             0       1.25311     0.0130789

              5             0    0.00810024       15.7062     0.0536683             0             0

              6             0     0.0548969       5.37351      0.203716             0             0

              7             0     0.0200963      0.118017       5.06984             0             0

              8    0.00798385             0             0             0       4.11488    0.00159431

              9             0      0.186413      0.330781       15.5781             0             0

             10             0     0.0275013       1.12394       3.54463             0             0

             11      0.261306             0             0             0       7.89571      0.017133

             12       0.32808             0             0             0       7.87054   0.000801163

             13             0    0.00467708     0.0176971      0.163476             0             0

             14     0.0868054             0             0             0       1.83929     0.0429203

             15             0    0.00630626       4.22162      0.335274             0             0

             16   0.000312136             0             0             0       1.98329    0.00778748

             17    0.00362325             0             0             0      0.426048      0.044989

             18             0     0.0131482       0.22448      0.296423             0             0

             19             0       0.73703      0.518882       7.89657             0             0

             20    0.00232755             0             0             0     0.0517858      0.032286

* 10. MODAL PARTICIPATION MASS RATIOS (%) (cumulative):

# The cumulative modal participation mass ratios (%) for each mode.

#          MODE            MX            MY            MZ           RMX           RMY           RMZ

# ------------- ------------- ------------- ------------- ------------- ------------- -------------

              1             0   0.000334513       56.9572        4.6555             0             0

              2      0.180509   0.000334513       56.9572        4.6555       51.4334   8.53172e-05

              3      0.180509     0.0708609       60.4464       49.2685       51.4334   8.53172e-05

              4      0.198038     0.0708609       60.4464       49.2685       52.6865     0.0131643

              5      0.198038     0.0789611       76.1525       49.3222       52.6865     0.0131643

              6      0.198038      0.133858       81.5261       49.5259       52.6865     0.0131643

              7      0.198038      0.153954       81.6441       54.5958       52.6865     0.0131643

              8      0.206022      0.153954       81.6441       54.5958       56.8014     0.0147586

              9      0.206022      0.340367       81.9749       70.1738       56.8014     0.0147586

             10      0.206022      0.367869       83.0988       73.7184       56.8014     0.0147586

             11      0.467328      0.367869       83.0988       73.7184       64.6971     0.0318915

             12      0.795408      0.367869       83.0988       73.7184       72.5676     0.0326927

             13      0.795408      0.372546       83.1165       73.8819       72.5676     0.0326927

             14      0.882213      0.372546       83.1165       73.8819       74.4069      0.075613

             15      0.882213      0.378852       87.3381       74.2172       74.4069      0.075613

             16      0.882526      0.378852       87.3381       74.2172       76.3902     0.0834005

             17      0.886149      0.378852       87.3381       74.2172       76.8162      0.128389

             18      0.886149         0.392       87.5626       74.5136       76.8162      0.128389

             19      0.886149       1.12903       88.0815       82.4102       76.8162      0.128389

             20      0.888476       1.12903       88.0815       82.4102        76.868      0.160676""")  # disabled

# ---- group: mesh2000_3storey_95mm_
# COPY PASTED REPORT FILE
panel_27 = Panel("""* 2. EIGENVALUE ANALYSIS:

#          MODE        LAMBDA         OMEGA     FREQUENCY        PERIOD

# ------------- ------------- ------------- ------------- -------------

              1       243.681       15.6103       2.48445      0.402503

              2       285.631       16.9006       2.68982      0.371772

              3       322.326       17.9535       2.85738      0.349971

              4       702.949       26.5132        4.2197      0.236983

              5       924.486       30.4054       4.83916      0.206647

              6       1069.81        32.708       5.20564      0.192099

              7       1947.48       44.1303       7.02355      0.142378

              8        2802.2       52.9358         8.425      0.118694

              9        3185.1       56.4366       8.98217      0.111332

             10       4401.22       66.3417       10.5586     0.0947095

             11       4468.39        66.846       10.6389     0.0939949

             12       7124.59       84.4073       13.4338     0.0744389

             13       7607.29       87.2198       13.8815     0.0720385

             14       8643.06       92.9681       14.7963     0.0675843

             15       9007.12       94.9058       15.1047     0.0662044

             16         12024       109.654        17.452        0.0573

             17       12359.7       111.174       17.6939     0.0565166

             18         14885       122.004       19.4175     0.0514999

             19       16536.9       128.596       20.4667     0.0488599

             20       18934.2       137.601       21.8999     0.0456622



* 3. TOTAL MASS OF THE STRUCTURE:

# The total masses (translational and rotational) of the structure

# including the masses at fixed DOFs (if any).

#            MX            MY            MZ           RMX           RMY           RMZ

# ------------- ------------- ------------- ------------- ------------- -------------

        16856.4       16856.4       16856.4        270462        167877        421735

* 4. TOTAL FREE MASS OF THE STRUCTURE:

# The total masses (translational and rotational) of the structure

# including only the masses at free DOFs.

#            MX            MY            MZ           RMX           RMY           RMZ

# ------------- ------------- ------------- ------------- ------------- -------------

        16023.1       16023.1       16023.1        239271        144426        383332

* 5. CENTER OF MASS:

# The center of mass of the structure, calculated from free masses.

#             X             Y             Z

# ------------- ------------- -------------

              5       6.49286       3.12179

* 6. MODAL PARTICIPATION FACTORS:

# The participation factor for a certain mode 'a' in a certain direction 'i'

# indicates how strongly displacement along (or rotation about)

# the global axes is represented in the eigenvector of that mode.

#          MODE            MX            MY            MZ           RMX           RMY           RMZ

# ------------- ------------- ------------- ------------- ------------- ------------- -------------

              1             0      -0.34153      -1.67288      -1.12199             0             0

              2      0.981199             0             0             0     -0.426298  -0.000544414

              3             0      0.967451     -0.129523       0.38383             0             0

              4    0.00663396             0             0             0     0.0673912       6.49028

              5             0      -0.35408     -0.242555        5.1503             0             0

              6       0.39421             0             0             0       3.53671     -0.289507

              7     0.0387196             0             0             0       0.57297      0.570552

              8             0    0.00221549      0.622801     -0.118849             0             0

              9             0    0.00579351      0.587908      -0.56232             0             0

             10             0   -0.00773946     0.0620508       1.73007             0             0

             11    -0.0219852             0             0             0      -1.27176    -0.0641007

             12             0    -0.0669023     -0.284018       1.83808             0             0

             13             0      0.106877     -0.110042      -3.93647             0             0

             14     0.0273873             0             0             0      0.488278      0.162574

             15     -0.127035             0             0             0      -2.99637    0.00738348

             16    -0.0230729             0             0             0      -1.27679      0.414197

             17             0    0.00206375    -0.0874117     -0.109882             0             0

             18             0   0.000777835     -0.502415     0.0300315             0             0

             19   -0.00395985             0             0             0       0.83187     0.0474018

             20             0   -0.00658842      0.494771       0.33754             0             0

* 7. MODAL PARTICIPATION MASSES:

# The modal participation masses for each mode.

#          MODE            MX            MY            MZ           RMX           RMY           RMZ

# ------------- ------------- ------------- ------------- ------------- ------------- -------------

              1             0       355.513       8529.56       3836.88             0             0

              2       15346.1             0             0             0       2896.75    0.00472436

              3             0         15220       272.806       2395.71             0             0

              4      0.398561             0             0             0       41.1297        381484

              5             0        413.87       194.215         87564             0             0

              6        632.16             0             0             0       50882.7        340.95

              7       5.41275             0             0             0       1185.27       1175.29

              8             0     0.0153373       1212.02       44.1367             0             0

              9             0      0.117706       1212.09       1108.88             0             0

             10             0      0.194271       12.4877       9707.61             0             0

             11       1.57157             0             0             0       5258.78       13.3597

             12             0       5.07286       91.4243       3829.14             0             0

             13             0       20.4546       21.6837         27748             0             0

             14       1.10842             0             0             0        352.32       39.0578

             15       27.8832             0             0             0       15512.8     0.0941935

             16      0.425274             0             0             0       1302.28        137.05

             17             0    0.00420939       7.55173       11.9332             0             0

             18             0    0.00155322       648.009       2.31532             0             0

             19     0.0295291             0             0             0       1303.17       4.23138

             20             0     0.0610256       344.158       160.177             0             0

* 8. MODAL PARTICIPATION MASSES (cumulative):

# The cumulative modal participation masses for each mode.

#          MODE            MX            MY            MZ           RMX           RMY           RMZ

# ------------- ------------- ------------- ------------- ------------- ------------- -------------

              1             0       355.513       8529.56       3836.88             0             0

              2       15346.1       355.513       8529.56       3836.88       2896.75    0.00472436

              3       15346.1       15575.5       8802.37       6232.59       2896.75    0.00472436

              4       15346.5       15575.5       8802.37       6232.59       2937.88        381484

              5       15346.5       15989.4       8996.58       93796.6       2937.88        381484

              6       15978.7       15989.4       8996.58       93796.6       53820.5        381825

              7       15984.1       15989.4       8996.58       93796.6       55005.8        383001

              8       15984.1       15989.4       10208.6       93840.7       55005.8        383001

              9       15984.1       15989.5       11420.7       94949.6       55005.8        383001

             10       15984.1       15989.7       11433.2        104657       55005.8        383001

             11       15985.7       15989.7       11433.2        104657       60264.6        383014

             12       15985.7       15994.8       11524.6        108486       60264.6        383014

             13       15985.7       16015.2       11546.3        136234       60264.6        383014

             14       15986.8       16015.2       11546.3        136234       60616.9        383053

             15       16014.7       16015.2       11546.3        136234       76129.7        383053

             16       16015.1       16015.2       11546.3        136234         77432        383190

             17       16015.1       16015.2       11553.8        136246         77432        383190

             18       16015.1       16015.2       12201.8        136249         77432        383190

             19       16015.1       16015.2       12201.8        136249       78735.2        383194

             20       16015.1       16015.3         12546        136409       78735.2        383194

* 9. MODAL PARTICIPATION MASS RATIOS (%):

# The modal participation mass ratios (%) for each mode.

#          MODE            MX            MY            MZ           RMX           RMY           RMZ

# ------------- ------------- ------------- ------------- ------------- ------------- -------------

              1             0       2.21875       53.2327       1.60357             0             0

              2       95.7748             0             0             0        2.0057   1.23245e-06

              3             0       94.9876       1.70257       1.00126             0             0

              4    0.00248741             0             0             0     0.0284781        99.518

              5             0       2.58295       1.21209       36.5962             0             0

              6       3.94529             0             0             0        35.231     0.0889437

              7     0.0337808             0             0             0       0.82068      0.306599

              8             0   9.57196e-05       7.56416     0.0184463             0             0

              9             0   0.000734601       7.56462       0.46344             0             0

             10             0    0.00121244     0.0779351       4.05717             0             0

             11     0.0098081             0             0             0       3.64116    0.00348516

             12             0     0.0316596      0.570576       1.60034             0             0

             13             0      0.127656      0.135327       11.5969             0             0

             14    0.00691759             0             0             0      0.243945      0.010189

             15      0.174018             0             0             0        10.741   2.45723e-05

             16    0.00265412             0             0             0      0.901698     0.0357522

             17             0   2.62707e-05     0.0471301    0.00498732             0             0

             18             0   9.69358e-06       4.04421   0.000967658             0             0

             19    0.00018429             0             0             0      0.902314    0.00110384

             20             0   0.000380859       2.14788      0.066944             0             0

* 10. MODAL PARTICIPATION MASS RATIOS (%) (cumulative):

# The cumulative modal participation mass ratios (%) for each mode.

#          MODE            MX            MY            MZ           RMX           RMY           RMZ

# ------------- ------------- ------------- ------------- ------------- ------------- -------------

              1             0       2.21875       53.2327       1.60357             0             0

              2       95.7748       2.21875       53.2327       1.60357        2.0057   1.23245e-06

              3       95.7748       97.2063       54.9353       2.60483        2.0057   1.23245e-06

              4       95.7773       97.2063       54.9353       2.60483       2.03418       99.5181

              5       95.7773       99.7893       56.1474       39.2011       2.03418       99.5181

              6       99.7225       99.7893       56.1474       39.2011       37.2652        99.607

              7       99.7563       99.7893       56.1474       39.2011       38.0859       99.9136

              8       99.7563       99.7894       63.7116       39.2195       38.0859       99.9136

              9       99.7563       99.7901       71.2762       39.6829       38.0859       99.9136

             10       99.7563       99.7913       71.3541       43.7401       38.0859       99.9136

             11       99.7661       99.7913       71.3541       43.7401        41.727       99.9171

             12       99.7661        99.823       71.9247       45.3405        41.727       99.9171

             13       99.7661       99.9507         72.06       56.9374        41.727       99.9171

             14       99.7731       99.9507         72.06       56.9374        41.971       99.9273

             15       99.9471       99.9507         72.06       56.9374        52.712       99.9273

             16       99.9497       99.9507         72.06       56.9374       53.6137        99.963

             17       99.9497       99.9507       72.1072       56.9424       53.6137        99.963

             18       99.9497       99.9507       76.1514       56.9433       53.6137        99.963

             19       99.9499       99.9507       76.1514       56.9433        54.516       99.9641

             20       99.9499       99.9511       78.2992       57.0103        54.516       99.9641""")  # disabled

# ---- group: mesh2000_1storey_60mm
panel_28 = Panel("""* 2. EIGENVALUE ANALYSIS:

#          MODE        LAMBDA         OMEGA     FREQUENCY        PERIOD

# ------------- ------------- ------------- ------------- -------------

              1       154.847       12.4438       1.98049      0.504926

              2       373.282       19.3205       3.07496      0.325208

              3        440.36       20.9848       3.33983      0.299417

              4       693.128       26.3273       4.19012      0.238656

              5       702.548       26.5056        4.2185      0.237051

              6       988.925       31.4472       5.00497      0.199801

              7        1334.2       36.5267        5.8134      0.172016

              8       1456.11        38.159        6.0732      0.164658

              9       2470.94       49.7086       7.91137        0.1264

             10       2796.49       52.8818       8.41641      0.118816

             11       3103.76       55.7114       8.86674      0.112781

             12       4716.31       68.6754         10.93     0.0914911

             13       5229.59       72.3159       11.5094     0.0868853

             14       5751.34       75.8376       12.0699     0.0828505

             15       6155.75       78.4586       12.4871     0.0800828

             16        7840.7       88.5478       14.0928     0.0709582

             17       8912.55       94.4063       15.0252     0.0665547

             18       10541.2        102.67       16.3405     0.0611978

             19         12136       110.164       17.5331      0.057035

             20       12692.6       112.661       17.9306     0.0557706



* 3. TOTAL MASS OF THE STRUCTURE:

# The total masses (translational and rotational) of the structure

# including the masses at fixed DOFs (if any).

#            MX            MY            MZ           RMX           RMY           RMZ

# ------------- ------------- ------------- ------------- ------------- -------------

        11260.1       11260.1       11260.1        190796        120302        294655

* 4. TOTAL FREE MASS OF THE STRUCTURE:

# The total masses (translational and rotational) of the structure

# including only the masses at free DOFs.

#            MX            MY            MZ           RMX           RMY           RMZ

# ------------- ------------- ------------- ------------- ------------- -------------

        10426.9       10426.9       10426.9        159623         96869        256253

* 5. CENTER OF MASS:

# The center of mass of the structure, calculated from free masses.

#             X             Y             Z

# ------------- ------------- -------------

              5       6.49307        3.1182

* 6. MODAL PARTICIPATION FACTORS:

# The participation factor for a certain mode 'a' in a certain direction 'i'

# indicates how strongly displacement along (or rotation about)

# the global axes is represented in the eigenvector of that mode.

#          MODE            MX            MY            MZ           RMX           RMY           RMZ

# ------------- ------------- ------------- ------------- ------------- ------------- -------------

              1             0    -0.0889149       -1.7409      -1.33403             0             0

              2      0.907716             0             0             0     -0.700202   -0.00683743

              3             0      0.940838    -0.0662206      0.748835             0             0

              4      0.749927   8.58352e-12             0  -5.78776e-11       3.27482      0.369653

              5   1.06674e-11     -0.685516     -0.271661        4.8263   4.77488e-11             0

              6     -0.023209             0             0             0     -0.139687       6.40839

              7     0.0917419             0             0             0       0.93479       1.78416

              8             0     0.0164048      0.708885     -0.333701             0             0

              9             0     0.0115093      0.616261      -1.02317             0             0

             10             0   -0.00288844      0.190162       1.66383             0             0

             11    -0.0151819             0             0             0      -1.30667     -0.146064

             12             0    0.00609913     -0.366882     -0.772822             0             0

             13     -0.230764             0             0             0      -3.54975  -0.000186477

             14             0       -0.1933    0.00412075       4.97882             0             0

             15     0.0120292             0             0             0      0.456881      -0.23505

             16    -0.0304838             0             0             0      -1.53616       0.68298

             17             0     0.0283992     -0.104736      -1.14195             0             0

             18             0   -0.00289587      0.837349      0.198969             0             0

             19             0    0.00887205      0.177399     -0.486082             0             0

             20     0.0149261             0             0             0      -0.78437    -0.0698898

* 7. MODAL PARTICIPATION MASSES:

# The modal participation masses for each mode.

#          MODE            MX            MY            MZ           RMX           RMY           RMZ

# ------------- ------------- ------------- ------------- ------------- ------------- -------------

              1             0       13.4274       5147.45       3022.55             0             0

              2       9009.19             0             0             0       5360.84      0.511177

              3             0       9435.05       46.7413       5977.05             0             0

              4       1343.59             0             0             0       25621.4        326.45

              5             0       936.283       147.037       46408.8             0             0

              6       3.27047             0             0             0       118.469        249341

              7       16.0665             0             0             0       1668.07       6076.52

              8             0      0.504743       942.501       208.855             0             0

              9             0      0.210796       604.362       1665.96             0             0

             10             0     0.0127571       55.2932       4232.93             0             0

             11      0.349045             0             0             0       2585.61       32.3084

             12             0     0.0217888       78.8408        349.83             0             0

             13        35.622             0             0             0       8428.99    2.3261e-05

             14             0       27.6221     0.0125529         18325             0             0

             15     0.0745744             0             0             0       107.577        28.473

             16      0.366684             0             0             0       931.168       184.065

             17             0        0.3109       4.22866       502.693             0             0

             18             0    0.00663783       554.986       31.3356             0             0

             19             0     0.0903513       36.1232        271.21             0             0

             20      0.222509             0             0             0       614.469       4.87849

* 8. MODAL PARTICIPATION MASSES (cumulative):

# The cumulative modal participation masses for each mode.

#          MODE            MX            MY            MZ           RMX           RMY           RMZ

# ------------- ------------- ------------- ------------- ------------- ------------- -------------

              1             0       13.4274       5147.45       3022.55             0             0

              2       9009.19       13.4274       5147.45       3022.55       5360.84      0.511177

              3       9009.19       9448.48       5194.19        8999.6       5360.84      0.511177

              4       10352.8       9448.48       5194.19        8999.6       30982.3       326.961

              5       10352.8       10384.8       5341.23       55408.4       30982.3       326.961

              6         10356       10384.8       5341.23       55408.4       31100.7        249668

              7       10372.1       10384.8       5341.23       55408.4       32768.8        255745

              8       10372.1       10385.3       6283.73       55617.2       32768.8        255745

              9       10372.1       10385.5       6888.09       57283.2       32768.8        255745

             10       10372.1       10385.5       6943.39       61516.1       32768.8        255745

             11       10372.5       10385.5       6943.39       61516.1       35354.4        255777

             12       10372.5       10385.5       7022.23         61866       35354.4        255777

             13       10408.1       10385.5       7022.23         61866       43783.4        255777

             14       10408.1       10413.1       7022.24         80191       43783.4        255777

             15       10408.2       10413.1       7022.24         80191         43891        255805

             16       10408.5       10413.1       7022.24         80191       44822.2        255990

             17       10408.5       10413.4       7026.47       80693.7       44822.2        255990

             18       10408.5       10413.5       7581.45         80725       44822.2        255990

             19       10408.5       10413.5       7617.58       80996.2       44822.2        255990

             20       10408.7       10413.5       7617.58       80996.2       45436.6        255994

* 9. MODAL PARTICIPATION MASS RATIOS (%):

# The modal participation mass ratios (%) for each mode.

#          MODE            MX            MY            MZ           RMX           RMY           RMZ

# ------------- ------------- ------------- ------------- ------------- ------------- -------------

              1             0      0.128777       49.3672       1.89356             0             0

              2       86.4037             0             0             0       5.53411   0.000199482

              3             0        90.488      0.448278       3.74449             0             0

              4       12.8858             0             0             0       26.4496      0.127394

              5             0       8.97953       1.41017        29.074             0             0

              6     0.0313658             0             0             0      0.122298       97.3028

              7      0.154088             0             0             0       1.72199        2.3713

              8             0    0.00484079       9.03917      0.130843             0             0

              9             0    0.00202166       5.79621       1.04369             0             0

             10             0   0.000122348      0.530296       2.65183             0             0

             11    0.00334756             0             0             0       2.66918      0.012608

             12             0   0.000208968      0.756132       0.21916             0             0

             13      0.341637             0             0             0       8.70143   9.07738e-09

             14             0      0.264913    0.00012039       11.4802             0             0

             15   0.000715214             0             0             0      0.111054     0.0111113

             16    0.00351673             0             0             0      0.961265     0.0718294

             17             0    0.00298172     0.0405555      0.314926             0             0

             18             0   6.36609e-05       5.32266      0.019631             0             0

             19             0   0.000866525      0.346444      0.169907             0             0

             20      0.002134             0             0             0       0.63433    0.00190378

* 10. MODAL PARTICIPATION MASS RATIOS (%) (cumulative):

# The cumulative modal participation mass ratios (%) for each mode.

#          MODE            MX            MY            MZ           RMX           RMY           RMZ

# ------------- ------------- ------------- ------------- ------------- ------------- -------------

              1             0      0.128777       49.3672       1.89356             0             0

              2       86.4037      0.128777       49.3672       1.89356       5.53411   0.000199482

              3       86.4037       90.6168       49.8155       5.63804       5.53411   0.000199482

              4       99.2895       90.6168       49.8155       5.63804       31.9837      0.127593

              5       99.2895       99.5963       51.2257       34.7121       31.9837      0.127593

              6       99.3209       99.5963       51.2257       34.7121        32.106       97.4304

              7        99.475       99.5963       51.2257       34.7121        33.828       99.8017

              8        99.475       99.6012       60.2649       34.8429        33.828       99.8017

              9        99.475       99.6032       66.0611       35.8866        33.828       99.8017

             10        99.475       99.6033       66.5914       38.5385        33.828       99.8017

             11       99.4783       99.6033       66.5914       38.5385       36.4971       99.8143

             12       99.4783       99.6035       67.3475       38.7576       36.4971       99.8143

             13         99.82       99.6035       67.3475       38.7576       45.1986       99.8143

             14         99.82       99.8684       67.3476       50.2378       45.1986       99.8143

             15       99.8207       99.8684       67.3476       50.2378       45.3096       99.8255

             16       99.8242       99.8684       67.3476       50.2378       46.2709       99.8973

             17       99.8242       99.8714       67.3882       50.5527       46.2709       99.8973

             18       99.8242       99.8715       72.7108       50.5724       46.2709       99.8973

             19       99.8242       99.8723       73.0573       50.7423       46.2709       99.8973

             20       99.8263       99.8723       73.0573       50.7423       46.9052       99.8992""")  # disabled

# ---- group: mesh2000_1storey_60mm_nocolumns
panel_29 = Panel("""* 2. EIGENVALUE ANALYSIS:

#          MODE        LAMBDA         OMEGA     FREQUENCY        PERIOD

# ------------- ------------- ------------- ------------- -------------

              1        313.32       17.7008       2.81718      0.354965

              2       882.659       29.7096       4.72843      0.211487

              3       1221.56       34.9509       5.56261      0.179772

              4       1860.22       43.1303        6.8644      0.145679

              5       1893.28       43.5119       6.92513      0.144402

              6       3242.14       56.9398       9.06224      0.110348

              7       3926.08       62.6584        9.9724      0.100277

              8       4173.02       64.5989       10.2812     0.0972646

              9       7063.95       84.0473       13.3765     0.0747577

             10       7116.43        84.359       13.4261     0.0744815

             11       7332.37       85.6293       13.6283     0.0733766

             12       8424.86       91.7871       14.6084     0.0684539

             13       11139.8       105.545        16.798     0.0595308

             14       11976.3       109.436       17.4173     0.0574141

             15       15731.4       125.425        19.962     0.0500952

             16       16553.5       128.661        20.477     0.0488354

             17       19890.4       141.033       22.4461     0.0445511

             18       21262.8       145.818       23.2076     0.0430893

             19       25381.4       159.316       25.3559     0.0394386

             20       27636.1       166.241       26.4581     0.0377956



* 3. TOTAL MASS OF THE STRUCTURE:

# The total masses (translational and rotational) of the structure

# including the masses at fixed DOFs (if any).

#            MX            MY            MZ           RMX           RMY           RMZ

# ------------- ------------- ------------- ------------- ------------- -------------

        9593.65       9593.65       9593.65        136545       81531.8        217850

* 4. TOTAL FREE MASS OF THE STRUCTURE:

# The total masses (translational and rotational) of the structure

# including only the masses at free DOFs.

#            MX            MY            MZ           RMX           RMY           RMZ

# ------------- ------------- ------------- ------------- ------------- -------------

        7973.51       7973.51       7973.51       94923.7       53136.1        147910

* 5. CENTER OF MASS:

# The center of mass of the structure, calculated from free masses.

#             X             Y             Z

# ------------- ------------- -------------

              5       6.49224      0.154573

* 6. MODAL PARTICIPATION FACTORS:

# The participation factor for a certain mode 'a' in a certain direction 'i'

# indicates how strongly displacement along (or rotation about)

# the global axes is represented in the eigenvector of that mode.

#          MODE            MX            MY            MZ           RMX           RMY           RMZ

# ------------- ------------- ------------- ------------- ------------- ------------- -------------

              1             0    0.00428883       1.86069       2.06437             0             0

              2     0.0727469             0             0             0      -3.74057    -0.0175464

              3             0    -0.0581147      0.480312      -5.08531             0             0

              4     0.0192435             0             0             0     -0.793368     0.0854775

              5             0     0.0108603     -0.811215     -0.154838             0             0

              6             0    -0.0542567      0.769497     -0.544153             0             0

              7             0     0.0423841     0.0565632      -1.56319             0             0

              8     0.0433199             0             0             0      -1.10321    -0.0292043

              9      0.270571             0             0             0       3.79169      0.215928

             10             0      0.114424     -0.542321       2.94378             0             0

             11             0      -0.16618     -0.174435      -5.41975             0             0

             12     0.0518694             0             0             0      0.799184     -0.154615

             13      0.151708             0             0             0      -1.61981      0.325829

             14             0     -0.076671     -0.144095     -0.386984             0             0

             15             0    -0.0241453     -0.646432       1.03617             0             0

             16     0.0136084             0             0             0       1.11188      0.127792

             17    -0.0286701             0             0             0      0.779057      0.513814

             18             0     -0.229675     -0.860014      -2.89897             0             0

             19             0     -0.144657     -0.298281       -1.4286             0             0

             20             0      -0.19058      0.644271       -4.1088             0             0

* 7. MODAL PARTICIPATION MASSES:

# The modal participation masses for each mode.

#          MODE            MX            MY            MZ           RMX           RMY           RMZ

# ------------- ------------- ------------- ------------- ------------- ------------- -------------

              1             0     0.0241558       4546.66       5596.55             0             0

              2       10.6462             0             0             0       28147.6      0.619356

              3             0       5.69928       389.309       43639.7             0             0

              4      0.699753             0             0             0        1189.4       13.8064

              5             0       0.16355       912.513       33.2445             0             0

              6             0       3.48484       700.953       350.524             0             0

              7             0       2.52567        4.4982       3435.52             0             0

              8       2.59416             0             0             0       1682.44         1.179

              9       39.6827             0             0             0       7792.99       25.2729

             10             0       5.20544       116.933       3445.38             0             0

             11             0       13.8596       15.2708       14741.9             0             0

             12       1.21811             0             0             0       289.173       10.8235

             13       9.45791             0             0             0       1078.21       43.6271

             14             0       1.94862       6.88276       49.6421             0             0

             15             0      0.427153       306.171       786.642             0             0

             16      0.109223             0             0             0       729.142       9.63178

             17       0.18657             0             0             0        137.76       59.9232

             18             0       11.1435       156.244       1775.34             0             0

             19             0       9.63705       40.9744       939.902             0             0

             20             0       7.00385       80.0425       3255.47             0             0

* 8. MODAL PARTICIPATION MASSES (cumulative):

# The cumulative modal participation masses for each mode.

#          MODE            MX            MY            MZ           RMX           RMY           RMZ

# ------------- ------------- ------------- ------------- ------------- ------------- -------------

              1             0     0.0241558       4546.66       5596.55             0             0

              2       10.6462     0.0241558       4546.66       5596.55       28147.6      0.619356

              3       10.6462       5.72343       4935.97       49236.2       28147.6      0.619356

              4       11.3459       5.72343       4935.97       49236.2         29337       14.4258

              5       11.3459       5.88698       5848.48       49269.5         29337       14.4258

              6       11.3459       9.37182       6549.43         49620         29337       14.4258

              7       11.3459       11.8975       6553.93       53055.5         29337       14.4258

              8       13.9401       11.8975       6553.93       53055.5       31019.4       15.6048

              9       53.6228       11.8975       6553.93       53055.5       38812.4       40.8778

             10       53.6228       17.1029       6670.87       56500.9       38812.4       40.8778

             11       53.6228       30.9626       6686.14       71242.8       38812.4       40.8778

             12        54.841       30.9626       6686.14       71242.8       39101.6       51.7013

             13       64.2989       30.9626       6686.14       71242.8       40179.8       95.3284

             14       64.2989       32.9112       6693.02       71292.4       40179.8       95.3284

             15       64.2989       33.3383       6999.19       72079.1       40179.8       95.3284

             16       64.4081       33.3383       6999.19       72079.1       40908.9        104.96

             17       64.5947       33.3383       6999.19       72079.1       41046.7       164.883

             18       64.5947       44.4818       7155.44       73854.4       41046.7       164.883

             19       64.5947       54.1189       7196.41       74794.3       41046.7       164.883

             20       64.5947       61.1227       7276.45       78049.8       41046.7       164.883

* 9. MODAL PARTICIPATION MASS RATIOS (%):

# The modal participation mass ratios (%) for each mode.

#          MODE            MX            MY            MZ           RMX           RMY           RMZ

# ------------- ------------- ------------- ------------- ------------- ------------- -------------

              1             0   0.000302951       57.0221       5.89583             0             0

              2      0.133519             0             0             0       52.9726   0.000418737

              3             0     0.0714776       4.88253       45.9734             0             0

              4    0.00877597             0             0             0        2.2384    0.00933433

              5             0    0.00205116       11.4443     0.0350224             0             0

              6             0     0.0437052       8.79103      0.369269             0             0

              7             0     0.0316758     0.0564143       3.61925             0             0

              8     0.0325348             0             0             0       3.16628   0.000797105

              9      0.497682             0             0             0       14.6661     0.0170866

             10             0     0.0652842       1.46652       3.62963             0             0

             11             0      0.173821       0.19152       15.5302             0             0

             12      0.015277             0             0             0      0.544211    0.00731763

             13      0.118617             0             0             0       2.02914     0.0294956

             14             0     0.0244387     0.0863204     0.0522968             0             0

             15             0    0.00535716       3.83985       0.82871             0             0

             16    0.00136982             0             0             0       1.37221     0.0065119

             17    0.00233987             0             0             0      0.259258     0.0405132

             18             0      0.139756       1.95954       1.87028             0             0

             19             0      0.120863      0.513882      0.990165             0             0

             20             0      0.087839       1.00385       3.42956             0             0

* 10. MODAL PARTICIPATION MASS RATIOS (%) (cumulative):

# The cumulative modal participation mass ratios (%) for each mode.

#          MODE            MX            MY            MZ           RMX           RMY           RMZ

# ------------- ------------- ------------- ------------- ------------- ------------- -------------

              1             0   0.000302951       57.0221       5.89583             0             0

              2      0.133519   0.000302951       57.0221       5.89583       52.9726   0.000418737

              3      0.133519     0.0717806       61.9046       51.8692       52.9726   0.000418737

              4      0.142295     0.0717806       61.9046       51.8692        55.211    0.00975307

              5      0.142295     0.0738318       73.3489       51.9043        55.211    0.00975307

              6      0.142295      0.117537       82.1399       52.2735        55.211    0.00975307

              7      0.142295      0.149213       82.1964       55.8928        55.211    0.00975307

              8       0.17483      0.149213       82.1964       55.8928       58.3773     0.0105502

              9      0.672513      0.149213       82.1964       55.8928       73.0433     0.0276368

             10      0.672513      0.214497       83.6629       59.5224       73.0433     0.0276368

             11      0.672513      0.388318       83.8544       75.0526       73.0433     0.0276368

             12       0.68779      0.388318       83.8544       75.0526       73.5875     0.0349544

             13      0.806406      0.388318       83.8544       75.0526       75.6167     0.0644501

             14      0.806406      0.412757       83.9407       75.1049       75.6167     0.0644501

             15      0.806406      0.418114       87.7806       75.9336       75.6167     0.0644501

             16      0.807776      0.418114       87.7806       75.9336       76.9889      0.070962

             17      0.810116      0.418114       87.7806       75.9336       77.2482      0.111475

             18      0.810116       0.55787       89.7401       77.8039       77.2482      0.111475

             19      0.810116      0.678733        90.254       78.7941       77.2482      0.111475

             20      0.810116      0.766572       91.2578       82.2236       77.2482      0.111475""")  # disabled

# ---- group: mesh2000_1storey_45mm
panel_30 = Panel("""* 2. EIGENVALUE ANALYSIS:

#          MODE        LAMBDA         OMEGA     FREQUENCY        PERIOD

# ------------- ------------- ------------- ------------- -------------

              1       109.757       10.4765       1.66739       0.59974

              2       403.247        20.081       3.19599      0.312892

              3       504.009       22.4501       3.57305      0.279873

              4       561.372       23.6933        3.7709      0.265188

              5       624.138       24.9828       3.97613      0.251501

              6       931.805       30.5255       4.85828      0.205834

              7       1016.38       31.8807       5.07397      0.197084

              8       1235.81       35.1541       5.59495      0.178733

              9       2024.96       44.9995       7.16189      0.139628

             10       2217.19        47.087       7.49413      0.133438

             11       2414.38       49.1364        7.8203      0.127872

             12       3594.23       59.9519       9.54164      0.104804

             13       3733.68       61.1038       9.72497      0.102828

             14       4842.78       69.5901       11.0756     0.0902885

             15       4952.19       70.3718          11.2     0.0892855

             16       6299.42       79.3689        12.632     0.0791643

             17       7567.42       86.9909        13.845     0.0722281

             18       7746.69       88.0153       14.0081     0.0713874

             19         10603       102.971       16.3883     0.0610191

             20       11020.1       104.976       16.7075     0.0598533



* 3. TOTAL MASS OF THE STRUCTURE:

# The total masses (translational and rotational) of the structure

# including the masses at fixed DOFs (if any).

#            MX            MY            MZ           RMX           RMY           RMZ

# ------------- ------------- ------------- ------------- ------------- -------------

        8861.66       8861.66       8861.66        156645         99904        240193

* 4. TOTAL FREE MASS OF THE STRUCTURE:

# The total masses (translational and rotational) of the structure

# including only the masses at free DOFs.

#            MX            MY            MZ           RMX           RMY           RMZ

# ------------- ------------- ------------- ------------- ------------- -------------

        8028.45       8028.45       8028.45        125488       76487.4        201790

* 5. CENTER OF MASS:

# The center of mass of the structure, calculated from free masses.

#             X             Y             Z

# ------------- ------------- -------------

              5       6.49325       3.11514

* 6. MODAL PARTICIPATION FACTORS:

# The participation factor for a certain mode 'a' in a certain direction 'i'

# indicates how strongly displacement along (or rotation about)

# the global axes is represented in the eigenvector of that mode.

#          MODE            MX            MY            MZ           RMX           RMY           RMZ

# ------------- ------------- ------------- ------------- ------------- ------------- -------------

              1             0     0.0504561       1.76116       1.44243             0             0

              2       1.10487             0             0             0      -2.58607    -0.0428533

              3             0       1.19896     -0.210562       3.21234             0             0

              4       1.22587             0             0             0        1.4459     0.0820473

              5             0      -1.23099     -0.110895       2.16789             0             0

              6             0     0.0585725       0.73344     -0.488175             0             0

              7      0.144961             0             0             0       1.06062      -2.27182

              8    0.00699585             0             0             0     0.0970234         6.266

              9             0    0.00410779      0.440427      -1.56436             0             0

             10             0     0.0123866      0.580005      0.998772             0             0

             11   -0.00650834             0             0             0      -1.60717     -0.305922

             12             0    -0.0452906      0.399247       1.56771             0             0

             13     -0.284757             0             0             0      -3.90405     0.0888529

             14             0     -0.226614    -0.0271895       5.26886             0             0

             15      0.011231             0             0  -1.16116e-11      0.515085     -0.226039

             16    -0.0255178             0             0             0      -1.58617      0.746042

             17             0    -0.0421919     0.0928932       1.54504             0             0

             18             0    0.00166506      0.946073      0.364447             0             0

             19             0     0.0113541      0.338949     -0.641526             0             0

             20     0.0313367             0             0             0     -0.803868      -0.10504

* 7. MODAL PARTICIPATION MASSES:

# The modal participation masses for each mode.

#          MODE            MX            MY            MZ           RMX           RMY           RMZ

# ------------- ------------- ------------- ------------- ------------- ------------- -------------

              1             0       3.11038        3789.5          2542             0             0

              2       2926.64             0             0             0       16033.4       4.40264

              3             0       3358.98         103.6       24112.5             0             0

              4       5024.62             0             0             0       6990.19       22.5082

              5             0       4624.08       37.5262       14341.3             0             0

              6             0       4.62697       725.503       321.412             0             0

              7       27.4227             0             0             0       1468.01        6735.3

              8      0.242446             0             0             0       46.6323        194498

              9             0     0.0201801       231.981        2926.7             0             0

             10             0      0.122471        268.53       796.274             0             0

             11     0.0283792             0             0             0       1730.54       62.7018

             12             0      0.696574       54.1296       834.607             0             0

             13       28.6606             0             0             0       5387.25       2.79048

             14             0       22.9992      0.331085       12432.9             0             0

             15     0.0410238             0             0             0       86.2887       16.6174

             16      0.198837             0             0             0       768.266       169.957

             17             0      0.434254         2.105       582.324             0             0

             18             0   0.000956971        308.95       45.8466             0             0

             19             0     0.0939016       83.6821       299.773             0             0

             20      0.495245             0             0             0       325.899       5.56442

* 8. MODAL PARTICIPATION MASSES (cumulative):

# The cumulative modal participation masses for each mode.

#          MODE            MX            MY            MZ           RMX           RMY           RMZ

# ------------- ------------- ------------- ------------- ------------- ------------- -------------

              1             0       3.11038        3789.5          2542             0             0

              2       2926.64       3.11038        3789.5          2542       16033.4       4.40264

              3       2926.64       3362.09        3893.1       26654.5       16033.4       4.40264

              4       7951.26       3362.09        3893.1       26654.5       23023.6       26.9108

              5       7951.26       7986.18       3930.63       40995.8       23023.6       26.9108

              6       7951.26       7990.81       4656.13       41317.2       23023.6       26.9108

              7       7978.69       7990.81       4656.13       41317.2       24491.6       6762.21

              8       7978.93       7990.81       4656.13       41317.2       24538.3        201260

              9       7978.93       7990.83       4888.11       44243.9       24538.3        201260

             10       7978.93       7990.95       5156.64       45040.2       24538.3        201260

             11       7978.96       7990.95       5156.64       45040.2       26268.8        201323

             12       7978.96       7991.64       5210.77       45874.8       26268.8        201323

             13       8007.62       7991.64       5210.77       45874.8       31656.1        201326

             14       8007.62       8014.64        5211.1       58307.7       31656.1        201326

             15       8007.66       8014.64        5211.1       58307.7       31742.4        201342

             16       8007.86       8014.64        5211.1       58307.7       32510.6        201512

             17       8007.86       8015.08       5213.21         58890       32510.6        201512

             18       8007.86       8015.08       5522.16       58935.8       32510.6        201512

             19       8007.86       8015.17       5605.84       59235.6       32510.6        201512

             20       8008.35       8015.17       5605.84       59235.6       32836.5        201518

* 9. MODAL PARTICIPATION MASS RATIOS (%):

# The modal participation mass ratios (%) for each mode.

#          MODE            MX            MY            MZ           RMX           RMY           RMZ

# ------------- ------------- ------------- ------------- ------------- ------------- -------------

              1             0      0.038742       47.2009        2.0257             0             0

              2       36.4534             0             0             0       20.9622    0.00218179

              3             0       41.8385       1.29041        19.215             0             0

              4       62.5852             0             0             0       9.13901     0.0111542

              5             0       57.5963      0.467415       11.4285             0             0

              6             0     0.0576323       9.03665       0.25613             0             0

              7      0.341569             0             0             0       1.91929       3.33777

              8    0.00301984             0             0             0     0.0609673       96.3863

              9             0   0.000251357       2.88949       2.33226             0             0

             10             0    0.00152546       3.34473      0.634543             0             0

             11   0.000353483             0             0             0       2.26252     0.0310728

             12             0    0.00867632      0.674223       0.66509             0             0

             13      0.356989             0             0             0       7.04332    0.00138286

             14             0      0.286472     0.0041239       9.90764             0             0

             15    0.00051098             0             0             0      0.112814    0.00823497

             16    0.00247665             0             0             0       1.00443     0.0842244

             17             0    0.00540894     0.0262193      0.464048             0             0

             18             0   1.19198e-05       3.84819     0.0365347             0             0

             19             0    0.00116961       1.04232      0.238886             0             0

             20    0.00616863             0             0             0      0.426082    0.00275753

* 10. MODAL PARTICIPATION MASS RATIOS (%) (cumulative):

# The cumulative modal participation mass ratios (%) for each mode.

#          MODE            MX            MY            MZ           RMX           RMY           RMZ

# ------------- ------------- ------------- ------------- ------------- ------------- -------------

              1             0      0.038742       47.2009        2.0257             0             0

              2       36.4534      0.038742       47.2009        2.0257       20.9622    0.00218179

              3       36.4534       41.8773       48.4914       21.2407       20.9622    0.00218179

              4       99.0386       41.8773       48.4914       21.2407       30.1012      0.013336

              5       99.0386       99.4735       48.9588       32.6691       30.1012      0.013336

              6       99.0386       99.5312       57.9954       32.9253       30.1012      0.013336

              7       99.3802       99.5312       57.9954       32.9253       32.0205       3.35111

              8       99.3832       99.5312       57.9954       32.9253       32.0815       99.7374

              9       99.3832       99.5314       60.8849       35.2575       32.0815       99.7374

             10       99.3832       99.5329       64.2296       35.8921       32.0815       99.7374

             11       99.3836       99.5329       64.2296       35.8921        34.344       99.7684

             12       99.3836       99.5416       64.9039       36.5572        34.344       99.7684

             13       99.7406       99.5416       64.9039       36.5572       41.3873       99.7698

             14       99.7406       99.8281        64.908       46.4648       41.3873       99.7698

             15       99.7411       99.8281        64.908       46.4648       41.5001       99.7781

             16       99.7436       99.8281        64.908       46.4648       42.5046       99.8623

             17       99.7436       99.8335       64.9342       46.9289       42.5046       99.8623

             18       99.7436       99.8335       68.7824       46.9654       42.5046       99.8623

             19       99.7436       99.8347       69.8247       47.2043       42.5046       99.8623

             20       99.7497       99.8347       69.8247       47.2043       42.9306        99.865""")  # disabled
# ---- group: mesh2000_1storey_95mm
panel_31 = Panel("""* 2. EIGENVALUE ANALYSIS:

#          MODE        LAMBDA         OMEGA     FREQUENCY        PERIOD

# ------------- ------------- ------------- ------------- -------------

              1       45.0457       6.71161       1.06819      0.936167

              2       53.3384       7.30331       1.16236       0.86032

              3       121.233       11.0106       1.75239      0.570651

              4       231.793       15.2247       2.42309      0.412696

              5       258.993       16.0933       2.56132      0.390423

              6       270.481       16.4463       2.61751      0.382042

              7       388.536       19.7113       3.13715       0.31876

              8       447.356       21.1508       3.36625      0.297066

              9       835.221       28.9002       4.59961       0.21741

             10        873.88       29.5615       4.70485      0.212547

             11       968.972       31.1283       4.95423      0.201848

             12       981.152       31.3234       4.98527      0.200591

             13       982.883        31.351       4.98966      0.200414

             14       1121.12       33.4831         5.329      0.187652

             15       1139.84       33.7615       5.37332      0.186105

             16        1198.5       34.6194       5.50985      0.181493

             17       1272.65       35.6742       5.67772      0.176127

             18       1813.55       42.5858       6.77774      0.147542

             19       2063.52        45.426       7.22977      0.138317

             20       2151.61       46.3854       7.38247      0.135456



* 3. TOTAL MASS OF THE STRUCTURE:

# The total masses (translational and rotational) of the structure

# including the masses at fixed DOFs (if any).

#            MX            MY            MZ           RMX           RMY           RMZ

# ------------- ------------- ------------- ------------- ------------- -------------

        50569.1       50569.1       50569.1    1.1141e+06        806347    1.2652e+06

* 4. TOTAL FREE MASS OF THE STRUCTURE:

# The total masses (translational and rotational) of the structure

# including only the masses at free DOFs.

#            MX            MY            MZ           RMX           RMY           RMZ

# ------------- ------------- ------------- ------------- ------------- -------------

        49735.9       49735.9       49735.9   1.06036e+06        760342    1.2268e+06

* 5. CENTER OF MASS:

# The center of mass of the structure, calculated from free masses.

#             X             Y             Z

# ------------- ------------- -------------

              5       6.49309       6.06745

* 6. MODAL PARTICIPATION FACTORS:

# The participation factor for a certain mode 'a' in a certain direction 'i'

# indicates how strongly displacement along (or rotation about)

# the global axes is represented in the eigenvector of that mode.

#          MODE            MX            MY            MZ           RMX           RMY           RMZ

# ------------- ------------- ------------- ------------- ------------- ------------- -------------

              1        1.2529             0             0             0       1.00062     0.0117729

              2             0       1.24619     0.0125297     -0.925771             0             0

              3   -0.00282422             0             0             0     0.0234188       8.09665

              4             0     0.0424856      -1.24155     -0.597694             0             0

              5             0    -0.0605277      0.783278     0.0718566             0             0

              6             0    -0.0639354       2.05834       1.11299             0             0

              7     -0.352971             0             0             0       2.04533    0.00172691

              8             0      0.350403     0.0438319       2.11536             0             0

              9             0      0.233757     -0.175939       5.08814             0             0

             10     -0.313819             0             0             0       3.16648     -0.157337

             11             0    -0.0429982      0.303135      -8.22759             0             0

             12             0       0.33392      0.177454      -2.75736             0  -1.17867e-11

             13   -0.00532351             0             0             0   -0.00504323       2.35846

             14      0.324696             0             0             0       3.58497    -0.0417612

             15      0.172027             0             0             0      -4.93036     -0.221768

             16             0     -0.143437   0.000124412     -0.638645             0             0

             17     -0.129319             0             0             0       1.05211    -0.0820005

             18     0.0179254             0             0             0      0.586486     -0.523536

             19     0.0128711             0             0             0     -0.725815     -0.152914

             20     0.0148349             0             0             0      0.509956      0.886111

* 7. MODAL PARTICIPATION MASSES:

# The modal participation masses for each mode.

#          MODE            MX            MY            MZ           RMX           RMY           RMZ

# ------------- ------------- ------------- ------------- ------------- ------------- -------------

              1       43251.2             0             0             0       27587.1       3.81885

              2             0       43885.1       4.43639         24219             0             0

              3      0.133881             0             0             0       9.20559   1.10036e+06

              4             0       6.43901       5498.74       1274.36             0             0

              5             0       18.5556       3107.41       26.1517             0             0

              6             0       17.2477       17876.5       5226.72             0             0

              7        4805.8             0             0             0        161367      0.115035

              8             0       4477.79        70.066        163190             0             0

              9             0       232.981       131.982        110385             0             0

             10       684.224             0             0             0       69661.7       171.989

             11             0       6.73409       334.696        246561             0             0

             12             0       369.817       104.441       25216.7             0             0

             13      0.536281             0             0             0      0.481298        105257

             14       562.953             0             0             0       68625.8       9.31244

             15        147.98             0             0             0        121553       245.926

             16             0       704.338   0.000529884         13963             0             0

             17        261.52             0             0             0       17310.2       105.151

             18       1.27203             0             0             0       1361.67       1085.05

             19      0.642582             0             0             0        2043.4       90.6979

             20      0.846132             0             0             0       999.845       3018.87

* 8. MODAL PARTICIPATION MASSES (cumulative):

# The cumulative modal participation masses for each mode.

#          MODE            MX            MY            MZ           RMX           RMY           RMZ

# ------------- ------------- ------------- ------------- ------------- ------------- -------------

              1       43251.2             0             0             0       27587.1       3.81885

              2       43251.2       43885.1       4.43639         24219       27587.1       3.81885

              3       43251.3       43885.1       4.43639         24219       27596.3   1.10036e+06

              4       43251.3       43891.6       5503.17       25493.3       27596.3   1.10036e+06

              5       43251.3       43910.1       8610.58       25519.5       27596.3   1.10036e+06

              6       43251.3       43927.4       26487.1       30746.2       27596.3   1.10036e+06

              7       48057.1       43927.4       26487.1       30746.2        188963   1.10036e+06

              8       48057.1       48405.2       26557.1        193936        188963   1.10036e+06

              9       48057.1       48638.2       26689.1        304321        188963   1.10036e+06

             10       48741.4       48638.2       26689.1        304321        258625   1.10053e+06

             11       48741.4       48644.9       27023.8        550882        258625   1.10053e+06

             12       48741.4       49014.7       27128.3        576098        258625   1.10053e+06

             13       48741.9       49014.7       27128.3        576098        258626   1.20579e+06

             14       49304.9       49014.7       27128.3        576098        327251    1.2058e+06

             15       49452.8       49014.7       27128.3        576098        448804   1.20604e+06

             16       49452.8       49719.1       27128.3        590061        448804   1.20604e+06

             17       49714.4       49719.1       27128.3        590061        466115   1.20615e+06

             18       49715.6       49719.1       27128.3        590061        467476   1.20723e+06

             19       49716.3       49719.1       27128.3        590061        469520   1.20732e+06

             20       49717.1       49719.1       27128.3        590061        470519   1.21034e+06

* 9. MODAL PARTICIPATION MASS RATIOS (%):

# The modal participation mass ratios (%) for each mode.

#          MODE            MX            MY            MZ           RMX           RMY           RMZ

# ------------- ------------- ------------- ------------- ------------- ------------- -------------

              1       86.9618             0             0             0       3.62825   0.000311285

              2             0       88.2364    0.00891991       2.28404             0             0

              3   0.000269184             0             0             0    0.00121072       89.6931

              4             0     0.0129464       11.0559      0.120182             0             0

              5             0     0.0373083       6.24783    0.00246631             0             0

              6             0     0.0346786       35.9428      0.492921             0             0

              7       9.66264             0             0             0        21.223   9.37683e-06

              8             0       9.00314      0.140876       15.3901             0             0

              9             0      0.468436      0.265366       10.4102             0             0

             10       1.37572             0             0             0       9.16189     0.0140193

             11             0     0.0135397      0.672948       23.2526             0             0

             12             0      0.743561      0.209991       2.37814             0             0

             13    0.00107826             0             0             0   6.33001e-05       8.57981

             14       1.13189             0             0             0       9.02565   0.000759083

             15      0.297531             0             0             0       15.9866     0.0200461

             16             0       1.41616    1.0654e-06       1.31682             0             0

             17      0.525818             0             0             0       2.27664    0.00857117

             18    0.00255756             0             0             0      0.179086     0.0884454

             19    0.00129199             0             0             0      0.268747    0.00739304

             20    0.00170125             0             0             0      0.131499      0.246076

* 10. MODAL PARTICIPATION MASS RATIOS (%) (cumulative):

# The cumulative modal participation mass ratios (%) for each mode.

#          MODE            MX            MY            MZ           RMX           RMY           RMZ

# ------------- ------------- ------------- ------------- ------------- ------------- -------------

              1       86.9618             0             0             0       3.62825   0.000311285

              2       86.9618       88.2364    0.00891991       2.28404       3.62825   0.000311285

              3       86.9621       88.2364    0.00891991       2.28404       3.62946       89.6934

              4       86.9621       88.2494       11.0648       2.40422       3.62946       89.6934

              5       86.9621       88.2867       17.3126       2.40669       3.62946       89.6934

              6       86.9621       88.3213       53.2555       2.89961       3.62946       89.6934

              7       96.6247       88.3213       53.2555       2.89961       24.8524       89.6934

              8       96.6247       97.3245       53.3963       18.2897       24.8524       89.6934

              9       96.6247       97.7929       53.6617       28.6999       24.8524       89.6934

             10       98.0004       97.7929       53.6617       28.6999       34.0143       89.7074

             11       98.0004       97.8065       54.3347       51.9525       34.0143       89.7074

             12       98.0004         98.55       54.5446       54.3306       34.0143       89.7074

             13       98.0015         98.55       54.5446       54.3306       34.0144       98.2872

             14       99.1334         98.55       54.5446       54.3306         43.04        98.288

             15       99.4309         98.55       54.5446       54.3306       59.0266        98.308

             16       99.4309       99.9662       54.5446       55.6474       59.0266        98.308

             17       99.9567       99.9662       54.5446       55.6474       61.3033       98.3166

             18       99.9593       99.9662       54.5446       55.6474       61.4824        98.405

             19       99.9606       99.9662       54.5446       55.6474       61.7511       98.4124

             20       99.9623       99.9662       54.5446       55.6474       61.8826       98.6585""")  # disabled

# ---- group: headings for all
panel_32 = Panel("""* 3. TOTAL MASS OF THE STRUCTURE:
* 4. TOTAL FREE MASS OF THE STRUCTURE:
* 5. CENTER OF MASS:
* 6. MODAL PARTICIPATION FACTORS:
* 7. MODAL PARTICIPATION MASSES:
* 8. MODAL PARTICIPATION MASSES (cumulative):
* 9. MODAL PARTICIPATION MASS RATIOS (%):
* 10. MODAL PARTICIPATION MASS RATIOS (%) (cumulative):""")  # disabled

# ---- group: making branches at headings
cull = CullPattern(List=panel_31, CullPattern=[True, False])  # disabled
mindex = MemberIndex(Set=cull, Member=panel_32)  # -> flatten(Index), Count; disabled
python_2 = GhPythonScript(input=cull, indices=mindex.Index)  # -> out, new_list; inputs input: list, indices: list of Int32; disabled
# ---------- python_2: Python ----------
import rhinoscriptsyntax as rs
import ghpythonlib.treehelpers as th


def create_nested_list(x, indices):
    nested_list = []
    start_index = 0
    
    for idx in indices:
        nested_list.append(x[start_index:idx])
        start_index = idx
    
    # Add the remaining elements after the last index
    nested_list.append(x[start_index:])
    
    return nested_list

new_list = create_nested_list(input,indices)

# Convert the nested list to a data tree
new_list = th.list_to_tree(new_list)
# ---------- end python_2 ----------

cull_2 = CullPattern(List=panel_27, CullPattern=[True, False])  # disabled
mindex_2 = MemberIndex(Set=cull_2, Member=panel_32)  # -> flatten(Index), Count; disabled
python_3 = GhPythonScript(input=cull_2, indices=mindex_2.Index)  # -> out, new_list; inputs input: list, indices: list of Int32; disabled; same code as python_2

# ---- group: headings
panel_33 = Panel("""1

4
5
3

5""")

# ----
# COPY PASTED - EXTRACTING TIME PERIOD BASED ON MASS PARTICIPATION
_1_storey = Panel(python_3.new_list)  # disabled
_3_storeys = Panel(python_2.new_list)  # disabled

# ---- group: just the Time period
panel_34 = Panel("0;0")  # disabled
branch = TreeBranch(Tree=_1_storey, Path=panel_34, MaintainPaths=True)  # -> flatten(Branch); disabled
panel_35 = Panel("             ")  # disabled
panel_36 = Panel("""0
1
2""")  # disabled
cull_i = CullIndex(List=branch, Indices=panel_36, Wrap=True)  # disabled
split = TextSplit(Text=cull_i, Separators=panel_35)  # -> simplify(Result); disabled
panel_37 = Panel("-1")  # disabled
item = ListItem(List=split, Index=panel_37, Wrap=True)  # -> flatten(Item); disabled
path_mapper = PathMapper(item, source="{A}", target="{0;0}")  # disabled

# ---- group: just the mass participation ratios
panel_38 = Panel("0;7")  # disabled
branch_2 = TreeBranch(Tree=_1_storey, Path=panel_38, MaintainPaths=True)  # disabled
path_mapper_2 = PathMapper(branch_2, source="{0;8}", target="{0;0}")  # disabled

# ---- group: for headings
panel_39 = Panel("             ")  # disabled
panel_40 = Panel("2")  # disabled
item_2 = ListItem(List=path_mapper_2, Index=panel_40, Wrap=True)  # -> simplify(Item); disabled
split_2 = TextSplit(Text=item_2, Separators=panel_39)  # disabled
python_4 = GhPythonScript(x=split_2)  # -> out, new_x; inputs x: list; disabled
# ---------- python_4: Python ----------
import rhinoscriptsyntax as rs

def check_input_type(input_value):
    """
    Checks the type of the input value.
    Returns True if it's a float, string, or integer; otherwise, returns False.
    """
    if isinstance(input_value, (float, str, int)):
        return True
    else:
        return False

## Example usage:
#user_input = input("Enter a value: ")
#result = check_input_type(user_input)
#print(f"Is the input a float, string, or integer? {result}")

new_x = []
for i in x:
    if i == None or i == "":
        output = True
        print(output)
    else:
        output = False
        print(output)
    new_x.append(output)

#for i in range(len(x)):
#    if x[i] == "" or x[i] == None:
#        if i == 0:
#            for j in range (1,len(x)):
#                if x[j] != "" and x[j] != None:
#                    x[i] = x[j];
#                    break;
#        else:
#            x[i] =x[i-1]
#output = x
# ---------- end python_4 ----------
dispatch = Dispatch(List=split_2, DispatchPattern=python_4.new_x)  # -> ListA, ListB; disabled
panel_41 = Panel(dispatch.ListB)  # disabled
panel_42 = Panel("0")  # disabled
cull_i_2 = CullIndex(List=panel_41, Indices=panel_42, Wrap=True)  # -> simplify(List); disabled
panel_43 = Panel("0")  # disabled
cull_i_3 = CullIndex(List=cull_i_2, Indices=panel_43, Wrap=True)  # -> simplify(graft(List)); disabled

# ---- group: headings
panel_44 = Panel(cull_i_3)  # disabled

# ---- group: Time Period according to modes. index 0 = mode 1
panel_45 = Panel(path_mapper)  # disabled

# ----
panel_46 = Panel("""Height_of_vault/m
Thickness/m
Mass/kg
Size_x/m
Size_y/m
Height_of_each_node/m""")

# ----
# EXPORT
concatenate_9 = Concatenate(FragmentA=concat, FragmentB="dataset_separate/")

concatenate_10 = Concatenate(FragmentA=concatenate_9, FragmentB="dataset_separate_height_of_node/")
concat_7 = Concatenate(FragmentA="mesh_", FragmentB=panel_6, FragmentD="_ggh", FragmentC=".json")
concatenate_11 = Concatenate(FragmentA=concatenate_10, FragmentB=concat_7)
file_path_mesh_5 = Panel(concatenate_11)

concatenate_12 = Concatenate(FragmentA=concatenate_9, FragmentB="dataset_separate_height_thickness/")
concat_8 = Concatenate(FragmentA="mesh_", FragmentB=panel_6, FragmentD="_gg", FragmentC=".json")
concatenate_13 = Concatenate(FragmentA=concatenate_12, FragmentB=concat_8)
file_path_mesh_6 = Panel(concatenate_13)

# ---- group: stress karamba
item_3 = ListItem(List=panel_2, Index=0, Wrap=True)

# ----
# INPUTS / INTERFACE
# VAULT STRUCTURE
# KARAMBA VISUALIZATION
# LINEAR STATIC SEISMIC ANALYSIS
# MATERIAL
turn_on_karamba = BooleanToggle(False)
# MODAL ANALYSIS
list_9 = ValueList({"alpaca": 0, "karamba": 1}, selected="karamba")
floor_height_m = Panel("3")
minium_mass_participation_ratio_per_mode = Panel("5")  # "minium_mass_participation_ratio_per_mode_percentage"
total_thrershold_mass_participation_rati = Panel("90")  # "total_thrershold mass_participation_ratio_percentage"
list_10 = ValueList({"Dynamic Analysis": 1, "Static analysis": 0}, selected="Static analysis")

# ---- group: VAULT geometry. columns? / move up if columns
panel_47 = Panel(floor_height_m)
unit_z_2 = UnitZ(Factor=panel_47)

# ---- group: shear_walls
division_4 = Division(A=beam_depth_mm, B="2000")
subtraction = Subtraction(A=floor_height_m, B=division_4)
Z_2 = UnitZ(Factor=floor_height_m)

# ----
# POINT GENERATION FOR SEISMIC LOADS
addition = Addition(A=subtraction, B=division)

# ---- group: for mass participation
panel_48 = Panel("4")  # disabled
panel_49 = Panel("             ")  # disabled
split_3 = SplitList(List=path_mapper_2, Index=panel_48)  # -> Headings, MassParticipation; disabled
split_4 = TextSplit(Text=split_3.MassParticipation, Separators=panel_49)  # -> simplify(Result); disabled
python_5 = GhPythonScript(x=split_4)  # -> out, new_x; inputs x: list; disabled; same code as python_4
dispatch_2 = Dispatch(List=split_4, DispatchPattern=python_5.new_x)  # -> ListA, ListB; disabled
panel_50 = Panel(dispatch_2.ListB)  # disabled
path_mapper_3 = PathMapper(panel_50, source="{A}(i)", target="{i}(A)")  # disabled
panel_51 = Panel("6")  # disabled
roundd = RoundToDecimalPlace(NumberX=path_mapper_3, DecimalPlace=panel_51, RoundType=0)  # -> Rounded, Difference; disabled
sort = SortList(Keys=roundd.Rounded)  # -> Keys, ValuesA; disabled
rev = ReverseList(List=sort.Keys)  # disabled
python_6 = GhPythonScript(
    min_mpr=minium_mass_participation_ratio_per_mode,
    threshold_mpr=total_thrershold_mass_participation_rati,
    old_list=roundd.Rounded,
    new_list=rev)  # -> out, simplify(new_index), simplify(new_ref_list); inputs old_list: tree, new_list: tree; disabled
# ---------- python_6: Python ----------
import rhinoscriptsyntax as rs
import ghpythonlib.treehelpers as th

dict_1 ={}


# CONVERTING BRANCHES INTO A NESTED LIST
def tree_to_nested_list(x):
    '''Convert a tree into a nested list'''
    nested_list = []
    for i in range(x.BranchCount):
        branchList = x.Branch(i)
        branch=[]
    
        for j in range(branchList.Count):
            s = float(branchList[j])
            branch.append(s)
        nested_list.append(branch)
    return nested_list

old_list = tree_to_nested_list(old_list)
new_list = tree_to_nested_list(new_list)

# FINDING min % mass participation MODES

new_ref_list = []
for branch in range(len(new_list)):
    branch_list = []
    sum = 0
    for i,val in enumerate(new_list[branch]):
#        sum += val
        if sum < threshold_mpr and val >= min_mpr:
            branch_list.append(val)
            sum += val
    new_ref_list.append(branch_list)

print(new_ref_list)

# FINDING INDICES

new_index = []
for branch in range(len(old_list)):


    for i,val in enumerate(old_list[branch]):
        dict_1[val] = i+1
    
    branch_list = []
    for i,val in enumerate(new_ref_list[branch]):
        branch_list.append(dict_1[val])
        
    new_index.append(branch_list)



del new_index[0]
del new_ref_list[0]
# Convert the nested list to a data tree
new_index = th.list_to_tree(new_index)
new_ref_list = th.list_to_tree(new_ref_list)
# ---------- end python_6 ----------

# ---- group: Dominant modes for all directions / mode number. 1 = mode 1
panel_52 = Panel(python_6.new_index)  # disabled

# ---- group: Dominant modes for all directions / mass participation %
panel_53 = Panel(python_6.new_ref_list)  # disabled

# ---- group: Dominant modes for all directions
ma = MassAddition(Input=panel_53)  # -> Result, PartialResults; disabled

# ---- group: Dominant modes for all directions / mass participation cummulative
panel_54 = Panel(ma.Result)  # disabled

# ----
panel_55 = Panel("""Mode
Time_Period/s
Mass_Participation/%
Mass_Participation_total/%
Eurocode_satsisfied_(1=yes,0=no)
Base_shear/KN""")

# ---- group: no crease test
# IMPORTING FROM PYTHON
toggle = BooleanToggle(True)
python_7 = GhPythonScript(on=toggle)  # -> out, lines
# ---------- python_7: Python ----------
import rhinoscriptsyntax as rs

from compas.datastructures import Mesh
import time

start_time = time.time()
#from compas_fd.fd import fd_numpy

# FDM is implemented using NumPy, not available with RHino's IronPython, so a Proxy is needed
from compas.rpc import Proxy

if on:
    
    # opening the Proxy takes time (a couple of seconds), but, once open, form finding is fast
    with Proxy('compas_fd.fd') as fd:
        
        # generate a standard mesh grid
        mesh = Mesh.from_meshgrid(10.0, 10, 15.0, 15)
        
        # get initial vertex coordinates
        vertices = [mesh.vertex_coordinates(vkey) for vkey in mesh.vertices()]
        
        # get indices of fixed vertices (supports)
        fixed = mesh.vertices_on_boundary()
        
        # get edge connectivity
        edges = list(mesh.edges())
        
        # set values of force densities - the key parameters for form finding with FDM
        forcedensities = [5.0] * len(edges)
        
        # apply loads per vertex based on initial tributary area
        total_load = 40.0
        mesh_area = mesh.area()
        loads = [(0.0, 0.0, total_load * mesh.vertex_area(vkey) / mesh_area) for vkey in mesh.vertices()]
        
        # form find!
        result = fd.fd_numpy(vertices=vertices, fixed=fixed, edges=edges, forcedensities=forcedensities, loads=loads)
        
        # result data
        node_coordinates, node_residual_forces, edge_forces, edge_lengths = result
        
        # convert to Rhino data
        lines = [rs.AddLine(node_coordinates[u], node_coordinates[v]) for u, v in edges]


print(type(lines))

end_time = time.time()
elapsed_time = end_time - start_time

print('elapsed time:', elapsed_time, 'seconds')
# ---------- end python_7 ----------
curve = Curve(python_7.lines)
wbweave = WeaverbirdsMeshFromLinesWeaveBack(Lines=curve, MaximumValence=4)
mesh = Mesh(wbweave)

# ---- group: displaying column row creases
ghpython_script_4 = GhPythonScript(sel=concatenate_4)  # -> out, columns, rows
# ---------- ghpython_script_4: Python ----------
import rhinoscriptsyntax as rs
import json
import os


# main file path
main_path = 'D:/OneDrive - Delft University of Technology/Thesis/python/00_geometry_generation/mesh/'


# specific_path_mesh
additional_string_mesh = 'master_mesh_dict_1.json'
result_path_master_mesh_1 = os.path.join(main_path,additional_string_mesh)

# Load edge data from JSON file
with open(result_path_master_mesh_1, 'r') as file:
    master_mesh_dict_1 = json.load(file)

#print(master_mesh_dict)

#sel = 'mesh_80'
print(sel)
mesh_selected = master_mesh_dict_1[sel]
columns = [val for i, val in master_mesh_dict_1[sel]['col'].items()]
rows = [val for i, val in master_mesh_dict_1[sel]['row'].items()]
print(rows)
columns = [i for sublist in columns for i in sublist]
rows = [i for sublist in rows for i in sublist]
# ---------- end ghpython_script_4 ----------
rows_2 = Panel(ghpython_script_4.rows)
columns_2 = Panel(ghpython_script_4.columns)

# ----
# Deflections, Shear values, and moments calulated at specific cuts
panel_56 = Panel("KARAMBA RESULTS")
panel_57 = Panel("highest overall moment")

# ---- group: shear_walls
shear_wall_length_m_2 = Panel(shear_wall_length_m)
panel_58 = Panel("""0
3""")
panel_59 = Panel("""0
1""")

Y_3 = UnitY(Factor=expr("-x", shear_wall_length_m_2))
Y_4 = UnitY(Factor=expr("-x", shear_wall_length_m_2))
X_3 = UnitX(Factor=expr("-x", shear_wall_length_m_2))
X_4 = UnitX(Factor=expr("-x", shear_wall_length_m_2))
X_5 = UnitX(Factor=shear_wall_length_m_2)
Y_5 = UnitY(Factor=shear_wall_length_m_2)
X_6 = UnitX(Factor=shear_wall_length_m_2)
Y_6 = UnitY(Factor=shear_wall_length_m_2)
merge = Merge(Data1=X_5, Data2=Y_3)
merge_2 = Merge(Data1=X_6, Data2=Y_5)
merge_3 = Merge(Data1=X_3, Data2=Y_4)
merge_4 = Merge(Data1=X_4, Data2=Y_6)
entwine = Entwine(Branch00=merge_2, Branch01=merge_4, Branch02=merge_3, Branch03=merge, FlattenInputs=True)  # -> simplify(Result)

division_5 = Division(A=thickness_of_wall_mm, B="1000")

# ----
panel_60 = Panel("ANALYTICAL RESULTS")

# ---- group: MESH GENERATION IN PYTHON: TESTING DATASET MESHES IMPORTED FROM PYTHON
python_8 = GhPythonScript(filepath_mesh=file_path_mesh, filepath_edges=file_path_mesh_2)  # -> output, lines, rmesh
# ---------- python_8: Python ----------
import rhinoscriptsyntax as rs
from compas.datastructures import Mesh
import json
import Rhino.Geometry as rg

'''MESH'''

# Load mesh data from JSON file
with open(filepath_mesh, 'r') as file:
    mesh_data = json.load(file)

# Create a new Mesh instance
mesh = Mesh.from_data(mesh_data)

# compas mesh to grasshopper mesh conversion
rmesh = rs.AddMesh(*mesh.to_vertices_and_faces())
print(type(rmesh))

## grasshopper mesh to compas mesh conversion
#mesh = Mesh.from_vertices_and_faces(rs.MeshVertices(rmesh), rs.MeshFaceVertices(rmesh))


'''CURVES'''
# Extract vertices and faces from the mesh
vertices = list(mesh.vertices())
# Convert vertices to lists of coordinates
vertices = [mesh.vertex_coordinates(vertex) for vertex in vertices]
node_coordinates = vertices

# Load edge data from JSON file
with open(filepath_edges, 'r') as file:
    edges = json.load(file)

lines = [rs.AddLine(node_coordinates[u], node_coordinates[v]) for u, v in edges]
# ---------- end python_8 ----------

# ---- group: no crease test (continued)
filter_4 = StreamFilter(Gate=list_4, Stream0=curve, Stream1=python_8.lines)
filter_5 = StreamFilter(Gate=list_4, Stream0=mesh, Stream1=python_8.rmesh)

# ---- group: automatic from dataset
python_9 = GhPythonScript()  # -> output, thickness_dataset
# ---------- python_9: Python ----------
import rhinoscriptsyntax as rs
from compas.datastructures import Mesh
import json
import Rhino.Geometry as rg


filepath = 'D:/tahir_zahid/DATASETS/thickness_dataset.json'

# Load mesh data from JSON file
with open(filepath, 'r') as file:
    thickness_dataset = json.load(file)
# ---------- end python_9 ----------
item_4 = ListItem(List=python_9.thickness_dataset, Index=panel_6, Wrap=True)

# ---- group: INPUT THICKNESS OF VAULT (35/ 60/ 95mm)
filter_6 = StreamFilter(Gate=list_5, Stream0=thickness_of_vault_mm, Stream1=item_4)

# ---- group: automatic from dataset (continued)
thickness_of_vault_mm_2 = Panel(filter_6)

# ---- group: L
division_6 = Division(A=thickness_of_vault_mm_2, B="1000")

# ---- group: repeat vault in x or y direction
bbox = BoundingBox(Content=filter_5, Plane=PlaneXY(0, 0, 0), UnionBox=True)  # -> Box, Box_2
debrep = DeconstructBrep(Brep=bbox.Box)  # -> Faces, Edges, Vertices
item_5 = ListItem(List=debrep.Edges, Index=0, Wrap=True)  # -> Item, Item1
len = Length(Curve=item_5.Item1)
len_2 = Length(Curve=item_5.Item)
x = Panel(len_2)
y = Panel(len)
filter_7 = StreamFilter(Gate=list_3, Stream0=y, Stream1=x)
addition_2 = Addition(A=filter_7, B=panel_10)
panel_61 = Panel(number_of_replica_vaults)
series_2 = Series(Start="0", Step=addition_2, Count=expr("x+1", panel_61))
X_7 = UnitX(Factor=series_2)

# ----
Y_7 = UnitY(Factor=series_2)
filter_8 = StreamFilter(Gate=list_3, Stream0=Y_7, Stream1=X_7)

# ---- group: repeat vault in x or y direction (continued)
move = Move(Geometry=filter_5, Motion=filter_8)  # -> Geometry, Transform
mesh_to_polysurface = MeshToPolysurface(Mesh=move.Geometry, Triangles=False, FaceMerge=False)
mjoin = MeshJoin(Meshes=move.Geometry)
filter_9 = StreamFilter(Gate=list_2, Stream0=filter_5, Stream1=mjoin)

# ---- group: MESH GENERATION IN PYTHON: TESTING DATASET MESHES IMPORTED FROM PYTHON
curve_2 = Curve(filter_4)
mesh_2 = Mesh(filter_9)

# ---- group: displaying column row creases (continued)
list_item = ListItem(List=curve_2, Index=[columns_2, rows_2], Wrap=True)

previewlw = CustomPreviewLineweights(Geometry=list_item, Shader=ColourSwatch(SwatchColor=RGB(81, 0, 255)), Thickness=Slider(5, range=0.1..5), Absolute=False)

# ---- group: VAULT geometry. columns?
mesh_to_polysurface_2 = MeshToPolysurface(Mesh=mesh_2, Triangles=False, FaceMerge=False)
# VAULT + COLUMN GEOMETRY GENERATION
move_2 = Move(Geometry=mesh_to_polysurface_2, Motion=unit_z_2)  # -> Geometry, Transform
move_3 = Move(Geometry=mesh_2, Motion=unit_z_2)  # -> Geometry, Transform

# ----
wbedges = WeaverbirdsMeshEdges(MeshOrPolylines=mesh_2)

# ---- group: MESH GENERATION IN PYTHON: TESTING DATASET MESHES IMPORTED FROM PYTHON (continued)
curve_middle = CurveMiddle(Curve=curve_2)
point_list = PointList(Points=curve_middle, Size=Slider(0.15, range=0..1))

# ----
crv = Curve(wbedges)

wbweave_2 = WeaverbirdsMeshFromLinesWeaveBack(Lines=crv, MaximumValence=4)
swatch = ColourSwatch(SwatchColor=RGB(0, 0, 0))
bbox_2 = BoundingBox(Content=wbweave_2, Plane=PlaneXY(0, 0, 0), UnionBox=True)  # -> Box, Box_2
debrep_2 = DeconstructBrep(Brep=bbox_2.Box)  # -> Faces, Edges, Vertices
previewlw_2 = CustomPreviewLineweights(Geometry=crv, Shader=swatch, Thickness=Slider(1, range=0..5), Absolute=False)
item_6 = ListItem(List=debrep_2.Edges, Index=0, Wrap=True)  # -> Item, Item1, Item2, Item3, Item4, Item5, Item6, Item7
crv_2 = Curve([item_6.Item, item_6.Item1, item_6.Item2, item_6.Item3])
crv_3 = Curve([item_6.Item5, item_6.Item4, item_6.Item6, item_6.Item7])
previewlw_3 = CustomPreviewLineweights(Geometry=crv_2, Shader=swatch, Thickness=Slider(3.5, range=0..5), Absolute=False)

# ----
# DISPLAYING ROW/COL NUMBERS IN GRASSHOPPER
panel_62 = Panel("D:\OneDrive - Delft University of Technology\Thesis\python\00_geometry_generation\footprint\x=10,y=15_col_dict.csv")
file = ReadFile(File=panel_62, PerLineParse=True)  # -> simplify(Content)
split_5 = TextSplit(Text=file, Separators=",")  # -> simplify(Result)
path_mapper_4 = PathMapper(split_5, source="{A}(i)", target="{i}(A)")
cull_i_4 = CullIndex(List=path_mapper_4, Indices="0", Wrap=True)  # -> simplify(List)
item_7 = ListItem(List=path_mapper_4, Index=0, Wrap=True)
panel_63 = Panel(item_7)
panel_64 = Panel(cull_i_4)
item_8 = ListItem(List=curve_2, Index=panel_64, Wrap=True)
join = JoinCurves(Curves=item_8, Preserve=False)
Y_8 = UnitY(Factor=expr("-X", "0.2"))
end = EndPoints(Curve=join)  # -> Start, End
move_4 = Move(Geometry=end.Start, Motion=Y_8)  # -> Geometry, Transform
toggle_2 = BooleanToggle(True)
text = Text(
    Location=move_4.Geometry,
    Text=panel_63,
    Size=Slider(0.2, range=0..1),
    Bold=False,
    HorizontalAlignment=0,
    VerticalAlignment=0)

panel_65 = Panel("D:\OneDrive - Delft University of Technology\Thesis\python\00_geometry_generation\footprint\x=10,y=15_row_dict.csv")
file_2 = ReadFile(File=panel_65, PerLineParse=True)  # -> simplify(Content)
split_6 = TextSplit(Text=file_2, Separators=",")  # -> simplify(Result)
path_mapper_5 = PathMapper(split_6, source="{A}(i)", target="{i}(A)")
cull_i_5 = CullIndex(List=path_mapper_5, Indices="0", Wrap=True)  # -> simplify(List)
item_9 = ListItem(List=path_mapper_5, Index=0, Wrap=True)
panel_66 = Panel(item_9)
panel_67 = Panel(cull_i_5)
item_10 = ListItem(List=curve_2, Index=panel_67, Wrap=True)  # -> simplify(Item)
join_2 = JoinCurves(Curves=simplify(item_10), Preserve=False)  # -> simplify(Curves)
X_8 = UnitX(Factor=expr("-X", "0.7"))
end_2 = EndPoints(Curve=join_2)  # -> Start, End
move_5 = Move(Geometry=end_2.Start, Motion=X_8)  # -> Geometry, Transform
toggle_3 = BooleanToggle(True)
text_2 = Text(
    Location=move_5.Geometry,
    Text=panel_66,
    Size=Slider(0.2, range=0..1),
    Bold=False,
    HorizontalAlignment=0,
    VerticalAlignment=0)

# ---- group: VAULT geometry. columns? / VAULT KARAMBA GEOMETRY DEPENDANT ON WALLS YES NO?
stream_filter_2 = StreamFilter(Gate=list_6, Stream0=mesh_to_polysurface_2, Stream1=move_2.Geometry, Stream2=move_2.Geometry)

# ---- group: VAULT geometry. columns? / VAULT ALPACA GEOMETRY DEPENDANT ON WALLS YES NO?
stream_filter_3 = StreamFilter(Gate=list_6, Stream0=mesh_2, Stream1=move_3.Geometry, Stream2=move_3.Geometry)

# ---- group: export to abaqus
# EXPORT TO ABAQUS
offset_mesh = OffsetMesh(Mesh=mesh_2, Distance="95/1000", BothSides=0, CreateSolid=True)
mesh_to_polysurface_3 = MeshToPolysurface(Mesh=offset_mesh, Triangles=False, FaceMerge=False)
yz_plane = YZPlane(Origin=Point(0, 0, 0))
rotate = Rotate(Geometry=mesh_to_polysurface_3, Angle=expr("-x", 1.570796327), Plane=yz_plane)  # -> Geometry, Transform

# ---- group: extracting curves for points in x and y direction for seismic loads
brep = Brep(stream_filter_2)
bounding_box = BoundingBox(Content=brep, Plane=PlaneXY(0, 0, 0))  # -> Box, Box_2
deconstruct_brep = DeconstructBrep(Brep=bounding_box.Box)  # -> Faces, Edges, Vertices
list_item_2 = ListItem(List=deconstruct_brep.Edges, Index=0, Wrap=True)  # -> Item1, Item
curve_3 = Curve(list_item_2.Item1)
length = Length(Curve=curve_3)
division_7 = Division(A=length, B="2")
unit_z_3 = UnitZ(Factor=expr("x", division_7))
list_item_3 = ListItem(List=deconstruct_brep.Faces, Index=0, Wrap=True)  # -> Item1, Item
surface = Surface(list_item_3.Item1)
move_6 = Move(Geometry=surface, Motion=expr("-x", unit_z_3))  # -> Geometry, Transform
deconstruct_brep_2 = DeconstructBrep(Brep=move_6.Geometry)  # -> Faces, Edges, Vertices

# ---- group: shell
mesh_3 = Mesh(stream_filter_3)

# ----
previewlw_4 = CustomPreviewLineweights(
    Geometry=text,
    Shader={diffuse=RGB(255, 105, 180), emission=RGB(76, 32, 54), shine=0.5, specular=RGB(255, 255, 255), transparency=0},
    Thickness=Slider(3, range=0..10),
    Absolute=False)

previewlw_5 = CustomPreviewLineweights(
    Geometry=text_2,
    Shader={diffuse=RGB(255, 105, 180), emission=RGB(76, 32, 54), shine=0.5, specular=RGB(255, 255, 255), transparency=0},
    Thickness=Slider(3, range=0..10),
    Absolute=False)

# ---- group: vault
mesh_4 = Mesh(mesh_3)

# ---- group: multistorey mesh
Z_3 = UnitZ(Factor=storey_height)
move_7 = Move(Geometry=mesh_4, Motion=Z_3)  # -> Geometry, Transform
move_8 = Move(Geometry=move_7.Geometry, Motion=Z_3)  # -> Geometry, Transform
merge_5 = Merge(Data1=mesh_4, Data2=move_7.Geometry, Data3=move_8.Geometry)

# ---- group: hieght- vault base to top
bounding_box_2 = BoundingBox(Content=stream_filter_2, Plane=PlaneXY(0, 0, 0), UnionBox=True)  # -> Box, Box_2
deconstruct_brep_3 = DeconstructBrep(Brep=bounding_box_2.Box)  # -> Faces, Edges, Vertices
list_item_4 = ListItem(List=deconstruct_brep_3.Edges, Index="-1", Wrap=True)
length_2 = Length(Curve=list_item_4)
stream_filter_4 = StreamFilter(Gate=list_6, Stream0="0", Stream1=panel_47, Stream2=panel_47)
addition_3 = Addition(A=length_2, B=stream_filter_4)

# ----
# IMPORTING FROM COMPAS
height_of_slab_m = Panel(length_2)

# ---- group: shear_walls
panel_68 = Panel("3")

multiplication_3 = Multiplication(A=division_5, B=panel_68)
X_9 = UnitX(Factor=expr("-x", multiplication_3))
X_10 = UnitX(Factor=multiplication_3)
Y_9 = UnitY(Factor=expr("-x", multiplication_3))
Y_10 = UnitY(Factor=multiplication_3)
entwine_2 = Entwine(Branch00=X_9, Branch01=X_10, FlattenInputs=True)  # -> simplify(Result)
entwine_3 = Entwine(Branch00=Y_9, Branch01=Y_10, FlattenInputs=True)  # -> simplify(Result)

# ----
x_in_meters = Panel(x)
height_of_slab_m_2 = Panel(length_2)
y_in_meters = Panel(y)

# ---- group: h
filter_10 = StreamFilter(Gate=ghpython_script_2.output, Stream0=y_in_meters, Stream1=x_in_meters)

# ---- group: b
filter_11 = StreamFilter(Gate=ghpython_script_2.output, Stream0=x_in_meters, Stream1=y_in_meters)

# ---- group: base divided
rectangle = Rectangle(Plane=PlaneXY(0, 0, 0), XSize=x_in_meters, YSize=y_in_meters, Radius=0)  # -> Rectangle, Length

# ----
explode = Explode(Curve=rectangle.Rectangle, Recursive=True)  # -> Segments, Vertices
item_11 = ListItem(List=explode.Segments, Index=0, Wrap=True)  # -> Item, Item1, Item2, Item3
crv_4 = Curve([item_11.Item1, item_11.Item3])
crv_5 = Curve([item_11.Item, item_11.Item2])
divide = DivideCurve(Curve=crv_5, Count=x_in_meters, Kinks=False)  # -> Points, Tangents, Parameters
divide_2 = DivideCurve(Curve=crv_4, Count=y_in_meters, Kinks=False)  # -> Points, Tangents, Parameters
pt = Point(flatten([divide_2.Points, divide.Points]))

# ---- group: shear_walls (continued)
cull_i_6 = CullIndex(List=explode.Vertices, Indices="-1", Wrap=True)
move_9 = Move(Geometry=simplify(graft(cull_i_6)), Motion=simplify(entwine))  # -> Geometry, Transform
pt_2 = Point(flatten(cull_i_6))
pt_3 = Point(move_9.Geometry)
path_mapper_6 = PathMapper(pt_2, source="{A}(i)", target="{i}(A)")
merge_6 = Merge(Data1=pt_3, Data2=path_mapper_6)
item_12 = TreeItem(Tree=merge_6, Path=panel_58, Index="0", Wrap=True)
item_13 = TreeItem(Tree=merge_6, Path=panel_59, Index="1", Wrap=True)

# ---- group: shear_walls / y_division points
pt_4 = Point(item_13)

# ---- group: shear_walls / x_division points
pt_5 = Point(item_12)

# ---- group: shear_walls (continued)
python_10 = GhPythonScript(x=x_in_meters, y=y_in_meters, shear_wall_length=shear_wall_length_m, shear_wall_depth=division_5)  # -> out, flatten(x_divisions), flatten(x_division_length), flatten(y_divisions), flatten(y_division_length)
# ---------- python_10: Python ----------
list_xy = [x,y]

for xyi, x_y in enumerate(list_xy): 
# removing the end shear walls from each corner (1m long)
    x_y = x_y-2*(shear_wall_length)
    
    if x_y > 4.5:
        bool = True
        for i in range(2,int(x_y),1):
#            s_wall = i*shear_wall_depth
#            x_y_division = (x_y - s_wall + 1)/i
            x_y_division = (x_y)/i
            if x_y_division  < 4.5:
                break
    if xyi == 0:
        x_division_length = x_y_division
        x_divisions = i-1
    if xyi == 1:
        y_division_length = x_y_division
        y_divisions = i-1
# ---------- end python_10 ----------
x_divisions = Panel(python_10.x_divisions)
x_division_length_m = Panel(python_10.x_division_length)
y_divisions = Panel(python_10.y_divisions)
y_division_length_m = Panel(python_10.y_division_length)
series_3 = Series(Start=x_division_length_m, Step=x_division_length_m, Count=x_divisions)
series_4 = Series(Start=y_division_length_m, Step=y_division_length_m, Count=y_divisions)
Y_11 = UnitY(Factor=series_4)
X_11 = UnitX(Factor=series_3)
move_10 = Move(Geometry=graft(pt_5), Motion=X_11)  # -> simplify(Geometry), Transform
move_11 = Move(Geometry=graft(pt_4), Motion=Y_11)  # -> simplify(Geometry), Transform
move_12 = Move(Geometry=move_11.Geometry, Motion=entwine_2)  # -> Geometry, Transform
move_13 = Move(Geometry=move_10.Geometry, Motion=entwine_3)  # -> Geometry, Transform

ln = Line(StartPoint=graft(pt_2), EndPoint=pt_3)
ln_2 = Line(StartPoint=move_10.Geometry, EndPoint=move_13.Geometry)
ln_3 = Line(StartPoint=move_11.Geometry, EndPoint=move_12.Geometry)

# ---- group: shear_walls / shear walls
extr = Extrude(Base=[ln, ln_3, ln_2], Direction=Z_2)

# ---- group: shear_walls (continued)
disc = Discontinuity(Curve=flatten([ln, ln_3, ln_2]), Level=1)  # -> Points, Parameters
duppt = RemoveDuplicatePts(Points=flatten(disc.Points), Tolerance=0.01)

srf = Surface(simplify(flatten(extr)))

# ----
duppt_2 = RemoveDuplicatePts(Points=explode.Vertices, Tolerance=0.01)  # -> flatten(UniquePoints)
duppt_3 = RemoveDuplicatePts(Points=pt, Tolerance=0.01)  # -> flatten(UniquePoints)
python_11 = GhPythonScript(main=duppt_3, points=duppt_2)  # -> out, indices; inputs main: list of Point3d, points: list of Point3d
# ---------- python_11: Python ----------
__author__ = "tahir"
__version__ = "2024.03.13"

import rhinoscriptsyntax as rs

indices = []
for i, val in enumerate(main):
    if val in points:
        indices.append(i)
#print(indices)
# ---------- end python_11 ----------
cull_i_7 = CullIndex(List=duppt_3, Indices=python_11.indices, Wrap=True)

shatter = Shatter(Curve=crv_5, Parameters=divide.Parameters)  # -> simplify(Segments)
Z_4 = UnitZ(Factor=storey_height)
# VAULT GEOMETRY
extr_2 = Extrude(Base=shatter, Direction=Z_4)
panel_69 = Panel("""{0;1}
{1:0}""")
branch_3 = TreeBranch(Tree=extr_2, Path=panel_69, MaintainPaths=True)
path_mapper_7 = PathMapper(branch_3, source="{A;B}", target="{A}")

shatter_2 = Shatter(Curve=crv_4, Parameters=divide_2.Parameters)  # -> simplify(Segments)
Z_5 = UnitZ(Factor=storey_height)
extr_3 = Extrude(Base=shatter_2, Direction=Z_5)
branch_4 = TreeBranch(Tree=extr_3, Path=panel_69, MaintainPaths=True)
path_mapper_8 = PathMapper(branch_4, source="{A;B}", target="{A}")

# ---- group: 3storey? / multistorey columns
Z_6 = UnitZ(Factor=floor_height_m)
move_14 = Move(Geometry=srf, Motion=Z_6)  # -> Geometry, Transform
move_15 = Move(Geometry=move_14.Geometry, Motion=Z_6)  # -> Geometry, Transform
merge_7 = Merge(Data1=srf, Data2=move_14.Geometry, Data3=move_15.Geometry)

# ---- group: edge points
pt_6 = Point(duppt_2)

# ---- group: mid points
pt_7 = Point(cull_i_7)

# ----
entwine_4 = Entwine(Branch00=pt_7, Branch01=pt_6, FlattenInputs=True)

# ---- group: points
graft = GraftTree(Tree=entwine_4, IncludeEmptyLists=True, IncludeNullItems=True)  # -> simplify(Tree)

# ----
srf_2 = Surface(path_mapper_8)
srf_3 = Surface(path_mapper_7)

# ---- group: 3storey?
filter_12 = StreamFilter(Gate=list_7, Stream1=srf, Stream3=merge_7)

# ----
debrep_3 = DeconstructBrep(Brep=srf_2)  # -> Faces, Edges, Vertices
debrep_4 = DeconstructBrep(Brep=srf_3)  # -> Faces, Edges, Vertices

# ---- group: support
point = Point(flatten(graft))

# ---- group: inclusion_points
sdivide = DivideSurface(Surface=filter_12, UCount=Slider(5, range=1..20), VCount=Slider(3, range=1..10))  # -> flatten(Points), Normals, Parameters
duppt_4 = RemoveDuplicatePts(Points=sdivide.Points, Tolerance=0.01)

# ----
item_14 = ListItem(List=flatten(divide.Points), Index=0, Wrap=True)  # -> Item, Item1
item_15 = ListItem(List=flatten(divide_2.Points), Index=0, Wrap=True)  # -> Item, Item1

# ---- group: column / columns
move_16 = Move(Geometry=simplify(graft), Motion=unit_z)  # -> Geometry, Transform
polyline = PolyLine(Vertices=move_16.Geometry, Closed=False)  # -> simplify(Polyline)

# ---- group: side edges
item_16 = ListItem(List=debrep_4.Edges, Index=0, Wrap=True)
item_17 = ListItem(List=debrep_3.Edges, Index=0, Wrap=True)
trim = TrimTree(Tree=item_16, Depth=1)
trim_2 = TrimTree(Tree=item_17, Depth=1)

# ----
branch_5 = TreeBranch(Tree=simplify(debrep_4.Edges), Path="{0;0}", MaintainPaths=True)

# ---- group: distance between columns x
dist = Distance(PointA=item_14.Item, PointB=item_14.Item1)

# ---- group: distance between columns y
dist_2 = Distance(PointA=item_15.Item, PointB=item_15.Item1)

# ----
item_18 = ListItem(List=branch_5, Index=Slider(3, range=0..3), Wrap=True)
divide_3 = DivideCurve(Curve=trim_2, Count="1", Kinks=False)  # -> Points, Tangents, Parameters
divide_4 = DivideCurve(Curve=trim, Count="1", Kinks=False)  # -> Points, Tangents, Parameters

# ---- group: columns
explode_2 = Explode(Curve=polyline, Recursive=True)  # -> simplify(Segments), Vertices

# ---- group: walls partitioned
srf_4 = Surface(flatten([srf_3, srf_2]))

# ---- group: panel points
merge_8 = Merge(Data1=divide_4.Points, Data2=divide_3.Points)

# ----
sdivide_2 = DivideSurface(Surface=srf_4, UCount=Slider(5, range=1..20), VCount=Slider(2, range=1..10))  # -> flatten(Points), Normals, Parameters

# ---- group: multistorey columns
Z_7 = UnitZ(Factor=storey_height)
move_17 = Move(Geometry=explode_2.Segments, Motion=Z_7)  # -> Geometry, Transform
move_18 = Move(Geometry=move_17.Geometry, Motion=Z_7)  # -> Geometry, Transform
merge_9 = Merge(Data1=explode_2.Segments, Data2=move_17.Geometry, Data3=move_18.Geometry)

# ----
duppt_5 = RemoveDuplicatePts(Points=sdivide_2.Points, Tolerance=0.01)

# ---- group: walls partitioned / multistorey columns
Z_8 = UnitZ(Factor=storey_height)
move_19 = Move(Geometry=srf_4, Motion=Z_8)  # -> Geometry, Transform
move_20 = Move(Geometry=move_19.Geometry, Motion=Z_8)  # -> Geometry, Transform
merge_10 = Merge(Data1=srf_4, Data2=move_19.Geometry, Data3=move_20.Geometry)

# ---- group: inclusion points for walls
pt_8 = Point(flatten(duppt_5))

# ---- group: walls partitioned inclusion points / multistorey columns
Z_9 = UnitZ(Factor=storey_height)
move_21 = Move(Geometry=pt_8, Motion=Z_9)  # -> Geometry, Transform
move_22 = Move(Geometry=move_21.Geometry, Motion=Z_9)  # -> Geometry, Transform
merge_11 = Merge(Data1=pt_8, Data2=move_21.Geometry, Data3=move_22.Geometry)

# ----
filter_13 = StreamFilter(Gate=list_7, Stream1=explode_2.Segments, Stream3=merge_9)
filter_14 = StreamFilter(Gate=list_7, Stream1=mesh_4, Stream3=merge_5)
msh2psrf = MeshToPolysurface(Mesh=filter_14, Triangles=False, FaceMerge=False)
split_7 = SplitTree(Data=filter_13, Masks=flatten("{1;?}"))  # -> Positive, Negative

# ---- group: column walls / columns_mid
crv_6 = Curve(split_7.Negative)

# ---- group: column walls
python_12 = GhPythonScript(x=x_in_meters, y=y_in_meters)  # -> out, a, b, c, d, a_last, b_last, c_last, d_last; inputs x: Int32, y: Int32
# ---------- python_12: Python ----------
__author__ = "tahir"
__version__ = "2024.03.27"

import rhinoscriptsyntax as rs


y= y-1
x =x-1

a = range(0,y)
a_last = a[-1]
b= range(y,x+y)
b_last = b[-1]

c= range(b[-1]+1,b[-1]+1 +y)
c_last=c[-1]
d = range(c[-1]+1,c[-1]+1 +x)
d_last=d[-1]
# ---------- end python_12 ----------
branch_6 = TreeBranch(Tree=simplify(crv_6), Path=python_12.b, MaintainPaths=True)
branch_7 = TreeBranch(Tree=simplify(crv_6), Path=python_12.a, MaintainPaths=True)
branch_8 = TreeBranch(Tree=simplify(crv_6), Path=python_12.c, MaintainPaths=True)
branch_9 = TreeBranch(Tree=simplify(crv_6), Path=python_12.d, MaintainPaths=True)

panel_70 = Panel("""0
-1""")
item_19 = ListItem(List=python_12.a, Index=panel_70, Wrap=True)
item_20 = ListItem(List=python_12.c, Index=panel_70, Wrap=True)
item_21 = ListItem(List=python_12.b, Index=panel_70, Wrap=True)
item_22 = ListItem(List=python_12.d, Index=panel_70, Wrap=True)
X_12 = UnitX(Factor=expr("-x", "0.75"))
Y_12 = UnitY(Factor=expr("-x", "0.75"))
X_13 = UnitX(Factor="0.75")
Y_13 = UnitY(Factor="0.75")
branch_10 = TreeBranch(Tree=simplify(branch_7), Path=item_19, MaintainPaths=True)  # -> flatten(Branch)
branch_11 = TreeBranch(Tree=simplify(branch_9), Path=item_22, MaintainPaths=True)  # -> flatten(Branch)
branch_12 = TreeBranch(Tree=simplify(branch_8), Path=item_20, MaintainPaths=True)  # -> flatten(Branch)
branch_13 = TreeBranch(Tree=simplify(branch_6), Path=item_21, MaintainPaths=True)  # -> flatten(Branch)
entwine_5 = Entwine(Branch00=Y_12, Branch01=Y_13, FlattenInputs=True)  # -> simplify(Result)
entwine_6 = Entwine(Branch00=Y_13, Branch01=Y_12, FlattenInputs=True)  # -> simplify(Result)
entwine_7 = Entwine(Branch00=X_12, Branch01=X_13, FlattenInputs=True)  # -> simplify(Result)
entwine_8 = Entwine(Branch00=X_13, Branch01=X_12, FlattenInputs=True)  # -> simplify(Result)
partition = PartitionList(List=branch_10, Size=list_7)
partition_2 = PartitionList(List=branch_12, Size=list_7)
partition_3 = PartitionList(List=branch_13, Size=list_7)
partition_4 = PartitionList(List=branch_11, Size=list_7)
move_23 = Move(Geometry=partition_2, Motion=entwine_6)  # -> Geometry, Transform
move_24 = Move(Geometry=partition, Motion=entwine_5)  # -> Geometry, Transform
move_25 = Move(Geometry=partition_3, Motion=entwine_7)  # -> Geometry, Transform
move_26 = Move(Geometry=partition_4, Motion=entwine_8)  # -> Geometry, Transform

# ---- group: walls partitioned
filter_15 = StreamFilter(Gate=list_7, Stream1=srf_4, Stream3=merge_10)

# ---- group: walls partitioned inclusion points
filter_16 = StreamFilter(Gate=list_7, Stream1=pt_8, Stream3=merge_11)

# ----
duppt_6 = RemoveDuplicatePts(Points=filter_16, Tolerance=0.01)

# ---- group: supports and other points on mesh
wbnaked = WeaverbirdsNakedBoundary(MeshClosedPolylines=filter_14)
demesh = DeconstructMesh(Mesh=filter_14)  # -> Vertices, Faces, Colours, Normals
incurve = PointInCurve(Point=demesh.Vertices, Curve=wbnaked)  # -> Relationship, Point
expression = Expression(x=incurve.Relationship, Expression="if(x=1,True,False)")
dispatch_3 = Dispatch(List=demesh.Vertices, DispatchPattern=expression)  # -> ListA, ListB
rdpoints = RemoveDuplicatePointsKaramba3D(Point=dispatch_3.ListA, LimitDistance=0.005)  # -> OutPoint, Info, Indexes
rdpoints_2 = RemoveDuplicatePointsKaramba3D(Point=dispatch_3.ListB, LimitDistance=0.005)  # -> OutPoint, Info, Indexes

# ---- group: MASS OF STRUCTURE / column wall
panel_71 = Panel(thickness_of_wall_mm)
division_8 = Division(A=panel_71, B="1000")
multiplication_4 = Multiplication(A=division_8, B="2")
multiplication_5 = Multiplication(A=division_8, B="2")
subtraction_2 = Subtraction(A=x_in_meters, B=multiplication_4)
subtraction_3 = Subtraction(A=y_in_meters, B=multiplication_5)
multiplication_6 = Multiplication(A=x_in_meters, B=y_in_meters)
multiplication_7 = Multiplication(A=subtraction_2, B=subtraction_3)
subtraction_4 = Subtraction(A=multiplication_6, B=multiplication_7)
multiplication_8 = Multiplication(A=subtraction_4, B=floor_height_m)

# ---- group: MASS OF STRUCTURE / shear walls volume/m3
area = Area(Geometry=flatten(srf))  # -> Area, Centroid
ma_2 = MassAddition(Input=area.Area)  # -> Result, PartialResults
multiplication_9 = Multiplication(A=ma_2.Result, B=division_8)

# ---- group: MASS OF STRUCTURE / column walls or shear walls mass/kg / column wall mass
multiplication_10 = Multiplication(A=multiplication_8, B=filter_3)

# ---- group: supports and other points on mesh / slab point
pt_9 = Point(rdpoints.OutPoint)

# ---- group: supports and other points on mesh / vault points but not_support
pt_10 = Point(rdpoints_2.OutPoint)

# ---- group: karamba?
# GEOMETRY OUTPUT
expression_2 = Expression(x=turn_on_karamba, Expression="if(x=True,1,0)")
stream_filter_5 = StreamFilter(Gate=expression_2, Stream1=msh2psrf)

# ---- group: inclusion_points_shear_walls_beam
pt_11 = Point(duppt_4)

# ---- group: vault for karamba
brep_2 = Brep(stream_filter_5)

# ---- group: shear_walls
srf_5 = Surface(filter_12)

# ---- group: karamba assembly / shear_walls
panel_72 = Panel(thickness_of_wall_mm)
division_9 = Division(A=panel_72, B="10")
cross_section_karamba3d = CrossSectionKaramba3D(
    FamilyNameOfCrossSection="DefaultCroSec",
    Material=material_properties_karamba3d,
    Height_cm=division_9,
    mode="Shell - Const")
# KARAMBA SET UP FOR
# RSA + MODAL ANALYSIS
mesh_breps_karamba3d = MeshBrepsKaramba3D(
    Brep=srf_5,
    InclusionPoints=flatten(pt_11),
    MeshResolution=1,
    EdgeRefinementFactor=0.67,
    PointReduction=False,
    SmoothingStepSize=0,
    SmoothingIterations=5)  # -> Mesh, Info
mesh_to_shell_karamba3d = MeshToShellKaramba3D(Mesh=mesh_breps_karamba3d.Mesh, Identifier="shear_walls", CrossSection=cross_section_karamba3d, LimitDistance_m=0.005)  # -> Element, Points, Info

# ----
panel_73 = Panel(list_7)

# ---- group: column walls
entwine_9 = Entwine(Branch00=branch_6, Branch01=branch_9, FlattenInputs=True)
entwine_10 = Entwine(Branch00=move_25.Geometry, Branch01=move_26.Geometry, FlattenInputs=True)
entwine_11 = Entwine(Branch00=branch_7, Branch01=branch_8, FlattenInputs=True)
entwine_12 = Entwine(Branch00=move_24.Geometry, Branch01=move_23.Geometry, FlattenInputs=True)
end_3 = EndPoints(Curve=[entwine_10, entwine_9, entwine_12, entwine_11])  # -> Start, End
duppt_7 = RemoveDuplicatePts(Points=flatten([end_3.End, end_3.Start]), Tolerance=0.01)

# ---- group: column walls / inclusion points - columnwall
pt_12 = Point(duppt_7)

# ---- group: column walls (continued)
project = Project(Geometry=pt_12, Plane=PlaneXY(0, 0, 0))  # -> Geometry, Transform
duppt_8 = RemoveDuplicatePts(Points=flatten(project.Geometry), Tolerance=0.01)

# ---- group: inclusion points - columnwall
pt_13 = Point(pt_12)

# ---- group: supports - columnwall
pt_14 = Point(duppt_8)

# ---- group: columns edge x
crv_7 = Curve(entwine_10)

# ---- group: columns mid y
crv_8 = Curve(entwine_11)

# ---- group: columns edge y
crv_9 = Curve(entwine_12)

# ---- group: columns mid x
crv_10 = Curve(entwine_9)

# ----
stream_filter_6 = StreamFilter(Gate=list_6, Stream1=flatten(pt_13), Stream2=pt_11)

pt_15 = Point(stream_filter_6)
bbox_3 = BoundingBox(Content=pt_15, Plane=PlaneXY(0, 0, 0), UnionBox=True)  # -> Box, Box_2
debrep_5 = DeconstructBrep(Brep=bbox_3.Box)  # -> Faces, Edges, Vertices
item_23 = ListItem(List=debrep_5.Faces, Index="4", Wrap=True)
srf_cp = SurfaceClosestPoint(Point=pt_15, Surface=item_23)  # -> Point, UVPoint, Distance

# ---- group: supports for shear walls
srf_cp_2 = SurfaceClosestPoint(Point=duppt_4, Surface=item_23)  # -> Point, UVPoint, Distance
python_13 = GhPythonScript(x=flatten("0"), distances=srf_cp_2.Distance)  # -> out, output; inputs x: list, distances: list
# ---------- python_13: Python ----------
output = []
for distance in distances:
    distance = round(distance)
    if distance in x:
        bool = True
    else:
        bool = False
    output.append(bool)

print(x)
# ---------- end python_13 ----------
dispatch_4 = Dispatch(List=duppt_4, DispatchPattern=python_13.output)  # -> ListA, ListB
pt_16 = Point(dispatch_4.ListA)

# ---- group: column walls level 1
python_14 = GhPythonScript(x="0", distances=srf_cp.Distance)  # -> out, output; inputs distances: list
# ---------- python_14: Python ----------
sum=0
output = []
for distance in distances:
    distance = round(distance)
    if distance == x:
        bool = True
        sum+=1
    else:
        bool = False
    output.append(bool)

print(sum)
# ---------- end python_14 ----------
dispatch_5 = Dispatch(List=pt_15, DispatchPattern=python_14.output)  # -> ListA, ListB

# ---- group: supports_shear_walls
pt_17 = Point(pt_16)

# ---- group: level 1
# GRAVITY LOAD
pt_18 = Point(dispatch_5.ListA)

# ---- group: karamba assembly / column walls edge x
cross_section = CrossSectionKaramba3D(
    FamilyNameOfCrossSection="DefaultCroSec",
    Material=material_properties_karamba3d,
    Height_cm=expr("x/20", panel_19),
    UpperFlangeWidth_cm=expr("x/10", panel_20),
    LowerFlangeWidth_cm=expr("x/10", panel_20),
    mode="Trapezoid")
linetobeam = LineToBeamKaramba3D(
    Line=entwine_10,
    Identifier=panel_24,
    CrossSection=cross_section,
    New=True,
    Remove=True,
    LimitDistance_m=0.005,
    Bending=True,
    SetBucklingLength=True,
    ToPolylineMaxAngle=0.03,
    ToPolylineTolerance=0.01,
    ToPolylineMaxEdgeLength=0.25)  # -> Element, Points, Info

# ---- group: karamba assembly / column walls mid x
cross_section_2 = CrossSectionKaramba3D(
    FamilyNameOfCrossSection="DefaultCroSec",
    Material=material_properties_karamba3d,
    Height_cm=expr("x/10", panel_19),
    UpperFlangeWidth_cm=expr("x/10", panel_20),
    LowerFlangeWidth_cm=expr("x/10", panel_20),
    mode="Trapezoid")
linetobeam_2 = LineToBeamKaramba3D(
    Line=entwine_9,
    Identifier=panel_24,
    CrossSection=cross_section_2,
    New=True,
    Remove=True,
    LimitDistance_m=0.005,
    Bending=True,
    SetBucklingLength=True,
    ToPolylineMaxAngle=0.03,
    ToPolylineTolerance=0.01,
    ToPolylineMaxEdgeLength=0.25)  # -> Element, Points, Info

# ---- group: karamba assembly / column walls mid y
cross_section_3 = CrossSectionKaramba3D(
    FamilyNameOfCrossSection="DefaultCroSec",
    Material=material_properties_karamba3d,
    Height_cm=expr("x/10", panel_21),
    UpperFlangeWidth_cm=expr("x/10", panel_22),
    LowerFlangeWidth_cm=expr("x/10", panel_22),
    mode="Trapezoid")
linetobeam_3 = LineToBeamKaramba3D(
    Line=entwine_11,
    Identifier=panel_24,
    CrossSection=cross_section_3,
    New=True,
    Remove=True,
    LimitDistance_m=0.005,
    Bending=True,
    SetBucklingLength=True,
    ToPolylineMaxAngle=0.03,
    ToPolylineTolerance=0.01,
    ToPolylineMaxEdgeLength=0.25)  # -> Element, Points, Info

# ---- group: karamba assembly / column walls edge y
cross_section_4 = CrossSectionKaramba3D(
    FamilyNameOfCrossSection="DefaultCroSec",
    Material=material_properties_karamba3d,
    Height_cm=expr("x/10", panel_21),
    UpperFlangeWidth_cm=expr("x/20", panel_22),
    LowerFlangeWidth_cm=expr("x/20", panel_22),
    mode="Trapezoid")
linetobeam_4 = LineToBeamKaramba3D(
    Line=entwine_12,
    Identifier=panel_24,
    CrossSection=cross_section_4,
    New=True,
    Remove=True,
    LimitDistance_m=0.005,
    Bending=True,
    SetBucklingLength=True,
    ToPolylineMaxAngle=0.03,
    ToPolylineTolerance=0.01,
    ToPolylineMaxEdgeLength=0.25)  # -> Element, Points, Info

# ---- group: replicate vaults as unjoined
incurve_2 = PointInCurve(Point=demesh.Vertices, Curve=graft(wbnaked))  # -> Relationship, Point
expression_3 = Expression(x=incurve_2.Relationship, Expression="if(x=1,True,False)")
dispatch_6 = Dispatch(List=demesh.Vertices, DispatchPattern=expression_3)  # -> ListA, ListB
rdpoints_3 = RemoveDuplicatePointsKaramba3D(Point=dispatch_6.ListA, LimitDistance=0.005)  # -> OutPoint, Info, Indexes
rdpoints_4 = RemoveDuplicatePointsKaramba3D(Point=dispatch_6.ListB, LimitDistance=0.005)  # -> OutPoint, Info, Indexes
python_15 = GhPythonScript(x=distance_between_vaults)  # -> out, output
# ---------- python_15: Python ----------
if x == 0:
    output = 0
else:
    output = 1
# ---------- end python_15 ----------

# ---- group: replicate vaults as unjoined / slab point
pt_19 = Point(flatten(rdpoints_3.OutPoint))

# ---- group: replicate vaults as unjoined / vault points but not_support
pt_20 = Point(flatten(rdpoints_4.OutPoint))

# ---- group: replicate vaults as unjoined (continued)
filter_17 = StreamFilter(Gate=python_15.output, Stream0=pt_10, Stream1=pt_20)
filter_18 = StreamFilter(Gate=python_15.output, Stream0=pt_9, Stream1=pt_19)
filter_19 = StreamFilter(Gate=list_2, Stream0=pt_9, Stream1=filter_18)
filter_20 = StreamFilter(Gate=list_2, Stream0=pt_10, Stream1=filter_17)

# ----
branch_14 = TreeBranch(Tree=simplify(filter_19), Path="0", MaintainPaths=True)
branch_15 = TreeBranch(Tree=simplify(filter_20), Path="0", MaintainPaths=True)
branch_16 = TreeBranch(Tree=simplify(filter_19), Path="1", MaintainPaths=True)
branch_17 = TreeBranch(Tree=simplify(filter_20), Path="1", MaintainPaths=True)
branch_18 = TreeBranch(Tree=simplify(filter_20), Path="2", MaintainPaths=True)
branch_19 = TreeBranch(Tree=simplify(filter_19), Path="2", MaintainPaths=True)
entwine_13 = Entwine(
    Branch00=branch_14,
    Branch01=branch_15,
    Branch02=branch_16,
    Branch03=branch_17,
    Branch04=branch_19,
    Branch05=branch_18,
    FlattenInputs=True)

entwine_14 = Entwine(Branch00=filter_19, Branch01=filter_20, FlattenInputs=True)

# ---- group: supports
pt_21 = Point(filter_19)

# ---- group: BEAMS / supports for valut bases for top stories
pt_22 = Point(pt_21)

# ---- group: BEAMS
srf_cp_3 = SurfaceClosestPoint(Point=pt_22, Surface=item_23)  # -> Point, UVPoint, Distance

# ----
stream_filter_7 = StreamFilter(Gate=list_6, Stream0=flatten(pt_21), Stream1=flatten(pt_14), Stream2=pt_17)
filter_21 = StreamFilter(Gate=list_7, Stream1=entwine_14, Stream3=entwine_13)

# ---- group: points for seismic loads
pt_23 = Point(filter_21)

# ---- group: force in y axis distributed in points loads / points from vault in x and y
point_2 = Point(simplify(pt_23))

# ---- group: gravity load axis distributed in points loads / points from vault in x and y
point_3 = Point(simplify(pt_23))  # disabled

# ---- group: force in y axis distributed in points loads / level 1
tree_branch = TreeBranch(Tree=point_2, Path=panel_15, MaintainPaths=True)  # -> flatten(Branch)

# ---- group: force in y axis distributed in points loads / level 2
tree_branch_2 = TreeBranch(Tree=point_2, Path=panel_16, MaintainPaths=True)  # -> flatten(Branch)

# ---- group: points from vault in x and y
point_4 = Point(simplify(pt_23))

# ---- group: gravity load axis distributed in points loads / level 1
tree_branch_3 = TreeBranch(Tree=point_3, Path=panel_17, MaintainPaths=True)  # -> flatten(Branch); disabled

# ---- group: gravity load axis distributed in points loads / level 2
tree_branch_4 = TreeBranch(Tree=point_3, Path=panel_18, MaintainPaths=True)  # -> flatten(Branch); disabled

# ----
list_length = ListLength(List=tree_branch_2)

# ---- group: level 2
panel_74 = Panel("""0
1""")
branch_20 = TreeBranch(Tree=point_4, Path=panel_74, MaintainPaths=True)  # -> flatten(Branch)

# ---- group: level 4
panel_75 = Panel("""2
3""")
branch_21 = TreeBranch(Tree=point_4, Path=panel_75, MaintainPaths=True)  # -> flatten(Branch)

# ---- group: level 6
panel_76 = Panel("""4
5""")
branch_22 = TreeBranch(Tree=point_4, Path=panel_76, MaintainPaths=True)  # -> flatten(Branch)

# ----
# HEIGHT OF NODES
number_slider_4 = Slider(4, range=0..5)
panel_77 = Panel("""0
1""")
branch_23 = TreeBranch(Tree=simplify(filter_21), Path=panel_77, MaintainPaths=True)  # -> flatten(Branch)
item_24 = ListItem(List=deconstruct_brep_3.Faces, Index=number_slider_4, Wrap=True)
duppt_9 = RemoveDuplicatePts(Points=branch_23, Tolerance=0.01)
srf_cp_4 = SurfaceClosestPoint(Point=duppt_9, Surface=item_24)  # -> Point, flatten(UVPoint), flatten(Distance)
Z_10 = UnitZ(Factor=1)
move_27 = Move(Geometry=srf_cp_4.Point, Motion=Z_10)  # -> Geometry, Transform

# ---- group: coordinate of flat points
panel_78 = Panel(srf_cp_4.UVPoint)

# ---- group: height of points/m
panel_79 = Panel(srf_cp_4.Distance)

# ---- group: karamba assembly / vault_karamba / seismic force on vault points
point_5 = Point(pt_23)

# ---- group: karamba assembly / support
removeduplicatepts = RemoveDuplicatePts(Points=flatten(stream_filter_7), Tolerance=0.01)
support_karamba3d = SupportKaramba3D(PosInd=flatten(removeduplicatepts), menu=[buttons(on, on, on, on, on, on)])

# ----
filter_22 = StreamFilter(Gate=list_9, Stream1=support_karamba3d)

python_16 = GhPythonScript(name=file_path_mesh_5, node_coord=panel_78, node_h=panel_79)  # -> out, a; inputs node_coord: list, node_h: list; disabled
# ---------- python_16: Python ----------
import json
import os


if not os.path.exists(directory):
    os.makedirs(directory)

height_dict = {}

for i,val in enumerate(node_h):
    height_dict[i]={}
    height_dict[i]['coordinates']= node_coord[i]
    height_dict[i]['height']= node_h[i]


with open(name, 'w') as f:
    json.dump(height_dict, f)
#print("The list has been written to the JSON file.")
# ---------- end python_16 ----------

# ---- group: MASS OF STRUCTURE / vault volume/m3
area_2 = Area(Geometry=stream_filter_2)  # -> Area, Centroid

# ----
area_vault = Number(area_2.Area)

# ---- group: BEAMS
bbox_4 = BoundingBox(Content=msh2psrf, Plane=PlaneXY(0, 0, 0))  # -> Box, Box_2
debrep_6 = DeconstructBrep(Brep=bbox_4.Box)  # -> Faces, Edges, Vertices
item_25 = ListItem(List=debrep_6.Faces, Index="4", Wrap=True)
debrep_7 = DeconstructBrep(Brep=item_25)  # -> Faces, Edges, Vertices
crv_11 = Curve(debrep_7.Edges)

# ---- group: MASS OF STRUCTURE / length of beams
branch_24 = TreeBranch(Tree=simplify(crv_11), Path="0", MaintainPaths=True)
len_3 = Length(Curve=branch_24)
ma_3 = MassAddition(Input=len_3)  # -> Result, PartialResults

# ---- group: MASS OF STRUCTURE / volume of beams
multiplication_11 = Multiplication(A=multiplication, B=ma_3.Result)

# ---- group: MASS OF STRUCTURE
addition_4 = Addition(A=multiplication_9, B=multiplication_11)

# ---- group: MASS OF STRUCTURE / shear wall+beams mass
multiplication_12 = Multiplication(A=addition_4, B=filter_3)

# ---- group: MASS OF STRUCTURE / column walls or shear walls mass/kg
stream_filter_8 = StreamFilter(Gate=list_6, Stream0=flatten("0"), Stream1=flatten(multiplication_10), Stream2=flatten(multiplication_12))
panel_80 = Panel(stream_filter_8)

# ----
# LATERAL LOADS
# GRAVITY LOAD
panel_81 = Panel("9.81")

# ----
# HEIGHT / WEIGHT
python_17 = GhPythonScript(h_vault=length_2, h_col=stream_filter_4, no_storeys=list_7)  # -> out, height_list; inputs no_storeys: Int32
# ---------- python_17: Python ----------
__author__ = "tahir"
__version__ = "2024.03.10"

import rhinoscriptsyntax as rs

height_list_initial = [h_col,h_vault]
height_list_initial = height_list_initial*no_storeys


height_list=[]
sum= 0
#for i in height_list_initial:
#    sum+=i
#    height_list.append(sum)

for i,val in enumerate(height_list_initial):
    if i%2 == 0:
        sum+=val
        height_list.append(sum)
    else:
        height_list.append(sum+val)
# ---------- end python_17 ----------

height_list_m = Panel(python_17.height_list)

# ---- group: BEAMS / supports for valut bases for top stories
item_26 = ListItem(List=height_list_m, Index="0", Wrap=True)
item_27 = ListItem(List=height_list_m, Index="2", Wrap=True)
item_28 = ListItem(List=height_list_m, Index="4", Wrap=True)
python_18 = GhPythonScript(x=flatten(item_26), distances=srf_cp_3.Distance)  # -> out, output; inputs x: list, distances: list; same code as python_13
python_19 = GhPythonScript(x=flatten(item_27), distances=srf_cp_3.Distance)  # -> out, output; inputs x: list, distances: list; same code as python_13
python_20 = GhPythonScript(x=flatten(item_28), distances=srf_cp_3.Distance)  # -> out, output; inputs x: list, distances: list; same code as python_13
dispatch_7 = Dispatch(List=pt_22, DispatchPattern=python_18.output)  # -> ListA, ListB
dispatch_8 = Dispatch(List=pt_22, DispatchPattern=python_19.output)  # -> ListA, ListB
dispatch_9 = Dispatch(List=pt_22, DispatchPattern=python_20.output)  # -> ListA, ListB
pt_24 = Point(dispatch_9.ListA)
pt_25 = Point(dispatch_7.ListA)
pt_26 = Point(dispatch_8.ListA)
entwine_15 = Entwine(Branch00=pt_25, Branch01=pt_26, Branch02=pt_24, FlattenInputs=True)

# ---- group: BEAMS (continued)
curveshatter = CurveShatter(Curve=crv_11, Points=entwine_15, Tolerance=0.01)  # -> simplify(Curves)
trim_3 = TrimTree(Tree=curveshatter, Depth=1)
dupln = RemoveDuplicateLines(Lines=trim_3, Tolerance=0.01)
end_4 = EndPoints(Curve=dupln)  # -> Start, End
duppt_10 = RemoveDuplicatePts(Points=flatten([end_4.Start, end_4.End]), Tolerance=0.01)

# ---- group: column walls level 3
item_29 = ListItem(List=height_list_m, Index="2", Wrap=True)
python_21 = GhPythonScript(x=item_29, distances=srf_cp.Distance)  # -> out, output; inputs distances: list
# ---------- python_21: Python ----------
output = []
for distance in distances:
    distance = round(distance)
    if distance == x:
        bool = True
    else:
        bool = False
    output.append(bool)
# ---------- end python_21 ----------
dispatch_10 = Dispatch(List=pt_15, DispatchPattern=python_21.output)  # -> ListA, ListB

# ---- group: column walls level 2
item_30 = ListItem(List=height_list_m, Index="0", Wrap=True)
python_22 = GhPythonScript(x=item_30, distances=srf_cp.Distance)  # -> out, output; inputs distances: list; same code as python_21
dispatch_11 = Dispatch(List=pt_15, DispatchPattern=python_22.output)  # -> ListA, ListB

# ----
curveshatter_2 = CurveShatter(Curve=flatten(dupln), Points=flatten(pt_11), Tolerance=0.01)  # -> simplify(flatten(Curves))
dupln_2 = RemoveDuplicateLines(Lines=curveshatter_2, Tolerance=0.01)
end_5 = EndPoints(Curve=dupln_2)  # -> Start, End
duppt_11 = RemoveDuplicatePts(Points=flatten([end_5.Start, end_5.End]), Tolerance=0.01)

# ---- group: inclusion points for vault bases_beam
pt_27 = Point(duppt_10)

# ---- group: INCLUSION POINTS FOR VAULT DEPENDING ON WALLS?
stream_filter_9 = StreamFilter(Gate=list_6, Stream0=point, Stream1=flatten(pt_13), Stream2=flatten(pt_27))

# ---- group: beams
crv_12 = Curve(dupln_2)

# ---- group: level 3
pt_28 = Point(dispatch_11.ListA)

# ----
vec = Vector(simplify(flatten(crv_12)))

# ---- group: level 5
pt_29 = Point(dispatch_10.ListA)

# ----
filter_23 = StreamFilter(Gate=list_2, Stream0=stream_filter_9)

python_23 = GhPythonScript(input=vec, x=X_2, x_neg=X, y=Y_2, y_neg=Y)  # -> out, bool_list; inputs input: list of Vector3d
# ---------- python_23: Python ----------
import rhinoscriptsyntax as rs
import ghpythonlib.treehelpers as th

def tree_to_nested_list(x):
    '''Convert a tree into a nested list'''
    nested_list = []
    for i in range(x.BranchCount):
        branchList = x.Branch(i)
        branch = []
    
        for j in range(branchList.Count):
            s = branchList[j]
            branch.append(s)
        nested_list.append(branch)
    return nested_list

#input = tree_to_nested_list(input)

#branch_list = []
#for branch in input:
#    bool_list = []
#    for vector in branch:
#        if vector == x or vector== x_neg:
#            output = True
#        elif vector == y or vector== y_neg:
#            output = False
#        bool_list.append(output)
#    branch_list.append(bool_list)
#
#print(branch_list)
#
## Convert the nested list to a data tree
#branch_list = th.list_to_tree(branch_list)

bool_list= []
for vector in input:
    if vector == x or vector== x_neg:
        output = True
    elif vector == y or vector== y_neg:
        output = False
    bool_list.append(output)
# ---------- end python_23 ----------
dispatch_12 = Dispatch(List=flatten(crv_12), DispatchPattern=python_23.bool_list)  # -> ListA, ListB
crv_13 = Curve(dispatch_12.ListB)
crv_14 = Curve(dispatch_12.ListA)

# ---- group: karamba assembly / vault_karamba
panel_82 = Panel(thickness_of_vault_mm_2)
division_10 = Division(A=panel_82, B="10")
cross_section_karamba3d_2 = CrossSectionKaramba3D(
    FamilyNameOfCrossSection="DefaultCroSec",
    Material=material_properties_karamba3d,
    Height_cm=division_10,
    mode="Shell - Const")
mesh_breps_karamba3d_2 = MeshBrepsKaramba3D(
    Brep=flatten(brep_2),
    InclusionPoints=flatten([point_5, filter_23]),
    MeshResolution=1,
    EdgeRefinementFactor=0.67,
    PointReduction=False,
    SmoothingStepSize=0,
    SmoothingIterations=5)  # -> Mesh, Info
mesh_to_shell_karamba3d_2 = MeshToShellKaramba3D(Mesh=mesh_breps_karamba3d_2.Mesh, Identifier="vault", CrossSection=cross_section_karamba3d_2, LimitDistance_m=0.005)  # -> Element, Points, Info

# ---- group: MASS OF STRUCTURE / vault volume/m3 (continued)
division_11 = Division(A=division_10, B="100")
multiplication_13 = Multiplication(A=area_2.Area, B=division_11)

# ---- group: column wall
addition_5 = Addition(A=multiplication_13, B=multiplication_8)

# ---- group: shear wall+beams
addition_6 = Addition(A=multiplication_13, B=addition_4)

# ---- group: MASS OF STRUCTURE / vault mass/kg
multiplication_14 = Multiplication(A=multiplication_13, B=filter_3)
panel_83 = Panel(multiplication_14)

# ---- group: MASS OF STRUCTURE / total mass/kg
multiplication_15 = Multiplication(A=addition_5, B=filter_3)
multiplication_16 = Multiplication(A=addition_6, B=filter_3)

# ----
stream_filter_10 = StreamFilter(Gate=list_6, Stream0=flatten(multiplication_14), Stream1=flatten(multiplication_15), Stream2=flatten(multiplication_16))
python_24 = GhPythonScript(a_vault=area_2.Area, m_vault=panel_83, m_col=panel_80, no_storeys=list_7)  # -> out, mass_list, m, mass_list_initial; inputs no_storeys: Int32
# ---------- python_24: Python ----------
__author__ = "tahir"
__version__ = "2024.03.10"

import rhinoscriptsyntax as rs

mass_list_initial = [m_col,m_vault]
mass_list_initial = mass_list_initial*no_storeys



ψ2i = 0.3
m=[]
for i, mi in enumerate(mass_list_initial):
    # if mass is columns, no live load needs to factored
    if i%2==0:
        mi = round(mi,5)
    # if mass is vault, live load needs to be factored
    else:
        if i == len(mass_list_initial) - 1:
            φ = 1.0
        else:
            φ = 0.8

        ψEi = ψ2i*φ   
        live_load = ψEi*2000*a_vault/9.81        
        mi = round((mi + live_load),5)

    m.append(mi)



# mass adding up incrementally
mass_list=[]
sum= 0
for i in m:
    sum+=i
    mass_list.append(sum)
# ---------- end python_24 ----------

mass_list_unfactored_kg_just_for_testing = Panel(python_24.mass_list_initial)

# ---- group: mass to weight
multiplication_17 = Multiplication(A=python_24.m, B=panel_81)

# ---- group: N to KN
division_12 = Division(A=multiplication_17, B="1000")

# ---- group: MASS OF STRUCTURE / total mass/kg (continued)
panel_84 = Panel(stream_filter_10)

# ---- group: gravity load axis distributed in points loads
list_item_5 = ListItem(List=division_12, Index=0, Wrap=True)  # -> Item, Item1, Item2, Item3, Item4, Item5; disabled
panel_85 = Panel("2")  # disabled
panel_86 = Panel("5")  # disabled
panel_87 = Panel("3")  # disabled
panel_88 = Panel("4")  # disabled
list_length_2 = ListLength(List=tree_branch_3)  # disabled
Z_11 = UnitZ(Factor=expr("-x", 1))  # disabled
panel_89 = Panel("seismic")  # disabled

# ---- group: gravity load axis distributed in points loads / level 3
tree_branch_5 = TreeBranch(Tree=point_3, Path=panel_85, MaintainPaths=True)  # -> flatten(Branch); disabled

# ---- group: gravity load axis distributed in points loads / level 4
tree_branch_6 = TreeBranch(Tree=point_3, Path=panel_87, MaintainPaths=True)  # -> flatten(Branch); disabled

# ---- group: gravity load axis distributed in points loads / level 6
tree_branch_7 = TreeBranch(Tree=point_3, Path=panel_86, MaintainPaths=True)  # -> flatten(Branch); disabled

# ---- group: gravity load axis distributed in points loads / level 5
tree_branch_8 = TreeBranch(Tree=point_3, Path=panel_88, MaintainPaths=True)  # -> flatten(Branch); disabled

# ----
list_item_6 = ListItem(List=division_12, Index=0, Wrap=True)  # -> Item, Item1, Item2, Item3, Item4, Item5
# ---- group: gravity load axis distributed in points loads / level 6 force magnitude
division_13 = Division(A=list_item_5.Item5, B=list_length_2)  # disabled
multiplication_18 = Multiplication(A=Z_11, B=division_13)  # disabled

# ---- group: gravity load axis distributed in points loads / level 2 force magnitude
division_14 = Division(A=list_item_5.Item1, B=list_length_2)  # disabled
multiplication_19 = Multiplication(A=Z_11, B=division_14)  # disabled

# ---- group: gravity load axis distributed in points loads / level 1 force magnitude
division_15 = Division(A=list_item_5.Item, B=list_length_2)  # disabled
multiplication_20 = Multiplication(A=Z_11, B=division_15)  # disabled

# ---- group: gravity load axis distributed in points loads / level 4 force magnitude
division_16 = Division(A=list_item_5.Item3, B=list_length_2)  # disabled
multiplication_21 = Multiplication(A=Z_11, B=division_16)  # disabled

# ---- group: gravity load axis distributed in points loads / level 5 force magnitude
division_17 = Division(A=list_item_5.Item4, B=list_length_2)  # disabled
multiplication_22 = Multiplication(A=Z_11, B=division_17)  # disabled

# ---- group: gravity load axis distributed in points loads / level 3 force magnitude
division_18 = Division(A=list_item_5.Item2, B=list_length_2)  # disabled
multiplication_23 = Multiplication(A=Z_11, B=division_18)  # disabled

# ----
python_25 = GhPythonScript(point_list=pt_18, force=list_item_6.Item)  # -> out, vector, point_list; inputs point_list: list
# ---------- python_25: Python ----------
import rhinoscriptsyntax as rs

length = len(point_list)
force_per_point = force / length

x, y, z = 0, 0, -force_per_point
vector = rs.VectorCreate([x, y, z], [0, 0, 0])

print(point_list)

#point = rs.AddPoint(
# ---------- end python_25 ----------
python_26 = GhPythonScript(point_list=branch_20, force=list_item_6.Item1)  # -> out, vector, point_list; inputs point_list: list; same code as python_25
python_27 = GhPythonScript(point_list=pt_28, force=list_item_6.Item2)  # -> out, vector, point_list; inputs point_list: list; same code as python_25
python_28 = GhPythonScript(point_list=branch_21, force=list_item_6.Item3)  # -> out, vector, point_list; inputs point_list: list; same code as python_25
python_29 = GhPythonScript(point_list=pt_29, force=list_item_6.Item4)  # -> out, vector, point_list; inputs point_list: list; same code as python_25
python_30 = GhPythonScript(point_list=branch_22, force=list_item_6.Item5)  # -> out, vector, point_list; inputs point_list: list; same code as python_25

loads_karamba3d = LoadsKaramba3D(ForceVector=flatten(python_25.vector), Local=False, PosInd=flatten(python_25.point_list), LCase="0", mode="Point")
loads_karamba3d_2 = LoadsKaramba3D(ForceVector=flatten(python_26.vector), Local=False, PosInd=flatten(python_26.point_list), LCase="0", mode="Point")
loads_karamba3d_3 = LoadsKaramba3D(ForceVector=flatten(python_27.vector), Local=False, PosInd=flatten(python_27.point_list), LCase="0", mode="Point")
loads_karamba3d_4 = LoadsKaramba3D(ForceVector=flatten(python_28.vector), Local=False, PosInd=flatten(python_28.point_list), LCase="0", mode="Point")
loads_karamba3d_5 = LoadsKaramba3D(ForceVector=flatten(python_29.vector), Local=False, PosInd=flatten(python_29.point_list), LCase="0", mode="Point")
loads_karamba3d_6 = LoadsKaramba3D(ForceVector=flatten(python_30.vector), Local=False, PosInd=flatten(python_30.point_list), LCase="0", mode="Point")
load_karamba3d = LoadKaramba3D([loads_karamba3d, loads_karamba3d_2])
load_karamba3d_2 = LoadKaramba3D([loads_karamba3d, loads_karamba3d_2, loads_karamba3d_3, loads_karamba3d_4, loads_karamba3d_5, loads_karamba3d_6])
filter_24 = StreamFilter(Gate=list_7, Stream1=load_karamba3d, Stream3=load_karamba3d_2)

# ---- group: loads level 1
loads_karamba3d_7 = LoadsKaramba3D(ForceVector=flatten(multiplication_20), Local=False, PosInd=flatten(tree_branch_3), LCase=panel_89, mode="Point")  # disabled

# ---- group: loads level 2
loads_karamba3d_8 = LoadsKaramba3D(ForceVector=flatten(multiplication_19), Local=False, PosInd=flatten(tree_branch_4), LCase=panel_89, mode="Point")  # disabled

# ---- group: loads level 3
loads_karamba3d_9 = LoadsKaramba3D(ForceVector=flatten(multiplication_23), Local=False, PosInd=flatten(tree_branch_5), LCase=panel_89, mode="Point")  # disabled

# ---- group: loads level 4
loads_karamba3d_10 = LoadsKaramba3D(ForceVector=flatten(multiplication_21), Local=False, PosInd=flatten(tree_branch_6), LCase=panel_89, mode="Point")  # disabled

# ---- group: loads level 5
loads_karamba3d_11 = LoadsKaramba3D(ForceVector=flatten(multiplication_22), Local=False, PosInd=flatten(tree_branch_8), LCase=panel_89, mode="Point")  # disabled

# ---- group: loads level 6
loads_karamba3d_12 = LoadsKaramba3D(ForceVector=flatten(multiplication_18), Local=False, PosInd=flatten(tree_branch_7), LCase=panel_89, mode="Point")  # disabled

# ---- group: 1 storey or 3?
load_karamba3d_3 = LoadKaramba3D([loads_karamba3d_7, loads_karamba3d_8])  # disabled
load_karamba3d_4 = LoadKaramba3D([loads_karamba3d_7, loads_karamba3d_8, loads_karamba3d_9, loads_karamba3d_10, loads_karamba3d_11, loads_karamba3d_12])  # disabled
filter_25 = StreamFilter(Gate=list_7, Stream1=load_karamba3d_3, Stream3=load_karamba3d_4)  # disabled

# ----
seismic_mass_list_kg = Panel(python_24.mass_list)

item_31 = ListItem(List=seismic_mass_list_kg, Index="-1", Wrap=True)

# ---- group: EXPORT GEOMETRY GENERATION HEIGHT AND THICKNESS
python_31 = GhPythonScript(
    directory=concatenate_12,
    name=file_path_mesh_6,
    thickness=thickness_of_vault_mm_2,
    height=height_of_slab_m_2,
    keys=panel_46,
    mass=flatten(item_31),
    x=flatten(x_in_meters),
    y=flatten(y_in_meters),
    node_coord=panel_78,
    node_h=panel_79)  # -> out, a; inputs keys: list, node_coord: list, node_h: list
# ---------- python_31: Python ----------
import json
import os



height_dict = {}

for i,val in enumerate(node_h):
    height_dict[i]={}
    height_dict[i]['coordinates']= node_coord[i]
    height_dict[i]['height']= node_h[i]


if not os.path.exists(directory):
    os.makedirs(directory)


thickness = thickness/1000

metrics=[]
metrics.append(height)
metrics.append(thickness)
metrics.append(mass)
metrics.append(x)
metrics.append(y)
metrics.append(height_dict)


dict_metrics= {}
for i,val in enumerate(metrics):
    dict_metrics[keys[i]] = val
print(dict_metrics)


#metrics = tree_to_nested_list(metrics)

with open(name, 'w') as f:
    json.dump(dict_metrics, f)
#print("The list has been written to the JSON file.")
# ---------- end python_31 ----------

# ---- group: force in y axis distributed in points loads
panel_90 = Panel("2")
panel_91 = Panel("5")
panel_92 = Panel("3")
panel_93 = Panel("4")
list_length_3 = ListLength(List=tree_branch)
panel_94 = Panel("seismic")

# ---- group: force in y axis distributed in points loads / level 3
tree_branch_9 = TreeBranch(Tree=point_2, Path=panel_90, MaintainPaths=True)  # -> flatten(Branch)

# ---- group: force in y axis distributed in points loads / level 4
tree_branch_10 = TreeBranch(Tree=point_2, Path=panel_92, MaintainPaths=True)  # -> flatten(Branch)

# ---- group: force in y axis distributed in points loads / level 6
tree_branch_11 = TreeBranch(Tree=point_2, Path=panel_91, MaintainPaths=True)  # -> flatten(Branch)

# ---- group: force in y axis distributed in points loads / level 5
tree_branch_12 = TreeBranch(Tree=point_2, Path=panel_93, MaintainPaths=True)  # -> flatten(Branch)

# ----
list_length_4 = ListLength(List=tree_branch_9)
list_length_5 = ListLength(List=tree_branch_10)
list_length_6 = ListLength(List=tree_branch_12)
list_length_7 = ListLength(List=tree_branch_11)

# ---- group: karamba assembly / beams
panel_95 = Panel(beam_depth_mm)
panel_96 = Panel(beam_width_mm)

# ---- group: karamba assembly / beams / beams y
cross_section_5 = CrossSectionKaramba3D(
    FamilyNameOfCrossSection="DefaultCroSec",
    Material=material_properties_karamba3d,
    Height_cm=expr("x/10", panel_95),
    UpperFlangeWidth_cm=expr("x/10", panel_96),
    LowerFlangeWidth_cm=expr("x/10", panel_96),
    mode="Trapezoid")
linetobeam_5 = LineToBeamKaramba3D(
    Line=crv_14,
    Identifier=panel_23,
    CrossSection=cross_section_5,
    New=True,
    Remove=True,
    LimitDistance_m=0.005,
    Bending=True,
    SetBucklingLength=True,
    ToPolylineMaxAngle=0.03,
    ToPolylineTolerance=0.01,
    ToPolylineMaxEdgeLength=0.25)  # -> Element, Points, Info

# ---- group: karamba assembly / beams / beams y / beams x
linetobeam_6 = LineToBeamKaramba3D(
    Line=crv_13,
    Identifier=panel_23,
    CrossSection=cross_section_5,
    New=True,
    Remove=True,
    LimitDistance_m=0.005,
    Bending=True,
    SetBucklingLength=True,
    ToPolylineMaxAngle=0.03,
    ToPolylineTolerance=0.01,
    ToPolylineMaxEdgeLength=0.25)  # -> Element, Points, Info

# ---- group: karamba assembly / beams (continued)
element = ElementKaramba3D([linetobeam_6.Element, linetobeam_5.Element])

# ---- group: karamba assembly / WALLS?
stream_filter_11 = StreamFilter(
    Gate=list_6,
    Stream1=[linetobeam_3.Element, linetobeam_2.Element, linetobeam_4.Element, linetobeam.Element],
    Stream2=[mesh_to_shell_karamba3d.Element, element])

# ---- group: columns
element_2 = ElementKaramba3D(stream_filter_11)

# ----
filter_26 = StreamFilter(Gate=list_9, Stream1=[mesh_to_shell_karamba3d_2.Element, element_2])

# ---- group: model with walls
assemble_model_karamba3d = AssembleModelKaramba3D(Elem=flatten(filter_26), Support=flatten(filter_22), LimitDistance_m=0.005)  # -> Model, Info, Mass_kg, CenterOfGravity, LoadCaseNames

# ----
model_karamba3d = ModelKaramba3D(assemble_model_karamba3d.Model)

# ---- group: Eigenvalues from stiffness matrix - no mass involved
emodes = EigenModesKaramba(Model=model_karamba3d, FromIndex=1, NumberOfModes=modes, MaximumNumberOfIterations=300, Epsilon=1e-07)  # -> ModelWithEigenModesAsLoadCaseResults, Eigenvalues
eigenvalues = Panel(emodes.Eigenvalues)

# ----
nvibes = NaturalVibrationsKaramba(Model=model_karamba3d, FromIndex=1, NumberOfModes=modes, MaximumNumberOfIterations=30, Epsilon=1e-05)  # -> ModelWithVibrationModesAsLoadCaseResults, NaturalFrequencies_Hz, ModalMass_kg, ParticipationFactorInGlobalXYAndZDirection
participiation_factor = Panel(nvibes.ParticipationFactorInGlobalXYAndZDirection)
modal_mass = Panel(nvibes.ModalMass_kg)
natural_frequencies = Panel(nvibes.NaturalFrequencies_Hz)
division_19 = Division(A="1", B=natural_frequencies)
time_periods = Panel(division_19)

panel_97 = Panel(nvibes.ParticipationFactorInGlobalXYAndZDirection)
partition_list = PartitionList(List=panel_97, Size="3")  # -> simplify(Chunks)
panel_98 = Panel(partition_list)
list_item_7 = ListItem(List=panel_98, Index=0, Wrap=True)  # -> flatten(Item), flatten(Item1), flatten(Item2)
entwine_16 = Entwine(Branch00=list_item_7.Item, Branch01=list_item_7.Item1, Branch02=list_item_7.Item2, FlattenInputs=True)  # -> simplify(Result)
tree_branch_13 = TreeBranch(Tree=simplify(entwine_16), Path="1", MaintainPaths=True)
tree_branch_14 = TreeBranch(Tree=simplify(entwine_16), Path="0", MaintainPaths=True)
tree_branch_15 = TreeBranch(Tree=simplify(entwine_16), Path="2", MaintainPaths=True)

natural_frequencies_2 = Panel(nvibes.NaturalFrequencies_Hz)

modelview = ModelViewKaramba3D(Model=emodes.ModelWithEigenModesAsLoadCaseResults, ResultFactors=1, ResultCase=panel_25)  # -> Model, DeformedMesh, DeformedAxes, DeformedModel
shell_view_karamba3d = ShellViewKaramba3D(Model=modelview.Model, IndexOfLayer=0)  # -> Model, MeshesOfRenderedShells, LegendColors, LegendTags
beamview = BeamViewKaramba3D(Model=modelview.Model)  # -> Model, MeshesOfRenderedBeams, DeformedBeamAxes, LegendColors, LegendTags

participation_factor_y = Panel(tree_branch_13)
participation_factor_x = Panel(tree_branch_14)
participation_factor_z = Panel(tree_branch_15)
square = Square(Value=participation_factor_y)
square_2 = Square(Value=participation_factor_x)
square_3 = Square(Value=participation_factor_z)
effective_mass_x = Panel(square_2)
effective_mass_y = Panel(square)
effective_mass_z = Panel(square_3)

panel_99 = Panel(modal_mass)
sort_list = SortList(Keys=panel_99)  # -> Keys, ValuesValuesA
reverse_list = ReverseList(List=sort_list.Keys)
panel_100 = Panel(reverse_list)
number = Number(panel_100)
number_2 = Number(panel_99)
member_index = MemberIndex(Set=number_2, Member=number)  # -> flatten(Index), Count
mode_indices_modalmass = Panel(member_index.Index)

panel_101 = Panel(x_or_y)
ghpython_script_5 = GhPythonScript(input_term=panel_101, x=participation_factor_x, y=participation_factor_y, z=participation_factor_z)  # -> out, output_term; inputs x: list, y: list, z: list
# ---------- ghpython_script_5: Python ----------
import rhinoscriptsyntax as rs

#print(input_term)
if input_term == 'x':
    output_term = x
elif input_term == 'y':
    output_term = y
elif input_term == 'z':
    output_term = z
# ---------- end ghpython_script_5 ----------
panel_102 = Panel(ghpython_script_5.output_term)

# ---- group: modulus and normalize
ghpython_script_6 = GhPythonScript(x=panel_102)  # -> out, y; inputs x: list
# ---------- ghpython_script_6: Python ----------
import rhinoscriptsyntax as rs

y =[]
for i in x:
    if i<0:
        i=i*-1
    y.append(i)
# ---------- end ghpython_script_6 ----------
panel_103 = Panel(ghpython_script_6.y)

# ---- group: getting index of dominant modes in order
sort_list_2 = SortList(Keys=panel_103)  # -> Keys, ValuesValuesA
reverse_list_2 = ReverseList(List=sort_list_2.Keys)
panel_104 = Panel(reverse_list_2)
number_3 = Number(simplify(panel_103))
number_4 = Number(simplify(panel_104))
member_index_2 = MemberIndex(Set=number_3, Member=number_4)  # -> flatten(Index), Count
mode_indices_participation_factor = Panel(member_index_2.Index)

# ---- group: karamba modal analysis
lng = ListLength(List=entwine_16)  # -> flatten(Length)
item_32 = ListItem(List=lng, Index=0, Wrap=True)
dom = ConstructDomain(DomainStart="1", DomainEnd=item_32)
range = Range(Domain=dom, Steps=dom)
multiplication_24 = Multiplication(A=list_7, B=panel_84)
division_20 = Division(A=entwine_16, B=multiplication_24)
roundd_2 = RoundToDecimalPlace(NumberX=range, DecimalPlace="0", RoundType=0)  # -> flatten(Rounded), Difference
multiplication_25 = Multiplication(A=division_20, B="100")
abs = Absolute(Value=multiplication_25)
python_32 = GhPythonScript(old_list=abs, indices=roundd_2.Rounded)  # -> out, simplify(old_list); inputs old_list: tree, indices: list
# ---------- python_32: Python ----------
import rhinoscriptsyntax as rs
import ghpythonlib.treehelpers as th

# CONVERTING BRANCHES INTO A NESTED LIST
def tree_to_nested_list(x):
    '''Convert a tree into a nested list'''
    nested_list = []
    for i in range(x.BranchCount):
        branchList = x.Branch(i)
        branch=[]
    
        for j in range(branchList.Count):
            s = float(branchList[j])
            branch.append(s)
        nested_list.append(branch)
    return nested_list

old_list = tree_to_nested_list(old_list)

old_list.insert(0,indices)


# Convert the nested list to a data tree
old_list = th.list_to_tree(old_list)
# ---------- end python_32 ----------
ma_4 = MassAddition(Input=abs)  # -> flatten(Result), PartialResults

# ---- group: karamba or alpaca Time period
# EXTRACTING TIME PERIOD BASED ON MASS PARTICIPATION
filter_27 = StreamFilter(Gate=list_9, Stream1=division_19)

# ---- group: karamba or alpaca mass participation
filter_28 = StreamFilter(Gate=list_9, Stream1=python_32.old_list)

# ---- group: Time Period according to modes. index 0 = mode 1
panel_105 = Panel(filter_27)

# ----
karamba_cummulative_mass_particpation = Panel(ma_4.Result)

list_item_8 = ListItem(List=deconstruct_brep_2.Edges, Index=0, Wrap=True)  # -> Item1, Item
addition_7 = Addition(A=number_of_planes_to_cut_from, B="1")
panel_106 = Panel(addition_7)
panel_107 = Panel("seismic")
panel_108 = Panel("vault")

len_4 = Length(Curve=list_item_8.Item)
division_21 = Division(A=len_4, B=panel_106)
X_14 = UnitX(Factor=division_21)
arrlinear = LinearArray(Geometry=list_item_8.Item1, Direction=X_14, Count=panel_106)  # -> Geometry, Transform
cull_i_8 = CullIndex(List=arrlinear.Geometry, Indices="0", Wrap=True)

len_5 = Length(Curve=list_item_8.Item1)
division_22 = Division(A=len_5, B=panel_106)
Y_14 = UnitY(Factor=division_22)
arrlinear_2 = LinearArray(Geometry=list_item_8.Item, Direction=Y_14, Count=panel_106)  # -> Geometry, Transform
cull_i_9 = CullIndex(List=arrlinear_2.Geometry, Indices="0", Wrap=True)

stream_filter_12 = StreamFilter(Gate=ghpython_script_2.output, Stream0=cull_i_8, Stream1=cull_i_9)

move_28 = Move(Geometry=stream_filter_12, Motion=Z)  # -> Geometry, Transform

# ---- group: 3 storey or 1?
Z_12 = UnitZ(Factor=panel_47)
move_29 = Move(Geometry=stream_filter_12, Motion=Z_12)  # -> Geometry, Transform
move_30 = Move(Geometry=move_29.Geometry, Motion=Z_12)  # -> Geometry, Transform
merge_12 = Merge(Data1=stream_filter_12, Data2=move_29.Geometry, Data3=move_30.Geometry)

# ----
move_31 = Move(Geometry=merge_12, Motion=Z)  # -> Geometry, Transform

# ---- group: 3 storey or 1? (continued)
filter_29 = StreamFilter(Gate=list_7, Stream1=move_28.Geometry, Stream3=move_31.Geometry)

# ---- group: DEFLECTION
# EXTRACTING RESULTS OF RSA
panel_110 = Panel("vault")

# ---- group: For PrincForce Val
panel_111 = Panel("PrincForce - Val")

# ---- group: SHEAR FORCE
# shear force Vt
# 
# Turn on display to visualize Vt. Shear force that we use is Vt not Vn
filter_30 = StreamFilter(Gate=ghpython_script_2.output, Stream0=x_in_meters, Stream1=y_in_meters)

# ---- group: Dominant modes for all directions
sort_2 = SortList(Keys=filter_28)  # -> Keys, ValuesA
rev_2 = ReverseList(List=sort_2.Keys)
python_33 = GhPythonScript(
    min_mpr=minium_mass_participation_ratio_per_mode,
    threshold_mpr=total_thrershold_mass_participation_rati,
    old_list=filter_28,
    new_list=rev_2)  # -> out, simplify(new_index), simplify(new_ref_list); inputs old_list: tree, new_list: tree; same code as python_6

# ---- group: Dominant modes for all directions / mode number. 1 = mode 1
panel_112 = Panel(python_33.new_index)

# ---- group: Dominant modes for all directions / mass participation %
panel_113 = Panel(python_33.new_ref_list)

# ---- group: Dominant modes for all directions (continued)
ma_5 = MassAddition(Input=panel_113)  # -> Result, PartialResults

# ---- group: Dominant modes for all directions / mass participation cummulative
panel_114 = Panel(ma_5.Result)

# ----
branch_25 = TreeBranch(Tree=panel_112, Path=ghpython_script_3.output, MaintainPaths=True)
branch_26 = TreeBranch(Tree=panel_113, Path=ghpython_script_3.output, MaintainPaths=True)

# ---- group: mode number
panel_115 = Panel(branch_25)

# ----
item_33 = ListItem(List=simplify(panel_105), Index=expr("x-1", panel_115), Wrap=True)

# ---- group: mass participation %
panel_116 = Panel(branch_26)

# ---- group: Time Periods
panel_117 = Panel(item_33)

# ---- group: getting the modes, Tume periods, and mass particpiation factor for chosen direction
python_34 = GhPythonScript(
    Tp=panel_117,
    mass_par=panel_116,
    mode=panel_115,
    number_of_storeys=list_7,
    threshold_mpr=total_thrershold_mass_participation_rati)  # -> out, mode_chosen, mpr_chosen, T_chosen, dir_true, mpr_tot; inputs Tp: list, mass_par: list, mode: list of Int32, number_of_storeys: Int32
# ---------- python_34: Python ----------
# k is the number of modes

# chosen modes if below mass participation threshold
#for i,val in enumerate(mode):
#    pass
import copy

mode_chosen = []
T_chosen = []
mpr_chosen = []

# set counter to check if T of mode j > 0.9T of mode i
counter = 0
mpr_tot = sum(mass_par)
# Looping in the list
for i,val in enumerate(mode):
    

# condition if cummulative mass participation ratio of modes is below 90%
    if sum(mass_par) >= threshold_mpr:
        condition = 'pass'
        # condition to check if T of mode j > 0.9T of mode i 
        if counter == 0:
            mode_chosen.append(mode[i])
            T_chosen.append(Tp[i])
            mpr_chosen.append(mass_par[i])
            
            t = copy.deepcopy(Tp[i])
            counter+=1
        else:
            if Tp[i] <= 0.9*t:
                mode_chosen.append(mode[i])
                T_chosen.append(Tp[i])
                mpr_chosen.append(mass_par[i])
                
                t = copy.deepcopy(Tp[i])
                counter+=1
    else:
        condition = 'fail'
        k = 3 * (number_of_storeys ** 0.5)
#    for mode_each, mpr_each, T_each in zip(mode,mass_par,T)
        if Tp[i] <= 2:
            if len(mode_chosen) <= k:
                if counter == 0:
                    mode_chosen.append(mode[i])
                    T_chosen.append(Tp[i])
                    mpr_chosen.append(mass_par[i])
                    
                    t = copy.deepcopy(Tp[i])
                    counter+=1
                else:
                    if Tp[i] <= 0.9*t:
                        mode_chosen.append(mode[i])
                        T_chosen.append(Tp[i])
                        mpr_chosen.append(mass_par[i])
                        t = copy.deepcopy(Tp[i])
                        counter+=1
                        # print(mode_chosen)
if condition == 'fail':
    if len(mode_chosen) < k:
#        print('NOTE: Enough modes are not up to the Eurocode 8 standards')
        dir_true = 0
    else:
#        print('NOTE: Modes are up to the Eurocode 8 standards')
        dir_true = 1
else:
#    print('NOTE: Modes are up to the Eurocode 8 standards')
    dir_true = 1
# ---------- end python_34 ----------
mode = Panel(python_34.mode_chosen)
mass_participation = Panel(python_34.mpr_chosen)
tim_periods = Panel(python_34.T_chosen)
mass_participation_total = Panel(python_34.mpr_tot)
panel_118 = Panel(python_34.dir_true)

# ----
time_periods_2 = Panel(tim_periods)

ghpython_script_7 = GhPythonScript(
    a_vault=flatten(area_vault),
    Tp=flatten(time_periods_2),
    ag=flatten("0.2"),
    m=flatten(seismic_mass_list_kg),
    z=flatten(height_list_m),
    storey_no=flatten(panel_73),
    type_ground_macro=flatten("type_1"),
    type_ground_micro=flatten("B"))  # -> out, Fx, Fb; inputs m: list, z: list, storey_no: Int32
# ---------- ghpython_script_7: Python ----------
import rhinoscriptsyntax as rs
#import time

#print('-----------------------------------SEISMIC ANALYSIS.PY STARTS HERE--------------------------------------')

#start_time = time.time()


#####################################################################################################################
####################################################----INPUTS----################################################
#####################################################################################################################

'''VARIABLES INPUT'''
# Time period
#Tp = 0.274706
Tp = round(Tp,2)
# peak ground acceleration
#ag = 0.189
ag = ag*9.81
# mass at intervals

# height at intervals
#z = [3,3.57661]
z = [round(i,5) for i in z]

'''VARIABLES TO BE INPUT'''
## Number of storeys
#storey_no = 1
## type of ground: type_1 or type_2
#type_ground_macro = 'type_1'
## type of ground: A,B,C,D
#type_ground_micro = 'B'

'''CONSTANTS'''
# importance factor. 1 for residential
y1 = 1
# damping ratio
ξ = 1
# behaviour factor
q = 1.5

#####################################################################################################################
####################################################----FORMULA----################################################
#####################################################################################################################

time_list = [i * 0.01 for i in range(401)]
ground_param = {}
ground_param['type_1']={}
ground_param['type_2']={}


########################################### DEFINING S, TB, TC, TD

# # dataframe version 
# ground_param['type_1'] = {
#     "Type": ["A", "B", "C", "D", "E"],
#     "S": [1.0, 1.2, 1.15, 1.35, 1.4],
#     "TB(s)": [0.15, 0.15, 0.20, 0.20, 0.15],
#     "TC(s)": [0.4, 0.5, 0.6, 0.8, 0.5],
#     "TD(s)": [2.0, 2.0, 2.0, 2.0, 2.0]
# }
# ground_param['type_1'] = pd.DataFrame(ground_param["type_1"])

# dict version
ground_param['type_1'] = {
    'A': {'S': 1.00, 'TB(s)': 0.15, 'TC(s)': 0.4, 'TD(s)': 2.0},
    'B': {'S': 1.20, 'TB(s)': 0.15, 'TC(s)': 0.5, 'TD(s)': 2.0},
    'C': {'S': 1.15, 'TB(s)': 0.20, 'TC(s)': 0.6, 'TD(s)': 2.0},
    'D': {'S': 1.35, 'TB(s)': 0.20, 'TC(s)': 0.8, 'TD(s)': 2.0},
    'E': {'S': 1.40, 'TB(s)': 0.15, 'TC(s)': 0.5, 'TD(s)': 2.0}
}

# # dataframe version 
# ground_param['type_2'] = {
#     "Type": ["A", "B", "C", "D", "E"],
#     "S": [1.0, 1.35, 1.5, 1.8, 1.6],
#     "TB(s)": [0.05, 0.05, 0.10, 0.10, 0.05],
#     "TC(s)": [0.25, 0.25, 0.25, 0.30, 0.25],
#     "TD(s)": [1.2, 1.2, 1.2, 1.2, 1.2]
# }
# ground_param['type_2'] = pd.DataFrame(ground_param["type_2"])

# dict version
ground_param['type_2'] = {
    'A': {'S': 1.0, 'TB(s)': 0.05, 'TC(s)': 0.25, 'TD(s)': 1.2},
    'B': {'S': 1.35, 'TB(s)': 0.05, 'TC(s)': 0.25, 'TD(s)': 1.2},
    'C': {'S': 1.5, 'TB(s)': 0.1, 'TC(s)': 0.25, 'TD(s)': 1.2},
    'D': {'S': 1.8, 'TB(s)': 0.1, 'TC(s)': 0.3, 'TD(s)': 1.2},
    'E': {'S': 1.6, 'TB(s)': 0.05, 'TC(s)': 0.25, 'TD(s)': 1.2}
}


########################################### RULES FOR S, TB, TC, TD
Sf= ground_param[type_ground_macro][type_ground_micro]['S']
Tb = ground_param[type_ground_macro][type_ground_micro]['TB(s)']
Tc = ground_param[type_ground_macro][type_ground_micro]['TC(s)']
Td = ground_param[type_ground_macro][type_ground_micro]['TD(s)']


########################################### FINDING Sa(Spectral acceleration for given Time period)
if 0<=Tp<=Tb:
    Sa = ag * Sf * (2/3 + (Tp/Tb)*((2.5/q)-(2/3)))
elif Tb<=Tp<=Tc:
    Sa = ag * Sf * (2.5/q)
elif Tc<=Tp<=Td:
    Sa= ag * Sf * (2.5/q) * (Tc/Tp)
elif Td<=Tp:
    Sa = ag * Sf * (2.5/q) * ((Tc*Td)/(Tp**2))


########################################### FINDING BASE SHEAR

lamda  = 1.0
if Tp <= 2*Tc and storey_no > 2:
    lamda = 0.85

# Base shear in Newtons
Fb = Sa*m[-1]*lamda


########################################### DISTRIBUTION OF HORIZONTAL SEISMIC FORCES

# Force per interval
Fx = []

zjmj = 0
for zi,mi in zip (z,m):
    addition = zi*mi
    zjmj+= addition
#zjmj = sum(zjmj)

for zi,mi in zip (z,m):
    Fi = Fb * (zi * mi)/zjmj
    Fx.append(round(Fi,5))




## Check whether base shear is distributed properly
#if Fb - sum(Fx) > 1 or Fb - sum(Fx) < -1:
#    print('Base shear not distributed properly!')


#####################################################################################################################
####################################################----PLOT----################################################
#####################################################################################################################


# # Design spectrum graph 

# design_response_spectrum = {}
# design_response_spectrum['Sa(g)'] = []
# design_response_spectrum['T(s)'] = []

# for t in time_list:
#     if 0<=t<=Tb:
#         Sa = ag * Sf * (2/3 + (t/Tb)*((2.5/q)-(2/3)))
#     elif Tb<=t<=Tc:
#         Sa = ag * Sf * (2.5/q)
#     elif Tc<=t<=Td:
#         Sa= ag * Sf * (2.5/q) * (Tc/t)
#     elif Td<=t:
#         Sa = ag * Sf * (2.5/q) * ((Tc*Td)/(t**2))

#     design_response_spectrum['Sa(g)'].append(round(Sa,3))
#     design_response_spectrum['T(s)'].append(round(t,2))

# # Finding the spectral acceleration from the given time period
# print(design_response_spectrum['Sa(g)'][design_response_spectrum['T(s)'].index(Tp)])

# plt.figure(figsize=(8, 6))
# plt.plot(design_response_spectrum['T(s)'], design_response_spectrum['Sa(g)'], marker='o', linestyle='-', color='b')
# plt.xlabel('T(s)')
# plt.ylabel('Sa(g)')
# plt.title('Design Response Spectrum')
# plt.grid(False)
# plt.show()


#####################################################################################################################
####################################################----END----################################################
#####################################################################################################################

#end_time = time.time()
#print('Elapsed time = ', end_time - start_time, 'seconds')

#print('-----------------------------------SEISMIC ANALYSIS.PY STARTS HERE--------------------------------------')
# ---------- end ghpython_script_7 ----------
division_23 = Division(A=ghpython_script_7.Fb, B="1000")  # -> simplify(Result)
division_24 = Division(A=ghpython_script_7.Fx, B="1000")  # -> simplify(Result)
fb_before_srss = Panel(division_23)
fx_before_srss = Panel(division_24)

# ---- group: Fx and Fb after SRSS
path_mapper_9 = PathMapper(division_24, source="{A}(i)", target="{i}(A)")
panel_119 = Panel(path_mapper_9)
sqr = Square(Value=panel_119)
ma_6 = MassAddition(Input=sqr)  # -> Result, PartialResults
sqrt = SquareRoot(Value=ma_6.Result)  # -> flatten(Result)
fx_force_applied_per_level_kn = Panel(sqrt)
python_35 = GhPythonScript(x=time_periods_2)  # -> out, output; inputs x: list
# ---------- python_35: Python ----------
import rhinoscriptsyntax as rs
if len(x) ==1:
    output = 1
else:
    output = 0
# ---------- end python_35 ----------
filter_31 = StreamFilter(Gate=python_35.output, Stream0=flatten(fx_force_applied_per_level_kn), Stream1=flatten(fx_before_srss))
ma_7 = MassAddition(Input=filter_31)  # -> Result, PartialResults
fb_base_shear_kn = Panel(ma_7.Result)

# ---- group: Base shear / KN
fb = Panel(fb_base_shear_kn)

# ---- group: load (analytical)
multiplication_26 = Multiplication(A=fb, B="1000")

# ---- group: deflection, V, M
ghpython_script_8 = GhPythonScript(total_load=multiplication_26, L=division_6, b=filter_11, h=filter_10, E=filter)  # -> out, flatten(deflection), flatten(shear), flatten(moment)
# ---------- ghpython_script_8: Python ----------
__author__ = "tahir"
__version__ = "2024.03.07"

import rhinoscriptsyntax as rs



area = L*b
I = b*(h**3)/12

load_per_sq_m = total_load / area
# considering 1m length of beam
W = load_per_sq_m 
# Cantilevered UDL

# max moment in KNm
moment = (W*(L**2)/2)/1000
# max shear force in KN 
shear = (W*L)/1000
# max deflection in mm
deflection = (W*(L**4)/(8*E*I))*1000
# ---------- end ghpython_script_8 ----------

# ---- group: stress analytical
python_36 = GhPythonScript(V=ghpython_script_8.shear, M=ghpython_script_8.moment, b=panel_2, h=filter_10)  # -> out, flatten(shear_stress), flatten(b_stress)
# ---------- python_36: Python ----------
__author__ = "tahir"
__version__ = "2024.03.07"

import rhinoscriptsyntax as rs


y= h/2
I = b*(h**3)/12



# Cantilevered UDL

# max bending stress in MPa
b_stress = (M*y/I)/1000

# max shear stress in MPa in MPa
shear_stress = (1.5*V/(b*h))/1000
# ---------- end python_36 ----------

# ----
deflection_mm_analytical = Panel(ghpython_script_8.deflection)
shear_stress_mpa_analytical = Panel(python_36.shear_stress)
shear_max_kn_analytical = Panel(ghpython_script_8.shear)
moment_max_knm_analytical = Panel(ghpython_script_8.moment)
bending_stress_mpa_analytical = Panel(python_36.b_stress)

# ---- group: Force distrIbution at different levels / KN
fx = Panel(filter_31)

# ----
python_37 = GhPythonScript(
    directory=concatenate_5,
    name=file_path_mesh_3,
    modes=flatten(mode),
    mpr=flatten(mass_participation),
    Tp=flatten(tim_periods),
    keys=flatten(panel_55),
    dir_true=flatten(panel_118),
    mpr_tot=flatten(mass_participation_total),
    mpr_tot_all=flatten(karamba_cummulative_mass_particpation),
    karamba_alpaca_ma=flatten(list_9),
    base_shear=flatten(fb))  # -> out, a; inputs modes: list of Int32, mpr: list, Tp: list, keys: list, mpr_tot_all: list, karamba_alpaca_ma: Int32
# ---------- python_37: Python ----------
import json
import os






# CONVERTING BRANCHES INTO A NESTED LIST
def tree_to_nested_list(x):
    '''Convert a tree into a nested list'''
    nested_list = []
    for i in range(x.BranchCount):
        branchList = x.Branch(i)
        branch=[]
    
        for j in range(branchList.Count):
            s = str(branchList[j])
            branch.append(s)
        nested_list.append(branch)
    return nested_list

if not os.path.exists(directory):
    os.makedirs(directory)


metrics = []
metrics.append(modes)
metrics.append(Tp)
metrics.append(mpr)
metrics.append(mpr_tot)
metrics.append(dir_true)
metrics.append(base_shear)

if karamba_alpaca_ma == 1:
    keys.append('Mass_Participation_total_cumulative(x,y,z)/%')
    metrics.append(mpr_tot_all)


dict_metrics= {}
for i,val in enumerate(metrics):
    dict_metrics[keys[i]] = val
print(dict_metrics)


#metrics = tree_to_nested_list(metrics)

with open(name, 'w') as f:
    json.dump(dict_metrics, f)
#print("The list has been written to the JSON file.")
# ---------- end python_37 ----------

# ---- group: force in y axis distributed in points loads (continued)
list_item_9 = ListItem(List=filter_31, Index=0, Wrap=True)  # -> Item, Item1, Item2, Item3, Item4, Item5

# ---- group: force in y axis distributed in points loads / level 6 force magnitude
division_25 = Division(A=list_item_9.Item5, B=list_length_7)
multiplication_27 = Multiplication(A=stream_filter, B=division_25)

# ---- group: force in y axis distributed in points loads / level 2 force magnitude
division_26 = Division(A=list_item_9.Item1, B=list_length)
multiplication_28 = Multiplication(A=stream_filter, B=division_26)

# ---- group: force in y axis distributed in points loads / level 1 force magnitude
division_27 = Division(A=list_item_9.Item, B=list_length_3)
multiplication_29 = Multiplication(A=stream_filter, B=division_27)

# ---- group: force in y axis distributed in points loads / level 4 force magnitude
division_28 = Division(A=list_item_9.Item3, B=list_length_5)
multiplication_30 = Multiplication(A=stream_filter, B=division_28)

# ---- group: force in y axis distributed in points loads / level 5 force magnitude
division_29 = Division(A=list_item_9.Item4, B=list_length_6)
multiplication_31 = Multiplication(A=stream_filter, B=division_29)

# ---- group: force in y axis distributed in points loads / level 3 force magnitude
division_30 = Division(A=list_item_9.Item2, B=list_length_4)
multiplication_32 = Multiplication(A=stream_filter, B=division_30)

# ----
seismic_force_vector_at_different_level = Panel([multiplication_29, multiplication_28, multiplication_32, multiplication_30, multiplication_31, multiplication_27])  # "seismic force vector at different level / KN"

# ---- group: loads level 1
loads_karamba3d_13 = LoadsKaramba3D(ForceVector=flatten(multiplication_29), Local=False, PosInd=flatten(tree_branch), LCase=panel_94, mode="Point")

# ---- group: loads level 2
loads_karamba3d_14 = LoadsKaramba3D(ForceVector=flatten(multiplication_28), Local=False, PosInd=flatten(tree_branch_2), LCase=panel_94, mode="Point")

# ---- group: loads level 3
loads_karamba3d_15 = LoadsKaramba3D(ForceVector=flatten(multiplication_32), Local=False, PosInd=flatten(tree_branch_9), LCase=panel_94, mode="Point")

# ---- group: loads level 4
loads_karamba3d_16 = LoadsKaramba3D(ForceVector=flatten(multiplication_30), Local=False, PosInd=flatten(tree_branch_10), LCase=panel_94, mode="Point")

# ---- group: loads level 5
loads_karamba3d_17 = LoadsKaramba3D(ForceVector=flatten(multiplication_31), Local=False, PosInd=flatten(tree_branch_12), LCase=panel_94, mode="Point")

# ---- group: loads level 6
loads_karamba3d_18 = LoadsKaramba3D(ForceVector=flatten(multiplication_27), Local=False, PosInd=flatten(tree_branch_11), LCase=panel_94, mode="Point")

# ---- group: 1 storey or 3?
load_karamba3d_5 = LoadKaramba3D([loads_karamba3d_13, loads_karamba3d_14, loads_karamba3d_15, loads_karamba3d_16, loads_karamba3d_17, loads_karamba3d_18])
load_karamba3d_6 = LoadKaramba3D([loads_karamba3d_13, loads_karamba3d_14])
filter_32 = StreamFilter(Gate=list_7, Stream1=load_karamba3d_6, Stream3=load_karamba3d_5)

# ---- group: model with walls
assemble_model_karamba3d_2 = AssembleModelKaramba3D(
    Elem=flatten([mesh_to_shell_karamba3d_2.Element, element_2]),
    Support=flatten(support_karamba3d),
    Load=flatten([filter_24, filter_32]),
    LimitDistance_m=0.005)  # -> Model, Info, Mass_kg, CenterOfGravity, LoadCaseNames

# ---- group: displacement
analyze_karamba3d = AnalyzeKaramba3D(Model=assemble_model_karamba3d_2.Model)  # -> CalculatedModel, MaximumDisplacement_cm, ResultingForceOfGravity_kN, ElasticEnergyChange_kNm
model_view_karamba3d = ModelViewKaramba3D(Model=analyze_karamba3d.CalculatedModel, ResultFactors=1, ResultCase=-1)  # -> Model, DeformedMesh, DeformedAxes, DeformedModel
shell_view_karamba3d_2 = ShellViewKaramba3D(Model=model_view_karamba3d.Model, IndexOfLayer=0)  # -> Model, MeshesOfRenderedShells, LegendColors, LegendTags
legend = Legend(Colour=shell_view_karamba3d_2.LegendColors, Tags=shell_view_karamba3d_2.LegendTags, LegendType=1)

# ----
beam_view_karamba3d = BeamViewKaramba3D(Model=model_view_karamba3d.Model)  # -> Model, MeshesOfRenderedBeams, DeformedBeamAxes, LegendColors, LegendTags
legend_2 = Legend(Colour=beam_view_karamba3d.LegendColors, Tags=beam_view_karamba3d.LegendTags, LegendType=1)

analyzethii = AnalyzeThIIKaramba3D(Model=assemble_model_karamba3d_2.Model, LoadCase="-1", RTolerance=1e-07, MaxIterations=50, NoTensionalNII=False)  # -> CalculatedModel, MaximumDisplacement_cm, ResultingForceOfGravity_kN, ElasticEnergyChange_kNm
bmodes = BucklingModesKaramba3D(Model=analyzethii.CalculatedModel, FromIndex=1, NumberOfModes=1, MaximumNumberOfIterations=300, Epsilon=1e-07)  # -> ModelWithBucklingModesAsLoadCaseResults, flatten(BucklingLoadFactors)

model_view_karamba3d_2 = ModelViewKaramba3D(Model=bmodes.ModelWithBucklingModesAsLoadCaseResults, ResultFactors=1, ResultCase=-1)  # -> Model, DeformedMesh, DeformedAxes, DeformedModel
shell_view_karamba3d_3 = ShellViewKaramba3D(Model=model_view_karamba3d_2.Model, IndexOfLayer=0)  # -> Model, MeshesOfRenderedShells, LegendColors, LegendTags
beam_view_karamba3d_2 = BeamViewKaramba3D(Model=model_view_karamba3d_2.Model)  # -> Model, MeshesOfRenderedBeams, DeformedBeamAxes, LegendColors, LegendTags
legend_3 = Legend(Colour=shell_view_karamba3d_3.LegendColors, Tags=shell_view_karamba3d_3.LegendTags, LegendType=1)
legend_4 = Legend(Colour=beam_view_karamba3d_2.LegendColors, Tags=beam_view_karamba3d_2.LegendTags, LegendType=1)

shell_section_karamba3d = ShellSectionKaramba3D(
    AnalyzedModel=analyze_karamba3d.CalculatedModel,
    Polyline=filter_29,
    ProjectionDirection=Vector(0, 0, -1),
    LayerPosition=0,
    LayerIndex=0,
    mode="Stresses",
    menu=[checkbox(on), checkbox(off), checkbox(off), slider(20), slider(1), slider(1), checkbox(off), checkbox(off), checkbox(off), checkbox(off), checkbox(off), checkbox(off), checkbox(on), slider(1)])  # -> AnalyzedModel, Polylines, FaceIndexes, MeshesOfRenderedResults, CurvesOfRenderedResults, NormalStressInTangentialDirection_kN_cm2, NormalStressInNormalDirection_kN_cm2, InPlaneShearStress_kN_cm2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
panel_120 = Panel(shell_section_karamba3d.NormalStressInNormalDirection_kN_cm2)

# ---- group: SHEAR FORCE
shell_section_karamba3d_2 = ShellSectionKaramba3D(
    AnalyzedModel=analyze_karamba3d.CalculatedModel,
    Polyline=filter_29,
    ProjectionDirection=Vector(0, 0, -1),
    mode="Forces",
    menu=[checkbox(on), checkbox(on), checkbox(off), slider(13), slider(0.11), slider(0.19), checkbox(off), checkbox(off), checkbox(off), checkbox(off), checkbox(on), checkbox(off), checkbox(on), checkbox(off), checkbox(off), slider(1)])  # -> AnalyzedModel, Polylines, FaceIndexes, MeshesOfRenderedResults, CurvesOfRenderedResults, Ntt_kN_m, Nnn_kN_m, Ntn_kN_m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

# ---- group: UTILIZATION
utilization = UtilizationOfElementsKaramba3D(AnalyzedModel=analyze_karamba3d.CalculatedModel, ElementsIdentifiers="vault", mode="Shells")  # -> AnalyzedModel, flatten(Utilization)
sort_3 = SortList(Keys=utilization.Utilization)  # -> Keys, ValuesA
rev_3 = ReverseList(List=sort_3.Keys)

# ----
result_vectors_on_shells_karamba3d = ResultVectorsOnShellsKaramba3D(AnalyzedModel=analyze_karamba3d.CalculatedModel, LayerPosition=0, mode="PrincStress")  # -> AnalyzedModel, simplify(Points), simplify(FirstPrincipalStressVector_kN_cm2), simplify(SecondPrincipalStressVector_kN_cm2), simplify(FirstPrincipalStressValue_kN_cm2), simplify(SecondPrincipalStressValue_kN_cm2)
abs_2 = Absolute(Value=result_vectors_on_shells_karamba3d.SecondPrincipalStressValue_kN_cm2)
abs_3 = Absolute(Value=result_vectors_on_shells_karamba3d.FirstPrincipalStressValue_kN_cm2)
sort_4 = SortList(Keys=abs_2)  # -> Keys, ValuesA
sort_5 = SortList(Keys=abs_3)  # -> Keys, ValuesA
rev_4 = ReverseList(List=sort_4.Keys)
rev_5 = ReverseList(List=sort_5.Keys)
multiplication_33 = Multiplication(A=rev_4, B="0.1")
multiplication_34 = Multiplication(A=rev_5, B="0.1")
panel_121 = Panel(multiplication_33)
panel_122 = Panel(multiplication_34)
item_34 = ListItem(List=panel_121, Index=0, Wrap=True)
item_35 = ListItem(List=panel_122, Index=0, Wrap=True)
max = Maximum(A=item_34, B=item_35)

# ---- group: TENSILE AND COMPRESSIVE STRESS
result_vectors_on_shells_karamba3d_2 = ResultVectorsOnShellsKaramba3D(AnalyzedModel=analyze_karamba3d.CalculatedModel, LayerPosition="1", mode="PrincStress")  # -> AnalyzedModel, simplify(Points), simplify(FirstPrincipalStressVector_kN_cm2), simplify(SecondPrincipalStressVector_kN_cm2), simplify(FirstPrincipalStressValue_kN_cm2), simplify(SecondPrincipalStressValue_kN_cm2)
result_vectors_on_shells_karamba3d_3 = ResultVectorsOnShellsKaramba3D(AnalyzedModel=analyze_karamba3d.CalculatedModel, LayerPosition="-1", mode="PrincStress")  # -> AnalyzedModel, simplify(Points), simplify(FirstPrincipalStressVector_kN_cm2), simplify(SecondPrincipalStressVector_kN_cm2), simplify(FirstPrincipalStressValue_kN_cm2), simplify(SecondPrincipalStressValue_kN_cm2)
sort_6 = SortList(Keys=flatten(result_vectors_on_shells_karamba3d_2.FirstPrincipalStressValue_kN_cm2))  # -> Keys, ValuesA
sort_7 = SortList(Keys=flatten(result_vectors_on_shells_karamba3d_3.FirstPrincipalStressValue_kN_cm2))  # -> Keys, ValuesA
rev_6 = ReverseList(List=sort_6.Keys)
multiplication_35 = Multiplication(A=sort_7.Keys, B="10")
multiplication_36 = Multiplication(A=rev_6, B="10")

# ----
tensile_stress_mpa = Panel(multiplication_36)
compressive_stress_mpa = Panel(multiplication_35)
item_36 = ListItem(List=tensile_stress_mpa, Index=0, Wrap=True)
item_37 = ListItem(List=compressive_stress_mpa, Index=0, Wrap=True)

# ---- group: DEFLECTION (continued)
shell_section_karamba3d_3 = ShellSectionKaramba3D(
    AnalyzedModel=analyze_karamba3d.CalculatedModel,
    ShellsIdentifiers="vault",
    Polyline=filter_29,
    ProjectionDirection=Vector(0, 0, -1),
    mode="Displacements",
    menu=[checkbox(on), checkbox(on), checkbox(off), slider(15), slider(1.27), checkbox(off), checkbox(off), checkbox(off), checkbox(off), checkbox(off), slider(1)])  # -> AnalyzedModel, Polylines, FaceIndexes, MeshesOfRenderedResults, CurvesOfRenderedResults, simplify(XDisplacement_m), simplify(YDisplacement_m), simplify(ZDisplacement_m), simplify(ResultantTranslation_m)
filter_33 = StreamFilter(
    Gate=displacement_direction,
    Stream0=flatten(shell_section_karamba3d_3.XDisplacement_m),
    Stream1=flatten(shell_section_karamba3d_3.YDisplacement_m),
    Stream2=flatten(shell_section_karamba3d_3.ZDisplacement_m))
multiplication_37 = Multiplication(A=flatten(shell_section_karamba3d_3.ResultantTranslation_m), B="1000")
multiplication_38 = Multiplication(A=flatten(filter_33), B="1000")
abs_4 = Absolute(Value=multiplication_38)
abs_5 = Absolute(Value=multiplication_37)
sort_list_3 = SortList(Keys=abs_4)  # -> Keys, ValuesValuesA
sort_list_4 = SortList(Keys=abs_5)  # -> Keys, ValuesValuesA
reverse_list_3 = ReverseList(List=sort_list_3.Keys)
reverse_list_4 = ReverseList(List=sort_list_4.Keys)

# ---- group: directional displacement at cuts/ mm
directional_displacement_mm = Panel(reverse_list_3)

# ---- group: resultant |displacement| resultant at cuts/ mm
# different curves showing different sections
displacement_mm = Panel(reverse_list_4)

# ----
# N1 and N2: principal normal force
# M1 and M2: principal moment per meter. M1 and M2 are the same as the first principal moment and second principal moment in the Shell Forces (Karamba 3D) component
# 
# 
# Vec is the vector (0,0,150KN)
# Val is the value (150KN)
# Moment is given per meter. so you have to multiply it by the length to get the moment
result_vectors_on_shells_karamba3d_4 = ResultVectorsOnShellsKaramba3D(AnalyzedModel=analyze_karamba3d.CalculatedModel, mode="PrincForce")  # -> AnalyzedModel, simplify(Points), FirstPrincipalNormalForceVector_kN_m, SecondPrincipalNormalForceVector_kN_m, FirstPrincipalMomentVector_kN, SecondPrincipalMomentVector_kN, FirstPrincipalNormalForceValue_kN_m, SecondPrincipalNormalForceValue_kN_m, FirstPrincipalMomentValue_kN, SecondPrincipalMomentValue_kN

# ---- group: SHEAR FORCE / shear
branch_27 = TreeBranch(Tree=shell_section_karamba3d_2.Vt_kN_m, Path=toggle_different_cuts, MaintainPaths=True)

# ---- group: SHEAR FORCE / For Moment
# Bending moment causing normal stresses in the direction tangential to the section
abs_6 = Absolute(Value=flatten(shell_section_karamba3d_2.Mtt_kNm_m))
sort_8 = SortList(Keys=abs_6)  # -> Keys, ValuesA
rev_7 = ReverseList(List=sort_8.Keys)
multiplication_39 = Multiplication(A=rev_7, B="1")
principal_moment_knm = Panel(multiplication_39)

# ---- group: SHEAR FORCE / graph shear
filter_34 = StreamFilter(Gate=value_list, Stream0=branch_27, Stream1=shell_section_karamba3d_2.Vt_kN_m)

# ---- group: shear force karamba
graph = QuickGraph(filter_34, SortOrder=0)

# ---- group: SHEAR FORCE / For Moment / moment
branch_28 = TreeBranch(Tree=shell_section_karamba3d_2.Mtt_kNm_m, Path=toggle_different_cuts, MaintainPaths=True)

# ---- group: SHEAR FORCE / absolute max
abs_7 = Absolute(Value=flatten(shell_section_karamba3d_2.Vt_kN_m))
sort_9 = SortList(Keys=flatten(abs_7))  # -> Keys, ValuesA
rev_8 = ReverseList(List=sort_9.Keys)

# ---- group: DEFLECTION / deflection
tree_branch_16 = TreeBranch(Tree=shell_section_karamba3d_3.ResultantTranslation_m, Path=toggle_different_cuts, MaintainPaths=True)

# ---- group: For PrincForce Val (continued)
abs_8 = Absolute(Value=result_vectors_on_shells_karamba3d_4.FirstPrincipalMomentValue_kN)
sort_10 = SortList(Keys=abs_8)  # -> Keys, ValuesA
rev_9 = ReverseList(List=sort_10.Keys)
multiplication_40 = Multiplication(A=rev_9, B="1")
principal_moment_knm_2 = Panel(multiplication_40)

# ---- group: SHEAR FORCE / For Moment / graph moment
filter_35 = StreamFilter(Gate=value_list, Stream0=branch_28, Stream1=shell_section_karamba3d_2.Mtt_kNm_m)

# ---- group: moment karamba
graph_2 = QuickGraph(filter_35, SortOrder=0)

# ---- group: DEFLECTION / graph
filter_36 = StreamFilter(Gate=value_list, Stream0=tree_branch_16, Stream1=shell_section_karamba3d_3.ResultantTranslation_m)

# ---- group: displacement karamba
graph_3 = QuickGraph(filter_36, SortOrder=0)

# ---- group: SHEAR FORCE (continued)
multiplication_41 = Multiplication(A=rev_8, B="1")
shear_force_kn = Panel(multiplication_41)

# ----
multiplication_42 = Multiplication(A=shell_section_karamba3d_3.ResultantTranslation_m, B="1000")
abs_9 = Absolute(Value=multiplication_42)
sort_list_5 = SortList(Keys=abs_9)  # -> Keys, ValuesValuesA
reverse_list_5 = ReverseList(List=sort_list_5.Keys)

# ---- group: interstorey drift
item_38 = ListItem(List=reverse_list_5, Index=0, Wrap=True)  # -> flatten(Item)
partition_5 = PartitionList(List=item_38, Size=number_of_planes_to_cut_from)
sort_11 = SortList(Keys=partition_5)  # -> Keys, ValuesA
rev_10 = ReverseList(List=sort_11.Keys)
item_39 = ListItem(List=rev_10, Index=0, Wrap=True)  # -> flatten(Item)
python_38 = GhPythonScript(displacement_list=item_39, height_list=height_list_m)  # -> out, flatten(drv), flatten(failure); inputs displacement_list: list, height_list: list
# ---------- python_38: Python ----------
__author__ = "tahir"
__version__ = "2024.03.13"

import rhinoscriptsyntax as rs

# q is the behaviour factor (same as material)
q =1.0
# v is the reduction factor based on the importance class as importance class is II, v = 0.5
v=0.5


height_list = [val for i,val in enumerate(height_list) if i%2==1]

# ds is the displacement factored by the behaviour factor q
ds = [q*i/1000 for i in displacement_list]

# dr is the interstorey drift
dr = []
d1 = 0
for i, val in enumerate (ds):
    d2 = val
    dresultant = d2-d1
    dr.append(dresultant)
    d1=val



drv = []
failure = []
counter = 0
for i, val in enumerate(dr):
    drv.append(dr[i]*v/height_list[i])
    if dr[i]*v< 0.01*height_list[i]:
        failure.append('False')
    else:
        counter +=1
        failure.append('True')
#if counter > 0:
#    print('NOTE: Interstorey drift is above acceptable standards')

drv = [str(round(i,8))+'h' for i in drv]
# ---------- end python_38 ----------
interstorey_drift_ratio = Panel(python_38.drv)
acceptable_interstorey_drift = Panel(python_38.failure)

# ----
interstorey_drift_ratio_2 = Panel(python_38.drv)
acceptable_interstorey_drift_2 = Panel(python_38.failure)
principal_stress_mpa = Panel(max)
utilization_2 = Panel(rev_3)
item_40 = ListItem(List=utilization_2, Index=0, Wrap=True)
buckling_load_factor = Panel(bmodes.BucklingLoadFactors)

panel_123 = Panel(item_39)

# ---- group: karamba
item_41 = ListItem(List=displacement_mm, Index=0, Wrap=True)

# ----
utilization_3 = Panel(rev_3)
buckling_load_factor_2 = Panel(bmodes.BucklingLoadFactors)
displacement_mm_2 = Panel(item_41)

# ---- group: Transverse shear force at cuts /KN
shear_force_kn_2 = Panel(multiplication_41)

# ---- group: karamba (continued)
item_42 = ListItem(List=shear_force_kn_2, Index=0, Wrap=True)

# ---- group: moment at cuts /KNm
principal_moment_knm_4 = Panel(multiplication_39)

# ---- group: stress karamba (continued)
item_43 = ListItem(List=principal_moment_knm_4, Index=0, Wrap=True)
python_39 = GhPythonScript(V=item_3, M=item_43, b=panel_2, h=filter_10)  # -> out, flatten(shear_stress), flatten(b_stress); same code as python_36

# ---- group: Transverse shear force at cuts /KN (continued)
shear_stress_mpa_analytical_2 = Panel(python_39.shear_stress)

# ---- group: moment at cuts /KNm (continued)
bending_stress_mpa_analytical_2 = Panel(python_39.b_stress)

# ----
ma_8 = MassAddition(Input=displacement_mm)  # -> Result, PartialResults
lng_2 = ListLength(List=displacement_mm)
ma_9 = MassAddition(Input=shear_force_kn_2)  # -> Result, PartialResults
lng_3 = ListLength(List=shear_force_kn_2)
ma_10 = MassAddition(Input=principal_moment_knm_4)  # -> Result, PartialResults
lng_4 = ListLength(List=principal_moment_knm_4)
division_31 = Division(A=ma_8.Result, B=lng_2)
division_32 = Division(A=ma_9.Result, B=lng_3)
division_33 = Division(A=ma_10.Result, B=lng_4)

# ---- group: displacement_avg/mm
panel_124 = Panel(division_31)

# ---- group: shear_force_avg/KN
panel_125 = Panel(division_32)

# ---- group: bending_moment_avg/KNm
panel_126 = Panel(division_33)

# ---- group: karamba (continued)
item_44 = ListItem(List=principal_moment_knm_4, Index=0, Wrap=True)
merge_13 = Merge(
    Data1=flatten(item_41),
    Data2=flatten(item_42),
    Data3=flatten(item_44),
    Data4=simplify(flatten(shear_stress_mpa_analytical_2)),
    Data5=simplify(flatten(bending_stress_mpa_analytical_2)),
    Data6=flatten(principal_stress_mpa),
    Data7=flatten(panel_124),
    Data8=flatten(panel_125),
    Data9=flatten(panel_126))
panel_127 = Panel(merge_13)

# ---- group: EXPORT PERFORMANCE EVALUTAION
python_40 = GhPythonScript(
    directory=concatenate_7,
    name=file_path_mesh_4,
    metrics=panel_127,
    failure_interstorey_drifts=acceptable_interstorey_drift_2,
    interstorey_drift_ratios=interstorey_drift_ratio_2,
    keys=panel_9,
    buckling_load_factor=flatten(buckling_load_factor),
    utilization=flatten(item_40),
    compressive_stress=item_37,
    tensile_stress=item_36)  # -> out, a; inputs metrics: list, failure_interstorey_drifts: list, interstorey_drift_ratios: list, keys: list
# ---------- python_40: Python ----------
import json
import os






# CONVERTING BRANCHES INTO A NESTED LIST
def tree_to_nested_list(x):
    '''Convert a tree into a nested list'''
    nested_list = []
    for i in range(x.BranchCount):
        branchList = x.Branch(i)
        branch=[]
    
        for j in range(branchList.Count):
            s = str(branchList[j])
            branch.append(s)
        nested_list.append(branch)
    return nested_list

if not os.path.exists(directory):
    os.makedirs(directory)



metrics.append(interstorey_drift_ratios)
metrics.append(failure_interstorey_drifts)
metrics.append(utilization)
metrics.append(buckling_load_factor)
metrics.append(compressive_stress)
metrics.append(tensile_stress)

dict_metrics= {}
for i,val in enumerate(metrics):
    dict_metrics[keys[i]] = val
#print(dict_metrics)


#metrics = tree_to_nested_list(metrics)

with open(name, 'w') as f:
    json.dump(dict_metrics, f)
#print("The list has been written to the JSON file.")
# ---------- end python_40 ----------

# ----
branch_29 = TreeBranch(Tree=panel_52, Path=ghpython_script_3.output, MaintainPaths=True)  # disabled
branch_30 = TreeBranch(Tree=panel_53, Path=ghpython_script_3.output, MaintainPaths=True)  # disabled

# ---- group: mode number
panel_128 = Panel(branch_29)  # disabled

# ----
item_45 = ListItem(List=simplify(panel_45), Index=expr("x-1", panel_128), Wrap=True)  # disabled

# ---- group: mass participation %
panel_129 = Panel(branch_30)  # disabled

# ---- group: Time Periods
panel_130 = Panel(item_45)  # disabled

# ---- group: getting the modes, Tume periods, and mass particpiation factor for chosen direction
python_41 = GhPythonScript(
    Tp=panel_130,
    mass_par=panel_129,
    mode=panel_128,
    number_of_storeys=list_7,
    threshold_mpr=total_thrershold_mass_participation_rati)  # -> out, mode_chosen, mpr_chosen, T_chosen, dir_true, mpr_tot; inputs Tp: list, mass_par: list, mode: list of Int32, number_of_storeys: Int32; disabled
# ---------- python_41: Python ----------
# k is the number of modes

# chosen modes if below mass participation threshold
#for i,val in enumerate(mode):
#    pass
import copy

mode_chosen = []
T_chosen = []
mpr_chosen = []

# set counter to check if T of mode j > 0.9T of mode i
counter = 0

mpr_tot = sum(mass_par)
# Looping in the list
for i,val in enumerate(mode):
    

# condition if cummulative mass participation ratio of modes is below 90%
    if sum(mass_par) >= threshold_mpr:
        condition = 'pass'
        # condition to check if T of mode j > 0.9T of mode i 
        if counter == 0:
            mode_chosen.append(mode[i])
            T_chosen.append(Tp[i])
            mpr_chosen.append(mass_par[i])
            
            t = copy.deepcopy(Tp[i])
            counter+=1
        else:
            if Tp[i] <= 0.9*t:
                mode_chosen.append(mode[i])
                T_chosen.append(Tp[i])
                mpr_chosen.append(mass_par[i])
                
                t = copy.deepcopy(Tp[i])
                counter+=1
    else:
        condition = 'fail'
        k = 3 * (number_of_storeys ** 0.5)
#    for mode_each, mpr_each, T_each in zip(mode,mass_par,T)
        if Tp[i] <= 2:
            if len(mode_chosen) <= k:
                if counter == 0:
                    mode_chosen.append(mode[i])
                    T_chosen.append(Tp[i])
                    mpr_chosen.append(mass_par[i])
                    
                    t = copy.deepcopy(Tp[i])
                    counter+=1
                else:
                    if Tp[i] <= 0.9*t:
                        mode_chosen.append(mode[i])
                        T_chosen.append(Tp[i])
                        mpr_chosen.append(mass_par[i])
                        t = copy.deepcopy(Tp[i])
                        counter+=1
                        # print(mode_chosen)
if condition == 'fail':
    if len(mode_chosen) < k:
        print('NOTE: Enough modes are not up to the Eurocode 8 standards')
        dir_true = 0
    else:
        print('NOTE: Modes are up to the Eurocode 8 standards')
        dir_true = 1
else:
    print('NOTE: Modes are up to the Eurocode 8 standards')
    dir_true = 1
# ---------- end python_41 ----------
tim_periods_2 = Panel(python_41.T_chosen)  # disabled
mass_participation_2 = Panel(python_41.mpr_chosen)  # disabled
mode_2 = Panel(python_41.mode_chosen)  # disabled
panel_131 = Panel(python_41.out)  # disabled
mass_participation_total_2 = Panel(python_41.mpr_tot)  # disabled
direction_true = Panel(python_41.dir_true)  # disabled
